# Grasshopper definition FRP RC Beams Structural Analysis and Optimisation Tool.gh (Grasshopper 1.0.8)
# plug-ins: Heteroptera, Wallacei, ACORN

# Longitudinal Reinforcement
cover_thickness = Slider(0.03, range=0..0.1)
span_m = Slider(6, range=1..10)
bar_dia = ValueList({"H6": 6, "H8": 8, "H10": 10, "H12": 12, "H16": 16, "H20": 20, "H25": 25, "H32": 32, "H40": 40}, selected="H8")
bar_no = Slider(2, range=1..9)
length = Slider(6, range=0..10)
panel = Panel(bar_dia)
ghpython_script = GhPythonScript(dia=bar_dia, no=bar_no)  # -> out, a, As
# ---------- ghpython_script: Python ----------
import math

r = 0.5 * dia

As = (3.14 * (r**2)) * no
# ---------- end ghpython_script ----------
max_d_beam_effective_depth_m = Slider(7, range=0..50)
# Geometry Input
# Effective Depth
min_d_beam_effective_depth_m = Slider(29, range=0..50)
# Spacing
number_slider = Slider(4, range=0..14)
# Beam Width
number_slider_2 = Slider(8, range=0..17)
as_mm2 = Panel(ghpython_script.As)
# Shear Reinforcement
gene_pool = GenePool(Decimals=0, Maximum=5, Minimum=0, Value=[3, 1, 1, 0])
# Shear Reinforcement
cfrp_density_kg_m3 = Panel("1750")
cfrp_kgco2e_kg = Panel("1.8")
concrete_density_kg_m3 = Panel("2400")
steel_kgco2e_kg = Panel("0.76")
c30_37_kgco2e_kg = Panel("0.103")
steel_density_kg_m3 = Panel("7850")
# Material Properties
fck_mpa = Slider(30, range=0..60)
fyk_mpa = Slider(500, range=300..600)
number = Number(steel_density_kg_m3)
number_2 = Number(cfrp_density_kg_m3)
number_3 = Number(steel_kgco2e_kg)
number_4 = Number(cfrp_kgco2e_kg)
number_5 = Number(concrete_density_kg_m3)
number_6 = Number(c30_37_kgco2e_kg)
design_strengths = GhPythonScript(fck=fck_mpa, fyk=fyk_mpa)  # -> out, fcd, fctm, fywd
# ---------- design_strengths: Python ----------
import math
#Determine design compressive strength of concrete
alphaCc = 1 #for shear
gammaC = 1.5

fcd = (alphaCc * fck)/gammaC 

fctm = 0.3 * ((fck)**(2/3)) 

#Determine design yied strength of reinforcement
fywd = fyk / 1.15
# ---------- end design_strengths ----------
ghpython_script_2 = GhPythonScript(fck=fck_mpa, fyk=fyk_mpa)  # -> out, pwmin
# ---------- ghpython_script_2: Python ----------
import math

#Minimum shear reiforcement
sqrt = math.sqrt(fck)
pwmin = ((0.08 * (math.sqrt(fck))) / fyk)
# ---------- end ghpython_script_2 ----------
fcd = Panel(design_strengths.fcd)
fctm = Panel(design_strengths.fctm)
fywd = Panel(design_strengths.fywd)
at_0_01m = Panel("50")
ef_gpa = ValueList({"GFRP": 50, "CFRP": 120}, selected="GFRP")
ef_gpa_2 = ValueList({"GFRP": 50, "CFRP": 120}, selected="CFRP")
at_0_025m = Panel("14")
at_0_01m_2 = Panel("50")
# Spacing Range
construct_domain = ConstructDomain(DomainStart="0.05", DomainEnd="0.4")
range = Range(Domain=construct_domain, Steps=at_0_025m)
construct_domain_2 = ConstructDomain(DomainStart="-0.6", DomainEnd="-0.1")
range_2 = Range(Domain=construct_domain_2, Steps=at_0_01m)
at_1_layer = Panel("5")
# Shear Reinforcement Range
panel_2 = Panel("8.56")
construct_domain_3 = ConstructDomain(DomainStart="0.1", DomainEnd="0.6")
stress_level = GhPythonScript(Ef=ef_gpa_2)  # -> out, ffw
# ---------- stress_level: Python ----------
import math

ffw = 0.004 * (1000 * Ef)
# ---------- end stress_level ----------
range_3 = Range(Domain=construct_domain_3, Steps=at_0_01m_2)
at_0_05m = Panel("17")
# Width Range
panel_3 = Panel("0.075")
list_item = ListItem(List=range, Index=number_slider, Wrap=True)
spacing_m = Panel(list_item)
construct_domain_4 = ConstructDomain(DomainStart=panel_3, DomainEnd="0.5")
construct_domain_5 = ConstructDomain(DomainStart=panel_2, DomainEnd="51.36")
range_4 = Range(Domain=construct_domain_4, Steps=at_0_05m)
range_5 = Range(Domain=construct_domain_5, Steps=at_1_layer)
list_item_2 = ListItem(List=range_2, Index=min_d_beam_effective_depth_m, Wrap=True)
d_at_mid_span_m = Panel(list_item_2)
list_item_3 = ListItem(List=range_3, Index=max_d_beam_effective_depth_m, Wrap=True)
d_at_supports_m = Panel(list_item_3)
mpa = Panel(stress_level.ffw)
number_7 = Number(list_item)
list_item_4 = ListItem(List=range_4, Index=number_slider_2, Wrap=True)
bw_m = Panel(list_item_4)
panel_4 = Panel(range)
list_item_5 = ListItem(List=range_5, Index=gene_pool, Wrap=True)
number_8 = Number(list_item_2)
panel_5 = Panel(range_5)
number_9 = Number(list_item_3)
number_10 = Number(list_item_5)
asw_mm2 = Panel(number_10)
number_11 = Number(list_item_4)
number_of_bars = Slider(2, range=0..20)
tension_rebar_diameter_mm = ValueList({"6", "8", "10", "12", "16", "20", "25", "32"}, selected="8")
number_of_bars_2 = Slider(2, range=0..20)
compression_rebar_diameter_mm = ValueList({"6", "8", "10", "12", "16", "20", "25", "32"}, selected="8")
value_list = ValueList({"Hot rolled mild steel": False, "High yield steel": True}, selected="High yield steel")
make_rebar = MakeRebar(
    NrRebar=number_of_bars_2,
    RebarDiameter=compression_rebar_diameter_mm,
    HighYieldSteel=value_list,
    RebarAxisLength=number_of_bars_2)  # -> Rebar, Label, YieldStrength, Area
make_rebar_2 = MakeRebar(
    NrRebar=number_of_bars,
    RebarDiameter=tension_rebar_diameter_mm,
    HighYieldSteel=value_list,
    RebarAxisLength=number_of_bars)  # -> Rebar, Label, YieldStrength, Area
min_beam_breadth_m = Slider(0.374, range=0.05..1)
max_beam_breadth_m = Slider(0.921, range=0.1..1)
slab_thickness_m = Slider(0.042, range=0..1)
inset_compression_steel_d_m = Slider(0.04, range=0..0.1)
sections = Slider(9, range=3..21)
construct_domain_6 = ConstructDomain(DomainStart=min_beam_breadth_m, DomainEnd=max_beam_breadth_m)
negative = Negative(Value=number_8)
sections_2 = Integer(sections)
range_6 = Range(Domain=Domain(0, 1), Steps=expr("x-1", sections_2))
number_12 = Number(number_11)
construct_domain_7 = ConstructDomain(DomainStart=number_9, DomainEnd=negative)
unit_x = UnitX(Factor=1)
point = Point(Point(0, 0, 0))
line_sdl = LineSDL(Start=point, Direction=unit_x, Length=span_m)
gamma_concrete_weight_density_kn_m3 = Slider(25, range=0..25.51)
gamma_steel_weight_density_kn_m3 = Slider(77, range=0..100)
graph_mapper = GraphMapper(range_6, x0=0, x1=1, y0=0, y1=1, Ox=0.5007289052, Oy=0, Px=1, Py=1, container_name="Parabola")
graph_mapper_2 = GraphMapper(range_6, x0=0, x1=1, y0=0, y1=1, Ox=0.4993772507, Oy=0.9895373583, Px=1, Py=0, container_name="Parabola")
graph_mapper_3 = GraphMapper(
    range_6,
    x0=0,
    x1=1,
    y0=0,
    y1=1,
    container_name="Sine",
    Equation_px=[0, 0.2486483753],
    Equation_py=[0.01884126663, 0.4665032029])
beam_axis = Curve(line_sdl)
fcu_n_mm2 = Panel("30")
fcu_n_mm2_2 = Panel("36.6")
perp_frame = PerpFrame(Curve=reparameterize(beam_axis), Parameter=range_6)
flange_breadth = Multiplication(A=number_12, B="4")
flange_thickness = Multiplication(A=number_12, B="0.5")
fcu_n_mm2_3 = Number(fcu_n_mm2_2)
number_13 = Number(graph_mapper)
number_14 = Number(graph_mapper)
d_beam_effective_depth_m = Number(graph_mapper_2)
bounds = Bounds(Numbers=number_13)
bounds_2 = Bounds(Numbers=number_14)
d_beam_effective_depth_m_2 = Number(number_9)
bounds_3 = Bounds(Numbers=d_beam_effective_depth_m)
remap_numbers = RemapNumbers(Value=number_13, Source=bounds, Target=construct_domain_6)  # -> Mapped, Clipped
remap_numbers_2 = RemapNumbers(Value=number_14, Source=bounds_2, Target=construct_domain_6)  # -> Mapped, Clipped
remap_numbers_3 = RemapNumbers(Value=d_beam_effective_depth_m, Source=bounds_3, Target=construct_domain_7)  # -> Mapped, Clipped
variable_breadth_flange = Number(remap_numbers.Mapped)
variable_breadth = Number(remap_numbers_2.Mapped)
variable_effective_depth = Number(remap_numbers_3.Mapped)
new_beam_section = NewBeamSection(
    EffectiveDepth=variable_effective_depth,
    InsetDepth=inset_compression_steel_d_m,
    TensionRebar=make_rebar_2.Rebar,
    CompressionRebar=make_rebar.Rebar,
    WebBreadth=number_11,
    FlangeBreadth=flange_breadth,
    FlangeThickness=flange_thickness,
    SectionPlane=perp_frame,
    CoverThickness=cover_thickness)  # -> BeamSection, BeamSectionCurves
new_fabric_cross_section = NewFabricCrossSection(
    EffectiveDepth=variable_effective_depth,
    InsetDepth=inset_compression_steel_d_m,
    TensionRebar=make_rebar_2.Rebar,
    CompressionRebar=make_rebar.Rebar,
    WebBreadth=variable_breadth_flange,
    FlangeBreadth=min_beam_breadth_m,
    FlangeThickness=slab_thickness_m,
    SectionPlane=perp_frame,
    CoverThickness=cover_thickness)  # -> BeamSection, BeamSectionCurves
beam_cross_sections = Data(new_beam_section.BeamSection)
shear_stirrup_area_mm2 = Slider(50, range=0..100)
explode_cross_section = ExplodeBeamSection(BeamSection=beam_cross_sections)  # -> EffectiveDepth, InsetDepth, TotalDepth, TensionRebar, CompressionRebar, WebBreadth, FlangeBreadth, FlangeThickness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

# ---- group: labelling cross sections
geometry = Geometry(graft(explode_cross_section.ConcreteSection))
bounding_box = BoundingBox(Content=geometry, Plane=PlaneXY(0, 0, 0))  # -> Box, Box_2
# NON-prismatic
# RC T- beam
evaluate_box = EvaluateBox(Box=bounding_box.Box, UParameter=0.5, VParameter=0.5, WParameter="1")  # -> Plane, Point, Include
point_2 = Point(simplify(evaluate_box.Point))
xz_plane = XZPlane(Origin=point_2)
unit_z = UnitZ(Factor=Slider(0.049, range=0..1))
move = Move(Geometry=xz_plane, Motion=unit_z)  # -> Geometry, Transform
param_viewer = ParamViewer(xz_plane)
text_tag_3d = TextTag3D(Location=move.Geometry, Text=simplify(graft(param_viewer)), Size=Slider(0.063, range=0..1), Justification=9)

# ----
merge = Merge(Data1=explode_cross_section.CompressionRebarPoints, Data2=explode_cross_section.TensionRebarPoints)  # -> simplify(Result)
flip_matrix = FlipMatrix(Data=merge)
non_prismatic = BooleanToggle(True)
interpolate = Interpolate(Vertices=flip_matrix, Degree=3, Periodic=False, KnotStyle=1)  # -> Curve, Length, Domain
fabric = BooleanToggle(False)
# Change in Asw in sections of 1.5m
# Vertical Links Points
# T Section  Points
new_beam = NewBeam(
    NonPrismatic=non_prismatic,
    FabricFormed=fabric,
    Span=span_m,
    TensionRebar=make_rebar_2.Rebar,
    CompressionRebar=make_rebar.Rebar,
    ShearRebar=shear_stirrup_area_mm2,
    CrossSection=beam_cross_sections,
    Fcu=fcu_n_mm2_3)
labels_for_parametric_studies = LabelsForParametricStudies(beam=new_beam)
beam = Data(new_beam)
beam_2 = Data(beam)
make_shear_from_spacing = MakeShearFromSpacing(Beam=beam_2, Spacings=number_7)  # -> Params, MidParams, Spacings, Angles
explode_beam = ExplodeBeam(Beam=beam)  # -> NonPrismatic, FabricFormed, Span, TensionRebar, CompressionRebar, ShearRebar
gbp2 = Geometry(Tree({0}: [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], {1}: [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], {2}: []))
shear_stirrups_area = Number(explode_beam.ShearRebar)
angles = Number(make_shear_from_spacing.Angles)
spacings = Number(make_shear_from_spacing.Spacings)
panel_6 = Panel(shear_stirrups_area)
div = DivideDomain(Domain="1 to 0.5", Count=Slider(4, range=0..10))
mass_addition = MassAddition(Input=spacings)  # -> Result, PartialResults
panel_7 = Panel(div)
panel_8 = Panel(mass_addition.Result)
params_at_mid_diagonal_links = Number(make_shear_from_spacing.MidParams)
params_at_mid_diagonal_links_2 = Number(params_at_mid_diagonal_links)
x_diagonal = Panel(params_at_mid_diagonal_links)
panel_9 = Panel(params_at_mid_diagonal_links_2)
params_at_vertical_links = Number(make_shear_from_spacing.Params)
x_vertical = Panel(params_at_vertical_links)
beam_3 = Data(beam_2)
# SHEAR
# STIRRUPS
evaluate_beam = EvaluateBeam(Beam=beam_3, Parameter=params_at_mid_diagonal_links)  # -> AxisPoint, CrossSection
evaluate_beam_2 = EvaluateBeam(Beam=beam_3, Parameter=params_at_vertical_links)  # -> AxisPoint, CrossSection
evaluate_shear = EvaluateShear(t=params_at_mid_diagonal_links_2, params_at_vertical_links=params_at_vertical_links, spacings=spacings, angles=angles)  # -> spacings_4, angles_4
s = Panel(evaluate_shear.spacings_4)
explode_cross_section_2 = ExplodeCrossSection(CrossSection=evaluate_beam.CrossSection)  # -> EffectiveDepth, InsetDepth, TotalDepth, TensionRebar, CompressionRebar, WebBreadth, FlangeBreadth, FlangeThickness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
minimum_as = GhPythonScript(fck=fck_mpa, ffw=stress_level.ffw, bw=explode_cross_section_2.WebBreadth, s=evaluate_shear.spacings_4)  # -> out, As_min
# ---------- minimum_as: Python ----------
import math

As_min = ((((fck ** (0.5)) * 0.08) / ffw) * (bw * 1000)) * (s * 1000)
# ---------- end minimum_as ----------
as_min = Panel(minimum_as.As_min)
h = Panel(explode_cross_section_2.TotalDepth)
viz_shear_rebar = VizShearRebar(beam=beam_3, cross_sections=evaluate_beam_2.CrossSection)  # -> vertical_links_2, diagonal_links_2, all_links_2, t, D

# ---- group: defineing shear areas (WIP)
number_slider_3 = Slider(4, range=0..10)
panel_10 = Panel("""50
25
25
50""")
div_2 = DivideDomain(Domain="0 to 0.5 ", Count=number_slider_3)
# Alpha & Theta Angles
define_link_areas = DefineLinkAreas(beam_chunk_domains=[div_2, div], shear_link_areas=number_10)
evaluate_link_area = EvaluateLinkArea(shear_link_info=define_link_areas, params=params_at_mid_diagonal_links_2)
evaluate_link_area_2 = EvaluateLinkArea(shear_link_info=define_link_areas, params=viz_shear_rebar.t)
all_links = Geometry(viz_shear_rebar.all_links_2)
len = Length(Curve=all_links)
mm2_m2 = Number(expr("x * 10e-6", evaluate_link_area_2))
multiplication = Multiplication(A=mm2_m2, B=len)
ma = MassAddition(Input=multiplication)  # -> Result, PartialResults
shear_link_volume = Number(ma.Result)
panel_11 = Panel(shear_link_volume)

# ----
pool_controller = PoolController(GenePool=gene_pool, Count=number_slider_3, Randomness=0.1)
panel_12 = Panel(define_link_areas)
asw = Panel(evaluate_link_area)
d = Panel(explode_cross_section_2.EffectiveDepth)
alpha = Panel(evaluate_shear.angles_4)
geometry_2 = Geometry([explode_cross_section_2.CompressionRebarSection, explode_cross_section_2.TensionRebarSection])
section_geometry = Geometry(explode_cross_section_2.ConcreteSection)
bw = Panel(explode_cross_section_2.WebBreadth)
explode_cross_section_3 = ExplodeCrossSection(CrossSection=evaluate_beam_2.CrossSection)  # -> EffectiveDepth, InsetDepth, TotalDepth, TensionRebar, CompressionRebar, WebBreadth, FlangeBreadth, FlangeThickness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
bf = Panel(explode_cross_section_2.FlangeBreadth)
hf = Panel(explode_cross_section_2.FlangeThickness)
depth_at_links = Panel(explode_cross_section_3.EffectiveDepth)
panel_13 = Panel(explode_cross_section_3.CompressionRebar)
angles_2 = Number(angles)
number_15 = Number(viz_shear_rebar.D)
absolute = Absolute(Value=angles_2)
number_16 = Number(flatten(number_15))
quick_graph = QuickGraph(absolute, SortOrder=0)
quick_graph_2 = QuickGraph(number_16, SortOrder=0)
build_beam = BuildBeam(Beam=new_beam)  # -> Beam, Axis, SectionPlanes, BeamSections, FlangeSections, WebSections, ConcreteBeam, CompressionRebars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
explode_beam_2 = ExplodeBeam(Beam=build_beam.Beam)  # -> NonPrismatic, FabricFormed, Span, TensionRebar, CompressionRebar, ShearRebar
panel_14 = Panel(build_beam.TensionAxes)
concrete = Geometry(build_beam.ConcreteBeam)
tens_rebar = Geometry(build_beam.TensionRebars)
comp_rebar = Geometry(build_beam.CompressionRebars)
panel_15 = Panel(tens_rebar)
explode_rebar = ExplodeRebar(Rebar=explode_beam_2.TensionRebar)  # -> NrRebar, RebarDiameter, RebarSteelStrength
merge_2 = Merge(Data1=tens_rebar, Data2=comp_rebar, Data3=concrete)  # -> flatten(Result)
geometry_3 = Geometry(build_beam.TensionAxes)
volume = Volume(Geometry=concrete)  # -> Volume, Centroid
length_2 = Length(Curve=geometry_3)
panel_16 = Panel(explode_rebar.RebarDiameter)
q = Slider(6, range=0..100)
# Forces
g = Slider(6, range=0..100)
sw = Multiplication(A=number_5, B=volume.Volume)
panel_17 = Panel(length_2)
panel_18 = Panel(volume.Volume)
ghpython_script_3 = GhPythonScript(angles=evaluate_shear.angles_4)  # -> out, alpha, c_alpha
# ---------- ghpython_script_3: Python ----------
import math

alpha = angles

if (angles <= 90): #and (c_min > 0.01):
    alpha = angles
else:
    alpha = abs(angles - 180)

if (angles == 90): 
    alpha = 89.9



alpha = round(alpha,0) # theta is expressed in degrees



if (alpha >= 45) and (alpha <=90):
   c_alpha = 1
else:
   c_alpha = 1000000 #put some restraints"""
# ---------- end ghpython_script_3 ----------
med_ved = GhPythonScript(x_of_L=params_at_mid_diagonal_links, L=length, g=g, q=q, sw=sw)  # -> out, MEd, VEd, wk, MEdk
# ---------- med_ved: Python ----------
import math
x = x_of_L * L

sw = ((sw * 9.81) / 1000) / L

wk = g + q + sw

wd = (1.35 * g) + (1.5 * q) + (1.35 * sw)

Ra = (wd * L) / 2

MEd = (Ra * x) - (wd * x * (0.5*x))

VEd = abs(Ra - (wd * x))


Rak = (wk * L) / 2

MEdk = (Rak * x) - (wk * x * (0.5*x))
# ---------- end med_ved ----------
ved = Panel(med_ved.VEd)
alpha_deg_45_90 = Panel(ghpython_script_3.alpha)
c_alpha = Panel(ghpython_script_3.c_alpha)
at_1deg = Panel("23")
# Theta
construct_domain_8 = ConstructDomain(DomainStart="22", DomainEnd="45")
range_7 = Range(Domain=construct_domain_8, Steps=at_1deg)
theta = Panel(range_7)
calculate_theta = GhPythonScript(
    bw=explode_cross_section_2.WebBreadth,
    d=explode_cross_section_2.EffectiveDepth,
    s=evaluate_shear.spacings_4,
    alpha=ghpython_script_3.alpha,
    Asw=evaluate_link_area,
    fck=fck_mpa,
    fcd=design_strengths.fcd,
    fywd=design_strengths.fywd,
    theta=range_7)  # -> out, theta, t, bw, s, d, alpha, fck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; inputs Asw: Int32
# ---------- calculate_theta: Python ----------
import math

"""Find strut angle (theta) on predefined shear reinforcement
VRd,max = VRc,s"""

d = 1000 * d
bw = 1000 * bw
s = 1000 * s
v = 0.6 * (1 - (fck/250))
z = 0.9 * d

#cot_alpha
cot_alpha =  (1 / math.tan(math.radians(alpha)))

#sin_alpha
sin_alpha =  math.sin(math.radians(alpha))

#cos_alpha
cos_alpha =  math.cos(math.radians(alpha))


#cot_theta
cot_theta =  (1 / math.tan(math.radians(theta)))

#Calculate VRd_max / Vcd
VRd_max = (bw * z * v * fcd * (1 / ( 1 + (cot_theta * cot_theta))) * (cot_theta + (cos_alpha / (1 + sin_alpha)))) * 0.001

#Calculate VRd_s / Vsd
VRd_s = ((Asw * fywd * z * (cot_theta + (sin_alpha * (cot_theta + cot_alpha)))) / s) * 0.001


#y = ( 1 / (math.sqrt((((s * bw * v * ( 1 - (0.5 * (math.cos(math.radians(alpha))))) * fcd) / (Asw * fywd * (math.sin(math.radians(alpha)))))-1))))
#theta = round(math.degrees(math.atan(y)),0) # theta is expressed in degrees
"""if (theta >= 21.8) and (theta <=45):
   theta = theta
else:
   theta = 0.01 #put some restraints"""



#Calculate theta from VRd,max,total = VRd,max,vertical + VRd,max,inclined
#VRd_s_vertical = (bw * z * v * fcd / (( 1 / math.tan(math.radians(t))) + math.tan(math.radians(t)))) * 0.001


x = (bw * z * v* fcd) 

y = ((Asw * fywd * z) / s)
# ---------- end calculate_theta ----------
ghpython_script_4 = GhPythonScript(
    x=calculate_theta.x,
    y=calculate_theta.y,
    cot_alpha=calculate_theta.cot_alpha,
    sin_alpha=calculate_theta.sin_alpha,
    cos_alpha=calculate_theta.cos_alpha,
    t=range_7)  # -> out, VRd_max_total, VRd_max_vertical, VRd_max_inclined, VRd_max, VRd_s
# ---------- ghpython_script_4: Python ----------
import math 
#cot_theta
cot_theta =  (1 / math.tan(math.radians(t)))

#Calculate VRd_max (Vcd)
VRd_max = (x * (1 / ( 1 + (cot_theta * cot_theta))) * (cot_theta + (cos_alpha / (1 + sin_alpha)))) * 0.001

#Calculate VRd_s (Vsd)
VRd_s = ((y * (cot_theta + (sin_alpha * (cot_theta + cot_alpha))))) * 0.001



"""
y =  ( 1 / math.tan(math.radians(t))) + math.tan(math.radians(t))
z = ( 1 / math.tan(math.radians(t))) + cot_alpha
zz = ( 1 / math.tan(math.radians(t))) * ( 1 / math.tan(math.radians(t)))
zzz = z / ( 1 + zz)

#Calculate VRd,max,vertical for all thetas
VRd_max_vertical = (x / y) * 0.001
VRd_max_inclined = (x / zzz) * 0.001

#for concrete strut capacity use inclined contibution only
VRd_max_total = VRd_max_inclined"""
# ---------- end ghpython_script_4 ----------
vrd_max = Panel(ghpython_script_4.VRd_max)
vrd_s = Panel(ghpython_script_4.VRd_s)
minimum = Minimum(A=ghpython_script_4.VRd_max, B=ghpython_script_4.VRd_s)
ghpython_script_5 = GhPythonScript(VEd=med_ved.VEd)  # -> out, graft(VEd)
# ---------- ghpython_script_5: Python ----------
import math


VEd = VEd
# ---------- end ghpython_script_5 ----------
min_vrd_max_vrd_s = Panel(minimum)
ved_2 = Panel(ghpython_script_5.VEd)
ghpython_script_6 = GhPythonScript(V=minimum, VEd=ghpython_script_5.VEd)  # -> out, r
# ---------- ghpython_script_6: Python ----------
import math


r = VEd / V
# ---------- end ghpython_script_6 ----------
r = Panel(ghpython_script_6.r)
find_similar_member = FindSimilarMember(Data=Slider(0.98, range=0..1), Set=ghpython_script_6.r)  # -> Hit, flatten(Index)
panel_19 = Panel(find_similar_member.Hit)
panel_20 = Panel(find_similar_member.Index)
dia = Slider(16, range=0..100)
list_item_6 = ListItem(List=range_7, Index=find_similar_member.Index, Wrap=True)
ghpython_script_7 = GhPythonScript(
    h=explode_cross_section_2.TotalDepth,
    d=explode_cross_section_2.EffectiveDepth,
    bw=explode_cross_section_2.WebBreadth,
    bf=explode_cross_section_2.FlangeBreadth,
    hf=explode_cross_section_2.FlangeThickness)  # -> out, y, yt, Ig
# ---------- ghpython_script_7: Python ----------
import math
hw = h - hf
y = ((bf * hf * (0.5*hf)) + (bw * hw * ((0.5 * hw) + hf))) / ((bf * hf) + (hw * bw))
yt = h - y

Ig = (((bf * (hf)**3) / 12) + (bf * hf * ((y - (0.5 * hf))**2))) + (((bw * (hw)**3) / 12) + (bw * hw * ((h - y - (0.5 * hw))**2)))
# ---------- end ghpython_script_7 ----------
theta_2 = Panel(list_item_6)
y = Panel(ghpython_script_7.y)
yt = Panel(ghpython_script_7.yt)
ig = Panel(ghpython_script_7.Ig)
number_17 = Number("0.000001")
area_moments = AreaMoments(Geometry=section_geometry)  # -> Area, Centroid, Inertia, InertiaError, Secondary, SecondaryError, Gyration
inertia_0_iz_iy = Panel(area_moments.Secondary)
calculate_theta_2 = GhPythonScript(
    bw=explode_cross_section_2.WebBreadth,
    d=explode_cross_section_2.EffectiveDepth,
    s=evaluate_shear.spacings_4,
    alpha=ghpython_script_3.alpha,
    Asw=evaluate_link_area,
    fck=fck_mpa,
    fcd=design_strengths.fcd,
    fywd=design_strengths.fywd,
    theta=list_item_6)  # -> out, theta, t, bw, s, d, alpha, fck; inputs Asw: Int32
# ---------- calculate_theta_2: Python ----------
import math

"""Find strut angle (theta) on predefined shear reinforcement
VRd,max = VRc,s"""

d = 1000 * d
bw = 1000 * bw
s = 1000 * s
v = 0.6 * (1 - (fck/250))
z = 0.9 * d

#y = ( 1 / (math.sqrt((((s * bw * v * ( 1 - (0.5 * (math.cos(math.radians(alpha))))) * fcd) / (Asw * fywd * (math.sin(math.radians(alpha)))))-1))))
#theta = round(math.degrees(math.atan(y)),0) # theta is expressed in degrees
"""if (theta >= 21.8) and (theta <=45):
   theta = theta
else:
   theta = 0.01 #put some restraints"""



#Calculate theta from VRd,max,total = VRd,max,vertical + VRd,max,inclined
#VRd_s_vertical = (bw * z * v * fcd / (( 1 / math.tan(math.radians(t))) + math.tan(math.radians(t)))) * 0.001
# ---------- end calculate_theta_2 ----------
cfrp = Multiplication(A=number_4, B=number_2)
steel = Multiplication(A=number_3, B=number)
concrete_2 = Multiplication(A=number_6, B=number_5)
theta_deg_21_8_45 = Panel(calculate_theta_2.theta)
bw_2 = Panel(calculate_theta_2.bw)
s_2 = Panel(calculate_theta_2.s)
distance_x = Multiplication(A=params_at_mid_diagonal_links, B=length)
d_2 = Panel(calculate_theta_2.d)
# Deflection
x = Panel(distance_x)
medk = Panel(med_ved.MEdk)
deflection_limit = Slider(360, range=0..1000)
shear = GhPythonScript(
    VEd=med_ved.VEd,
    alpha=ghpython_script_3.alpha,
    theta=calculate_theta_2.theta,
    bw=explode_cross_section_2.WebBreadth,
    d=explode_cross_section_2.EffectiveDepth,
    fck=fck_mpa,
    fcd=design_strengths.fcd,
    fyk=fyk_mpa,
    Asw=evaluate_link_area,
    ffw=stress_level.ffw,
    s=evaluate_shear.spacings_4,
    fywd=design_strengths.fywd)  # -> out, simplify(VRd), simplify(utilisation)
# ---------- shear: Python ----------
"""Calculate the concrete struct capacity, VRd,max"""

#alphacw = 1 for non-prestressed structures
#cot(theta) = (1 / (math.tan(math.radians(theta)))) 
#cot(alpha) = (1 / (math.tan(math.radians(alpha))))

import math

bw = 1000 * bw
d = 1000 * d
s = 1000 * s

z = 0.9 * d

v = 0.6 * (1 - (fck/250))

#cot_alpha
cot_alpha =  (1 / math.tan(math.radians(alpha)))

#sin_alpha
sin_alpha =  math.sin(math.radians(alpha))

#cos_alpha
cos_alpha =  math.cos(math.radians(alpha))


#cot_theta
cot_theta =  (1 / math.tan(math.radians(theta)))

#Calculate VRd_max (Vcd)
VRd_max = (bw * z * v * fcd * (1 / ( 1 + (cot_theta * cot_theta))) * (cot_theta + (cos_alpha / (1 + sin_alpha)))) * 0.001

#Calculate VRd_s (Vsd)
VRd_s = ((((Asw * fywd * z) / s) * (cot_theta + (sin_alpha * (cot_theta + cot_alpha))))) * 0.001

VRd = min(VRd_max, VRd_s)
"""#Calculate theta from VRd,s,total = VRd,s,vertical + VRd,s,inclined
VRd_s_vertical = ((Asw / s) * z * fywd * (1 / (math.tan(math.radians(theta))))) * 0.001 
VRd_s_inclined = ((Asw / s) * z * fywd * ((1 / (math.tan(math.radians(theta)))) + (1 / (math.tan(math.radians(alpha))))) * (math.sin(math.radians(alpha)))) * 0.001
VRd_s_total = VRd_s_vertical + VRd_s_inclined"""



#Concrete strut capacity expressed in [kN]
#VRd_max = ((bw * z * v * (1 - (0.5 * (math.cos(math.radians(alpha))))) * fcd * ((1 / (math.tan(math.radians(theta)))) + (1 / (math.tan(math.radians(alpha)))))) / ( 1 + ((1 / (math.tan(math.radians(theta))))**2)))/1000))


#a = ((bw * z * v * (1 - (0.5 * (math.cos(math.radians(alpha))))) * fcd * ((1 / (math.tan(math.radians(theta)))) + (1 / (math.tan(math.radians(alpha)))))))

# Vf - contribution to shear capacity of the FRP shear reinforcement [kN]

#Vf =  ((Asw * ffw * d * ((((1 / (math.tan(math.radians(theta)))) - (1 / (math.tan(math.radians(alpha))))) * (math.sin(math.radians(alpha)))) + (1 / (math.tan(math.radians(theta)))))) / s) * 0.001   


#Check utilisation ratio
utilisation = VEd / VRd
# ---------- end shear ----------
# Concrete Capacity
# Calculations
ved_3 = Panel(med_ved.VEd)
vrd_kn = Panel(shear.VRd)
alpha_2 = CullIndex(List=ghpython_script_3.alpha, Indices="0", Wrap=True)
spacing = CullIndex(List=calculate_theta_2.s, Indices="0", Wrap=True)
depth_at_verticals = GhPythonScript(x=explode_cross_section_3.EffectiveDepth)  # -> out, a
# ---------- depth_at_verticals: Python ----------
import math 

a = 1000 * x
# ---------- end depth_at_verticals ----------
shift_list = ShiftList(List=depth_at_verticals.a, Shift=1, Wrap=True)
subtraction = Subtraction(A=shift_list, B=depth_at_verticals.a)
utilisation_shear = Panel(shear.utilisation)
shifted_list_d = Panel(shift_list)
alpha_3 = Panel(alpha_2)
Y = Slider(353.8, range=0..500)
depth_at_verticals_2 = Panel(depth_at_verticals.a)
panel_21 = Panel(subtraction)
s_3 = Panel(spacing)
moment = GhPythonScript(
    bw=explode_cross_section_2.WebBreadth,
    d=explode_cross_section_2.EffectiveDepth,
    fck=fck_mpa,
    fcd=design_strengths.fcd,
    MEd=med_ved.MEd,
    fyk=fyk_mpa,
    As=ghpython_script.As)  # -> out, simplify(utilisation_m), simplify(Asreq), Asprov, MRd, MEd
# ---------- moment: Python ----------
import math

bw = 1000 * bw

d = 1000 * d



v = 0.6 * (1 - (fck/250))

#Moment Calcs
MRd = 0.167 * fck * bw * d * d * 0.000001

utilisation_m = MEd / MRd

Ko = (1000000 * MEd) / (fck * bw * d * d)

#z = d * (0.5 + (math.sqrt(0.25 - ((3 * Ko) / 3.4)))) to be revised later

z = 0.9 * d

Asreq = (1000000 * MEd) / (0.87 * fyk * z)

Asprov = As
# ---------- end moment ----------
min_max = MinMax(Number=moment.Asreq)  # -> Minimum, Maximum
multiplication_2 = Multiplication(A=min_max.Maximum, B=number_17, C=length_2)
# Embodied Carbon
as_max = Panel(min_max.Maximum)
embodied_carbon = GhPythonScript(
    volume_total=volume.Volume,
    volume_asw_total=shear_link_volume,
    volume_as_total=multiplication_2,
    prop_concrete=concrete_2,
    prop_steel=steel,
    prop_CFRP=cfrp)  # -> out, simplify(flatten(carbon)), carbon_c, carbon_asw, carbon_as
# ---------- embodied_carbon: Python ----------
import math

#embodied carbon in concrete
carbon_c = volume_total * prop_concrete
carbon_asw = volume_asw_total * prop_CFRP
carbon_as = volume_as_total * prop_steel

carbon = carbon_c + carbon_asw + carbon_as
# ---------- end embodied_carbon ----------
total_embodied_carbon = Panel(embodied_carbon.carbon)
# G-Code
distance_from_farest_edge_to_fibre_dispe = Panel(Y)  # "Distance from farest edge to fibre dispenser [mm]"
med = Panel(med_ved.MEd)
mrd_knm = Panel(moment.MRd)
ghpython_script_8 = GhPythonScript(x=subtraction)  # -> out, delta_d; inputs x: list
# ---------- ghpython_script_8: Python ----------
import math

delta_d = x
x.insert(0,0)
x.pop()
# ---------- end ghpython_script_8 ----------
ghpython_script_9 = GhPythonScript(alpha=alpha_2, s=spacing, d=depth_at_verticals.a, delta_d=ghpython_script_8.delta_d, Y=Y)  # -> out, alpha, s, d, Yi, delta_d
# ---------- ghpython_script_9: Python ----------
import math

Yi = Y
d = d


#create a list with delta_d
#delta_d = []
#for x in d:
#    delta_d[x] = d[x] - d[x-1]


"""#calcylate disctance Yi from the mandrel
Y = []
Yi = Y

for x in Yi:
    """
# ---------- end ghpython_script_9 ----------
shift_list_2 = ShiftList(List=ghpython_script_9.Yi, Shift=1, Wrap=True)
subtraction_2 = Subtraction(A=shift_list_2, B=ghpython_script_9.Yi)
shifted_y = Panel(shift_list_2)
ghpython_script_10 = GhPythonScript(x=subtraction_2, Y=Y, delta_d=ghpython_script_8.delta_d)  # -> out, new_y; inputs x: list
# ---------- ghpython_script_10: Python ----------
import math

"""delta_d = x
x.insert(0,0)
x.pop()"""

new_y = Y + delta_d
# ---------- end ghpython_script_10 ----------
new_y = Panel(ghpython_script_10.new_y)
utilisation_moment = Panel(moment.utilisation_m)
min_max_2 = MinMax(Number=moment.Asreq)  # -> Minimum, Maximum
cracked_section = GhPythonScript(
    fctm=design_strengths.fctm,
    Ig=ghpython_script_7.Ig,
    yt=ghpython_script_7.yt,
    ccov=cover_thickness,
    As=min_max_2.Maximum,
    fck=fck_mpa,
    h=explode_cross_section_2.TotalDepth,
    d=explode_cross_section_2.EffectiveDepth,
    bw=explode_cross_section_2.WebBreadth,
    bf=explode_cross_section_2.FlangeBreadth,
    hf=explode_cross_section_2.FlangeThickness,
    dia=dia)  # -> out, Mcr, Icr, At, a, b, c, sol_1, sol_2, sol
# ---------- cracked_section: Python ----------
import math


Mcr = (fctm * 1000) * (Ig / yt)

Es = 200
Ec = 22 * (((fck + 8) / 10) ** 0.3)
n = Es / Ec
As = As * (10**(-6))#in [m2]
At = n * As

#c = ( h - ((dia * 0.001) + ccov))
a = 0.5 * bw
b = (bf * hf) - (bw * hf) + At
c = (-0.5 * bf * (hf**2)) + (0.5 * bw * (hf**2)) - (At * d)

d = (b**2) - (4 * a *c)
d = math.sqrt(d)
sol_1 = (-b-d) / (2 * a)
sol_2 = (-b+d) / (2 * a)

sol = max(sol_1, sol_2)

Icr = (((bf * (hf)**3) / 12) + (bf * hf * ((sol - (0.5 * hf))**2))) + (((bw * (sol - hf)**3) / 12) + (bw * (sol - hf) * (((0.5 * (sol - hf)))**2)))
# ---------- end cracked_section ----------
mcr = Panel(cracked_section.Mcr)
sol = Panel(cracked_section.sol)
icr_mm4 = Panel(cracked_section.Icr)
deflection = GhPythonScript(
    Ig=ghpython_script_7.Ig,
    Icr=cracked_section.Icr,
    Mcr=cracked_section.Mcr,
    MEdk=med_ved.MEdk,
    x=distance_x,
    L=length,
    def_limit=deflection_limit,
    fck=fck_mpa,
    q=q)  # -> out, u_d, dlim, dact, dactg, dactcr, status
# ---------- deflection: Python ----------
import math

#delfection limit
dlim = L / def_limit

#modulus of elasticity of concrete in [kN/m2]
Ec = ((22 * (((fck + 8) / 10)**0.3)) * (10**6))

#calculate deflection from GIVEN moment function
dactg = abs((((-1 * q) / (24 * Ec * Ig)) * (x**4)) + (((q * 2 * L) / (24 * Ec * Ig)) * (x**3)) + (((-1 * q * (L**3)) / (24 * Ec * Ig)) * x))
#dusu = (5 * q * (L**4)) / (384 * Ig * Ec)

dactcr = abs((((-1 * q) / (24 * Ec * Icr)) * (x**4)) + (((q * 2 * L) / (24 * Ec * Icr)) * (x**3)) + (((-1 * q * (L**3)) / (24 * Ec * Icr)) * x))


if MEdk < Mcr:
    dact = dactg
else:
    dact = dactcr

if MEdk < Mcr:
    status = 'uncracked'
else:
    status = 'cracked'



u_d = dact / dlim
# ---------- end deflection ----------
dactg_m = Panel(deflection.dactg)
dactcr_m = Panel(deflection.dactcr)
section = Panel(deflection.status)
dact_m = Panel(deflection.dact)
dlim_m = Panel(deflection.dlim)
utilisation_deflection = Panel(deflection.u_d)
delta_d = Panel(ghpython_script_8.delta_d)
alpha_deg = Panel(ghpython_script_9.alpha)
asreq_mm2 = Panel(moment.Asreq)
as_max_2 = Panel(min_max_2.Maximum)
s_mm = Panel(ghpython_script_9.s)
ghpython_script_11 = GhPythonScript(alpha=alpha_2, Y=ghpython_script_9.Yi, s=spacing)  # -> out, delta_s, alpha, tg_alpha, big_s
# ---------- ghpython_script_11: Python ----------
import math

tg_alpha = math.tan(math.radians(alpha))

delta_s = (Y / tg_alpha) - s

big_s = s + delta_s
# ---------- end ghpython_script_11 ----------
d_at_vertical_links = Panel(ghpython_script_9.d)
yi = Panel(ghpython_script_9.Yi)
panel_22 = Panel(ghpython_script_11.alpha)
list_length = ListLength(List=ghpython_script_11.big_s)
tg_alpha = Panel(ghpython_script_11.tg_alpha)
delta_d_2 = Panel(ghpython_script_9.delta_d)
ghpython_script_12 = GhPythonScript(Length=list_length)  # -> out, Index
# ---------- ghpython_script_12: Python ----------
import math



Index = (Length - 1) / 2
# ---------- end ghpython_script_12 ----------
big_s_1 = Panel(ghpython_script_11.big_s)
cut_list_1 = SplitList(List=ghpython_script_11.big_s, Index=ghpython_script_12.Index)  # -> flatten(ListA), ListB
cut_list_2 = SplitList(List=ghpython_script_11.delta_s, Index=ghpython_script_12.Index)  # -> flatten(ListA), ListB
panel_23 = Panel("""90
270""")
delta_s = Panel(ghpython_script_11.delta_s)
big_s_1_2 = Panel(cut_list_1.ListA)
delta_s_2 = Panel(cut_list_2.ListA)
multiplication_3 = Multiplication(A=cut_list_2.ListA, B="-1")
alpha_range = GhPythonScript(alpha=ghpython_script_3.alpha)  # -> out, flatten(a)
# ---------- alpha_range: Python ----------
import math

if (alpha < 45) or (alpha > 90):
    a = 0.0001
else:
    a = 1
# ---------- end alpha_range ----------
delta_s_3 = Panel(multiplication_3)
a = Panel(alpha_range.a)
weave = Weave(Pattern=[0, 1], Stream0=cut_list_1.ListA, Stream1=multiplication_3, NullGaps=False)  # -> flatten(Weave)
theta_range = GhPythonScript(theta=calculate_theta_2.theta)  # -> out, flatten(t)
# ---------- theta_range: Python ----------
import math

if (theta < 21.8) or (theta > 45):
    t = 0.0001
else:
    t = 1
# ---------- end theta_range ----------
panel_24 = Panel(weave)
t = Panel(theta_range.t)
mass_addition_2 = MassAddition(Input=weave)  # -> Result, PartialResults
list_length_2 = ListLength(List=mass_addition_2.PartialResults)
ghpython_script_13 = GhPythonScript(Length=list_length_2)  # -> out, Index
# ---------- ghpython_script_13: Python ----------
import math



Index = (Length - 1)
# ---------- end ghpython_script_13 ----------
ghpython_script_14 = GhPythonScript(Length=ghpython_script_13.Index)  # -> out, Index; same code as ghpython_script_12
duplicate_data = DuplicateData(Data=panel_23, Number=ghpython_script_14.Index, Order=True)  # -> flatten(Data)
panel_25 = Panel(duplicate_data)
mass_addition_3 = MassAddition(Input=["450", duplicate_data])  # -> Result, PartialResults
panel_26 = Panel("""90
270""")
merge_3 = Merge(Data1=a, Data2=t)
code_a = Panel(mass_addition_3.PartialResults)
code_x = Panel(mass_addition_2.PartialResults)
angles_check = Panel(merge_3)
duplicate_data_2 = DuplicateData(Data=panel_26, Number=ghpython_script_14.Index, Order=True)  # -> flatten(Data)
panel_27 = Panel(duplicate_data_2)
number_18 = Number("180")
# Karamba - not to be used for now.
min_max_3 = MinMax(Number=mass_addition_3.PartialResults)  # -> Minimum, Maximum
addition = Addition(A=min_max_3.Maximum, B=number_18)
panel_28 = Panel(min_max_3.Maximum)
panel_29 = Panel(addition)
mass_addition_4 = MassAddition(Input=weave)  # -> Result, reverse(PartialResults)
mass_addition_5 = MassAddition(Input=[addition, duplicate_data_2])  # -> Result, PartialResults
code_a_2 = Panel(mass_addition_5.PartialResults)
reversed_code_x = Panel(mass_addition_4.PartialResults)
ghpython_script_15 = GhPythonScript(x=code_a, y="A")  # -> out, a
# ---------- ghpython_script_15: Python ----------
import math


a = y + x
# ---------- end ghpython_script_15 ----------
ghpython_script_16 = GhPythonScript(x=code_x, y="X")  # -> out, a; same code as ghpython_script_15
panel_30 = Panel(ghpython_script_15.a)
panel_31 = Panel(ghpython_script_16.a)
weave_2 = Weave(Pattern=[0, 1], Stream0=ghpython_script_15.a, Stream1=ghpython_script_16.a, NullGaps=False)
code_half = Panel(weave_2)
ghpython_script_17 = GhPythonScript(x=reversed_code_x, y="X")  # -> out, a; same code as ghpython_script_15
ghpython_script_18 = GhPythonScript(x=code_a_2, y="A")  # -> out, a; same code as ghpython_script_15
panel_32 = Panel(ghpython_script_17.a)
panel_33 = Panel(ghpython_script_18.a)
weave_3 = Weave(Pattern=[0, 1], Stream0=ghpython_script_18.a, Stream1=ghpython_script_17.a, NullGaps=False)
ghpython_script_19 = GhPythonScript(x=weave_2, y=weave_3)  # -> out, a; inputs x: list, y: list
# ---------- ghpython_script_19: Python ----------
import math

a = x + y
# ---------- end ghpython_script_19 ----------
code = Panel(ghpython_script_19.a)
# Utilisations
utilisation_s = Panel(shear.utilisation)
code_half_2 = Panel(weave_3)
utilisation_d = Panel(utilisation_deflection)
# Utilisation Check
ghpython_script_20 = GhPythonScript(
    c_alpha=ghpython_script_3.c_alpha,
    utilisation_s=shear.utilisation,
    utilisation_m=moment.utilisation_m,
    utilisation_d=deflection.u_d)  # -> out, c_alpha, c_s, c_m, c_d
# ---------- ghpython_script_20: Python ----------
import rhinoscriptsyntax as rs

import math


if (utilisation_s <= 1):
   c_s = 1
else:
   c_s = 1000000 #put some restraints"""


if (utilisation_m <= 1):
   c_m = 1
else:
   c_m = 1000000 #put some restraints"""



if (utilisation_d <= 1):
   c_d = 1
else:
   c_d = 1000000 #put some restraints"""


c_alpha = c_alpha
# ---------- end ghpython_script_20 ----------
merge_4 = Merge(
    Data1=simplify(graft(ghpython_script_20.c_alpha)),
    Data2=simplify(graft(ghpython_script_20.c_s)),
    Data3=simplify(graft(ghpython_script_20.c_m)),
    Data4=simplify(graft(ghpython_script_20.c_d)))  # -> flatten(Result)
utillisation_check = Panel(merge_4)
ghpython_script_21 = GhPythonScript(x=simplify(flatten(merge_4)), y=simplify(flatten(embodied_carbon.carbon)))  # -> out, flatten(list_c), nl; inputs x: list
# ---------- ghpython_script_21: Python ----------
import math

#y is a value of carbon

nx = []
for i in x:
    nx.append(float(i))

list_c = []
for i in nx:
    if (i < 0.00000001) or ((i <= 1) and (i > 0.01)):
        list_c.append(y)
    else:
        list_c.append(1000000)
# ---------- end ghpython_script_21 ----------
panel_34 = Panel(ghpython_script_21.list_c)
min_max_4 = MinMax(Number=ghpython_script_21.list_c)  # -> Minimum, Maximum
c = Panel(min_max_4.Maximum)
# Optimization
wallacei_x = WallaceiX(
    Genes=[gene_pool, min_d_beam_effective_depth_m, max_d_beam_effective_depth_m, number_slider_2, number_slider],
    Objectives=min_max_4.Maximum,
    allFitness="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",
    allFrontIdx="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",
    allGenomes="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",
    curFrontIdx="59|0;59|1;59|2;59|3;59|4;59|5;59|6;59|7;59|8;59|9;59|10;59|11;59|12;59|13;59|14;59|15;59|16;59|17;59|18;59|19;59|20;59|21;59|22;59|23;59|24;59|25;59|26;59|27;59|28;59|29",
    curFrontIdxSave="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",
    popGen="30,60",
    total="1758453",
    wlcDone=True)  # -> WallaceiGenomes, FitnessValues, Data, Phenotypes
fitness_values = Panel(wallacei_x.FitnessValues)
stirrups = Geometry([viz_shear_rebar.vertical_links_2, viz_shear_rebar.diagonal_links_2])
beam_geometry = Geometry([tens_rebar, comp_rebar, concrete, viz_shear_rebar.vertical_links_2, viz_shear_rebar.diagonal_links_2])
# Visualisation
sections_geometry = Geometry([viz_shear_rebar.vertical_links_2, viz_shear_rebar.diagonal_links_2, section_geometry, geometry_2])

# ==== cluster LabelsForParametricStudies
beam = ClusterInput()
beam_2 = Data(beam)
timer = Timer(Interval=1000, TimerInterval=1000, Target=panel)  # disabled
panel = Panel("now")
a_explodebeam = ExplodeBeam(Beam=beam_2)  # -> NonPrismatic, FabricFormed, Span, TensionRebar, CompressionRebar, ShearRebar
span = Number(a_explodebeam.Span)
a_bbeam = BuildBeam(Beam=beam_2)  # -> Beam, Axis, SectionPlanes, BeamSections, FlangeSections, WebSections, ConcreteBeam, CompressionRebars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
time = Time(panel)
a_exploderebar = ExplodeRebar(Rebar=a_explodebeam.TensionRebar)  # -> NrRebar, RebarDiameter, RebarSteelStrength
concat = Concatenate(FragmentA="time = ", FragmentB=time)
beam_cross_sections = Data(a_bbeam.BeamSections)
a_explodesection = ExplodeBeamSection(BeamSection=beam_cross_sections)  # -> EffectiveDepth, InsetDepth, TotalDepth, TensionRebar, CompressionRebar, WebBreadth, FlangeBreadth, FlangeThickness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
effective_depth = Number(a_explodesection.EffectiveDepth)
web_width = Number(a_explodesection.WebBreadth)
division = Division(A=span, B=effective_depth)
concat_2 = Concatenate(
    FragmentA="span = ",
    FragmentB=span,
    FragmentC="; web width = ",
    FragmentD=web_width,
    FragmentE="; effective depth = ",
    FragmentF=effective_depth,
    FragmentG="; span/depth ratio = ",
    FragmentH=division)
number_slider = Slider(1.2, range=0..6)  # disabled
number_slider_2 = Slider(1, range=0..1)  # disabled
a_makerebar = MakeRebar()  # -> Rebar, Label, YieldStrength, Area

# ---- group: rebar label for parametric studies
number_slider_3 = Slider(0.1, range=0..0.1)  # disabled
X = UnitX(Factor=number_slider_3)  # disabled
Z = UnitZ(Factor=number_slider_3)  # disabled
bbox = BoundingBox(Content=a_bbeam.TensionRebars, Plane=PlaneXY(0, 0, 0), UnionBox=True)  # -> Box, Box_2; disabled
panel_2 = Panel("0")  # disabled
addition = Addition(A=X, B=Z)  # disabled
box = EvaluateBox(Box=bbox.Box, UParameter=panel_2, VParameter=0.5, WParameter=0.5)  # -> Plane, Point, Include; disabled
rev = Reverse(Vector=addition)  # disabled
# rebar short code
# (e.g. 2t20)
# should be output of explode rebar
move = Move(Geometry=box.Point, Motion=rev)  # -> Geometry, Transform; disabled
yz = YZPlane(Origin=move.Geometry)  # disabled
deplane = DeconstructPlane(Plane=yz)  # -> Origin, XAxis, YAxis, ZAxis; disabled
rev_2 = Reverse(Vector=deplane.XAxis)  # disabled
pl = ConstructPlane(Origin=deplane.Origin, XAxis=rev_2, YAxis=deplane.YAxis)  # disabled
tag = TextTag3D(Location=pl, Text=a_makerebar.Label, Size=number_slider_3, Justification=5)  # disabled

# ----
panel_3 = Panel("use TR")
a_makerebar_2 = MakeRebar()  # -> Rebar, Label, YieldStrength, Area

# ---- group: rebar label for parametric studies
number_slider_4 = Slider(0.1, range=0..0.1)  # disabled
X_2 = UnitX(Factor=number_slider_4)  # disabled
Z_2 = UnitZ(Factor=number_slider_4)  # disabled
bbox_2 = BoundingBox(Content=a_bbeam.CompressionRebars, Plane=PlaneXY(0, 0, 0), UnionBox=True)  # -> Box, Box_2; disabled
panel_4 = Panel("0")  # disabled
rev_3 = Reverse(Vector=X_2)  # disabled
box_2 = EvaluateBox(Box=bbox_2.Box, UParameter=panel_4, VParameter=0.5, WParameter=0.5)  # -> Plane, Point, Include; disabled
addition_2 = Addition(A=rev_3, B=Z_2)  # disabled
move_2 = Move(Geometry=box_2.Point, Motion=addition_2)  # -> Geometry, Transform; disabled
yz_2 = YZPlane(Origin=move_2.Geometry)  # disabled
deplane_2 = DeconstructPlane(Plane=yz_2)  # -> Origin, XAxis, YAxis, ZAxis; disabled
rev_4 = Reverse(Vector=deplane_2.XAxis)  # disabled
pl_2 = ConstructPlane(Origin=deplane_2.Origin, XAxis=rev_4, YAxis=deplane_2.YAxis)  # disabled
tag_2 = TextTag3D(Location=pl_2, Text=a_makerebar_2.Label, Size=number_slider_4, Justification=5)  # disabled

# ----
panel_5 = Panel("use CR")

# ---- group: rebar label for parametric studies
number_slider_5 = Slider(0.1, range=0..0.1)  # disabled
X_3 = UnitX(Factor=number_slider_5)  # disabled
Z_3 = UnitZ(Factor=number_slider)  # disabled
bbox_3 = BoundingBox(Content=a_bbeam.CompressionRebars, Plane=PlaneXY(0, 0, 0), UnionBox=True)  # -> Box, Box_2; disabled
panel_6 = Panel("0")  # disabled
rev_5 = Reverse(Vector=Z_3)  # disabled
box_3 = EvaluateBox(Box=bbox_3.Box, UParameter=0.5, VParameter=0.5, WParameter=0.5)  # -> Plane, Point, Include; disabled
addition_3 = Addition(A=rev_5, B=Z_3)  # disabled
move_3 = Move(Geometry=box_3.Point, Motion=rev_5)  # -> Geometry, Transform; disabled
yz_3 = YZPlane(Origin=move_3.Geometry)  # disabled

# ----
xz = XZPlane(Origin=move_3.Geometry)  # disabled

# ---- group: rebar label for parametric studies (continued)
deplane_3 = DeconstructPlane(Plane=xz)  # -> Origin, XAxis, YAxis, ZAxis; disabled
rev_6 = Reverse(Vector=deplane_3.XAxis)  # disabled
pl_3 = ConstructPlane(Origin=deplane_3.Origin, XAxis=deplane_3.XAxis, YAxis=deplane_3.YAxis)  # disabled
tag_3 = TextTag3D(Location=xz, Text=concat, Size=number_slider_5, Justification=5)  # disabled

number_slider_6 = Slider(0.1, range=0..0.1)  # disabled
X_4 = UnitX(Factor=number_slider_6)  # disabled
Z_4 = UnitZ(Factor=number_slider_2)  # disabled
bbox_4 = BoundingBox(Content=a_bbeam.CompressionRebars, Plane=PlaneXY(0, 0, 0), UnionBox=True)  # -> Box, Box_2; disabled
rev_7 = Reverse(Vector=Z_4)  # disabled
box_4 = EvaluateBox(Box=bbox_4.Box, UParameter=0.5, VParameter=0.5, WParameter=0.5)  # -> Plane, Point, Include; disabled
addition_4 = Addition(A=rev_7, B=Z_4)  # disabled
move_4 = Move(Geometry=box_4.Point, Motion=rev_7)  # -> Geometry, Transform; disabled
yz_4 = YZPlane(Origin=move_4.Geometry)  # disabled

# ----
xz_2 = XZPlane(Origin=move_4.Geometry)  # disabled

# ---- group: rebar label for parametric studies (continued)
deplane_4 = DeconstructPlane(Plane=xz_2)  # -> Origin, XAxis, YAxis, ZAxis; disabled
rev_8 = Reverse(Vector=deplane_4.XAxis)  # disabled
pl_4 = ConstructPlane(Origin=deplane_4.Origin, XAxis=deplane_4.XAxis, YAxis=deplane_4.YAxis)  # disabled
tag_4 = TextTag3D(Location=xz_2, Text=concat_2, Size=number_slider_6, Justification=5)  # disabled

# ==== cluster EvaluateShear
params_at_vertical_links = ClusterInput()
spacings = ClusterInput()
t = ClusterInput()
angles = ClusterInput()
params_at_vertical_links_2 = Number(params_at_vertical_links)
t_2 = Number(t)
angles_2 = Number(angles)
spacings_2 = Number(spacings)
consec = ConsecutiveDomains(Numbers=params_at_vertical_links_2, Additive=False)
fdom = FindDomain(Domains=consec, Number=t_2, Strict=False)  # -> Index, Neighbour
item = ListItem(List=spacings_2, Index=fdom.Index, Wrap=True)
item_2 = ListItem(List=angles_2, Index=fdom.Index, Wrap=True)
angles_3 = Number(item_2)
spacings_3 = Number(item)
angles_4 = ClusterOutput(angles_3)
spacings_4 = ClusterOutput(spacings_3)

# ==== cluster DefineLinkAreas
beam_chunk_domains = ClusterInput()
shear_link_areas = ClusterInput()
beam_chunk_domains_2 = Domain(beam_chunk_domains)
shear_link_areas_2 = Number(shear_link_areas)
entwine = Entwine(Branch00=beam_chunk_domains_2, Branch01=shear_link_areas_2, FlattenInputs=True)  # -> simplify(Result)
shear_link_info = Data(entwine)
shear_link_info_2 = ClusterOutput(shear_link_info)

# ==== cluster EvaluateLinkArea
shear_link_info = ClusterInput()
params = ClusterInput()
shear_link_info_2 = Data(shear_link_info)
params_2 = Number(params)
bang = ExplodeTree(Data=shear_link_info_2)  # -> Branch0, Branch1
shear_link_areas = Number(bang.Branch1)
beam_chunk_domains = Domain(bang.Branch0)
fdom = FindDomain(Domains=beam_chunk_domains, Number=params_2, Strict=False)  # -> Index, Neighbour
item = ListItem(List=shear_link_areas, Index=fdom.Index, Wrap=True)
link_areas_at_params = Number(item)
link_areas_at_params_2 = ClusterOutput(link_areas_at_params)

# ==== cluster VizShearRebar
beam = ClusterInput()
cross_sections = ClusterInput()
beam_2 = Data(beam)
cross_sections_2 = Data(cross_sections)
lng = ListLength(List=cross_sections_2)
division = Division(A=lng, B="2")
split = SplitList(List=cross_sections_2, Index=division)  # -> ListA, ListB
# viz shear uses the mirrored tree structure
rev = ReverseList(List=split.ListB)
entwine = Entwine(Branch00=split.ListA, Branch01=rev, FlattenInputs=True)  # -> simplify(Result)
shear_rebar_diameter_mm = ValueList({"6", "8", "10", "12", "16", "20", "25", "32"}, selected="20")
a_explodesection = ExplodeCrossSection(CrossSection=simplify(entwine))  # -> EffectiveDepth, InsetDepth, TotalDepth, TensionRebar, CompressionRebar, WebBreadth, FlangeBreadth, FlangeThickness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
shear_rebar_diameter_mm_2 = Number(shear_rebar_diameter_mm)
merge = Merge(Data1=a_explodesection.CompressionRebarSection, Data2=a_explodesection.TensionRebarSection)  # -> simplify(Result)
divide = DivideCurve(Curve=merge, Count="100", Kinks=False)  # -> simplify(Points), Tangents, Parameters
pln = Plane(simplify(graft(a_explodesection.SectionPlanes)))
trim = TrimTree(Tree=divide.Points, Depth=1)
hull = ConvexHull(Points=trim, Plane=pln)  # -> Hull, HullZ, Indices

# ---- group: shear rebar ends
stepsize = Slider(0, range=0..0.1)  # disabled
number_slider = Slider(100, range=0..100)  # disabled
number_slider_2 = Slider(500, range=0..1000)  # disabled
reb = RebuildCurve(Curve=hull.Hull, Count=number_slider_2, Tangents=False)  # disabled
cp = ControlPoints(Curve=reb)  # -> simplify(Points), Weights, Knots; disabled
shear_rebar_radius_m = Number(stepsize)  # disabled
lng_2 = ListLength(List=cp.Points)  # disabled
panel = Panel("1")  # disabled
subtraction = Subtraction(A=lng_2, B=panel)  # disabled
neg = Negative(Value=shear_rebar_radius_m)  # disabled
pln_2 = Plane(pln)  # disabled
dom = ConstructDomain(DomainStart=neg, DomainEnd=shear_rebar_radius_m)  # disabled
range = Range(Domain=dom, Steps=subtraction)  # -> simplify(Range); disabled
deplane = DeconstructPlane(Plane=pln_2)  # -> Origin, XAxis, YAxis, ZAxis; disabled
amp = Amplitude(Vector=deplane.ZAxis, Amplitude=range)  # disabled
move = Move(Geometry=cp.Points, Motion=amp)  # -> simplify(Geometry), Transform; disabled
intcrv = Interpolate(Vertices=move.Geometry, Degree=3, Periodic=False, KnotStyle=1)  # -> Curve, Length, Domain; disabled
trim_2 = TrimTree(Tree=intcrv.Curve, Depth=1)  # disabled

# ----
trim_3 = TrimTree(Tree=hull.Hull, Depth=1)
trim_4 = TrimTree(Tree=pln, Depth=1)
vertical_stirrups = Geometry(trim_3)
bbox = BoundingBox(Content=graft(vertical_stirrups), Plane=graft(trim_4))  # -> simplify(Box), Box_2
trim_5 = TrimTree(Tree=bbox.Box, Depth=1)
shift = ShiftList(List=trim_5, Shift=1, Wrap=False)  # -> simplify(List)
box_corners = BoxCorners(Box=trim_5)  # -> CornerA, CornerB, CornerC, CornerD, CornerE, CornerF, CornerG, CornerH
rec_2pt = Rectangle2Pt(Plane=trim_4, PointA=box_corners.CornerA, PointB=box_corners.CornerC, Radius=0)  # -> Rectangle, Length
box = EvaluateBox(Box=trim_5, UParameter="1", VParameter=0.5, WParameter=0.5)  # -> Plane, Point, Include
box_2 = EvaluateBox(Box=shift, UParameter="0", VParameter=0.5, WParameter=0.5)  # -> Plane, Point, Include
cull_i = CullIndex(List=box_corners.CornerC, Indices="-1", Wrap=True)  # -> simplify(List)
deplane_2 = DeconstructPlane(Plane=box.Plane)  # -> Origin, XAxis, YAxis, ZAxis
vec2pt = Vector2Pt(PointA=box_2.Point, PointB=box.Point, Unitize=True)  # -> Vector, Length
pl = ConstructPlane(Origin=deplane_2.Origin, XAxis=vec2pt.Vector, YAxis=deplane_2.YAxis)  # -> simplify(Plane)
box_corners_2 = BoxCorners(Box=shift)  # -> CornerA, CornerB, CornerC, CornerD, CornerE, CornerF, CornerG, CornerH
cull_i_2 = CullIndex(List=pl, Indices="-1", Wrap=True)  # -> simplify(List)
rec_2pt_2 = Rectangle2Pt(Plane=cull_i_2, PointA=box_corners_2.CornerA, PointB=cull_i, Radius=0)  # -> simplify(Rectangle), Length
recmap = RectangleMapping(Geometry=vertical_stirrups, Source=rec_2pt.Rectangle, Target=rec_2pt_2.Rectangle)  # -> Geometry, Transform
cull_i_3 = CullIndex(List=recmap.Geometry, Indices="-1", Wrap=True)
diagonal_links = Geometry(cull_i_3)
vertical_links = Geometry(vertical_stirrups)
weave = Weave(Pattern=[0, 1], Stream0=vertical_links, Stream1=diagonal_links, NullGaps=False)
bang = ExplodeTree(Data=weave)  # -> Branch0, Branch1

# ---- group: checking angles
explode = Explode(Curve=rec_2pt_2.Rectangle, Recursive=True)  # -> Segments, Vertices
explode_2 = Explode(Curve=rec_2pt.Rectangle, Recursive=True)  # -> Segments, Vertices
item = ListItem(List=explode.Segments, Index=0, Wrap=True)
item_2 = ListItem(List=explode_2.Segments, Index=0, Wrap=True)
end = EndPoints(Curve=item)  # -> Start, End
end_2 = EndPoints(Curve=item_2)  # -> Start, End
pt = Point(end.End)
pt_2 = Point(end_2.End)
vec2pt_2 = Vector2Pt(PointA=end.End, PointB=end.Start, Unitize=False)  # -> Vector, Length
vec2pt_3 = Vector2Pt(PointA=end_2.End, PointB=end_2.Start, Unitize=False)  # -> Vector, Length
angle = Angle(VectorA=vec2pt_3.Vector, VectorB=vec2pt_2.Vector)  # -> Angle, Reflex
panel_2 = Panel(angle.Angle)

# ----
diagonal_links_2 = ClusterOutput(diagonal_links)
vertical_links_2 = ClusterOutput(vertical_links)
rev_2 = ReverseList(List=bang.Branch1)
merge_2 = Merge(Data1=flatten(bang.Branch0), Data2=flatten(rev_2))
deplane_3 = DeconstructPlane(Plane=cull_i_2)  # -> Origin, XAxis, YAxis, ZAxis
Z = UnitZ(Factor=1)
all_links = Geometry(merge_2)
vdis = VectorDisplay(Anchor=deplane_3.Origin, Vector=deplane_3.XAxis)
X = UnitX(Factor=1)
beam_3 = Data(beam_2)
angle_2 = Angle(VectorA=X, VectorB=deplane_3.XAxis)  # -> Angle, Reflex
a_bbeam = BuildBeam(Beam=beam_3)  # -> Beam, Axis, SectionPlanes, BeamSections, FlangeSections, WebSections, ConcreteBeam, CompressionRebars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
area = Area(Geometry=all_links)  # -> Area, Centroid
deg = Degrees(Radians=angle_2.Angle)
crv_cp = CurveClosestPoint(Point=area.Centroid, Curve=a_bbeam.Axis)  # -> Point, Parameter, Distance
D = ClusterOutput(deg)
all_links_2 = ClusterOutput(all_links)
t = ClusterOutput(crv_cp.Parameter)
panel_3 = Panel(deg)
