# Grasshopper definition FRP RC Shells Structural Analysis and Optimisation Tool.gh (Grasshopper 1.0.8)
# plug-ins: Karamba3D, RhinoCodePluginGH, Bifocals

radius_m = Slider(10, range=10..20)
construct_plane = ConstructPlane(Origin=Point(0, 0, 0), XAxis=Vector(0, 1, 0), YAxis=Vector(0, 0, 1))
arc = Arc(Plane=construct_plane, Radius=radius_m, Angle=Domain(2.268928, 0.872665))  # -> Arc, Length
len = Length(Curve=arc.Arc)
divide_curve = DivideCurve(Curve=arc.Arc, Count=Slider(19, range=0..19), Kinks=False)  # -> Points, Tangents, Parameters
multiplication = Multiplication(A=len, B="4")
panel = Panel(arc.Length)
panel_2 = Panel(multiplication)
deconstruct = Deconstruct(Point=divide_curve.Points)  # -> XComponent, YComponent, ZComponent
sort_list = SortList(Keys=deconstruct.ZComponent, ValuesValuesA=divide_curve.Points)  # -> Keys, simplify(graft(ValuesValuesA))
number_slider = Slider(20, range=0..40)
branch = TreeBranch(Tree=sort_list.ValuesValuesA, Path="{0}", MaintainPaths=True)
branch_2 = TreeBranch(Tree=sort_list.ValuesValuesA, Path="{1}", MaintainPaths=True)
point = Point(branch_2)
point_2 = Point(branch)
X = UnitX(Factor=1)
line_sdl = LineSDL(Start=point_2, Direction=X, Length=number_slider)
extrude_along = ExtrudeAlong(Base=arc.Arc, Curve=line_sdl)
discritization_in_longitudinal_direction = Slider(20, range=0..40)

# ----
# Cutting planes for displaying outputs
addition = Addition(A=discritization_in_longitudinal_direction, B=1)
# I step - Geometry of the structure:
division = Division(A=1, B=discritization_in_longitudinal_direction)
series = Series(Start=0, Step=division, Count=addition)
multiplication_2 = Multiplication(A=number_slider, B=series, C=1)
panel_3 = Panel(multiplication_2)
pt = ConstructPoint(XCoordinate=multiplication_2, YCoordinate=0, ZCoordinate=0)
construct_plane_2 = ConstructPlane(Origin=pt, XAxis=Vector(0, 1, 0), YAxis=Vector(0, 0, 1))
planesrf = PlaneSurface(Plane=construct_plane_2, XSize=Domain(-100, 100), YSize=Domain(-100, 100))

discritization_in_hoop_direction = Slider(20, range=0..20)
surface = Surface(extrude_along)
mesh_surface = MeshSurface(
    Surface=surface,
    UCount=discritization_in_hoop_direction,
    VCount=discritization_in_longitudinal_direction,
    Overhang=True,
    Equalize=False)
deconstruct_mesh = DeconstructMesh(Mesh=mesh_surface)  # -> Vertices, Faces, Colours, flatten(Normals)

# ----
# 12. I defined the cross section by defining:
# - Concrete
# - Reinforcement (Steel B450C)
# - Height of the cross section
# (Other parameters like quantity of Steel
# in terms of cm2/m or covers were set as default)
height_cm = Slider(10, range=10..30)
matselect = MaterialSelectionKaramba3D(menu=[dropdown(7), dropdown(6)])

# ----
# 13. I defined the mesh to shell component
# in order to convert the mesh into a shell.
# Bending stiffness was activated.
boolean_toggle = BooleanToggle(True)
mtoshell = MeshToShellKaramba3D(Mesh=mesh_surface, Colour=RGBA(222, 0, 0, 0), LimitDistance_m=0.005, Bending=boolean_toggle)  # -> Element, Points, Info

points = PointList(Points=deconstruct_mesh.Vertices)
addition_2 = Addition(A=discritization_in_longitudinal_direction, B=1)
path = ConstructPath(Indices=discritization_in_hoop_direction)
partition = PartitionList(List=deconstruct_mesh.Vertices, Size=addition_2)  # -> simplify(Chunks)
flip = FlipMatrix(Data=partition)

# ---- group: Cross Section (Karamba3D)
# VI step -
# Structural Analysis with Karamba
crosec = CrossSectionKaramba3D(FamilyNameOfCrossSection="DefaultCroSec", Material=matselect, Height_cm=height_cm, mode="Shell - Const")

# ----
addition_3 = Addition()
path_2 = ConstructPath(Indices=discritization_in_longitudinal_direction)
branch_3 = TreeBranch(Tree=partition, Path=["{0}", path], MaintainPaths=True)
panel_4 = Panel(discritization_in_longitudinal_direction)
points_2 = PointList(Points=flip)
item = ListItem(List=branch_3, Index=panel_4, Wrap=True)
item_2 = ListItem(List=branch_3, Index="0", Wrap=True)
branch_4 = TreeBranch(Tree=flip, Path=["{0}", path_2], MaintainPaths=True)  # -> flatten(Branch)
pt_2 = Point(flatten([item_2, item]))
# - BCs
# - Load conditions
# (in a specific area of the vault)
data = Data([item_2, item])
difference = SetDifference(SetA=branch_3, SetB=data)
difference_2 = SetDifference(SetA=branch_4, SetB=pt_2)
supp = SupportKaramba3D(PosInd=difference_2, menu=[buttons(off, on, on, off, off, off)])

# ----
# 14. I defined a vertical
# force applied on the
# nodes of the model
# which magnitude
# can be varied.
# With vector display
# it's possible to see
# the vectors.
# I will need it later.
# This variable contains
# the points in which I want
# to evaluate the displacements
# [f(z)]
vertical_force_kn = Slider(2.8, range=0..5)
# True:
# Loads rotate
# with the structure
# during the large
# deformations
# analysis.
multiplication_3 = Multiplication(A=vertical_force_kn, B=-1)
unit_z = UnitZ(Factor=multiplication_3)
vector_display = VectorDisplay(Vector=unit_z)

Z = UnitZ(Factor=Slider(-4, range=-10..0))
supp_2 = SupportKaramba3D(PosInd=item_2, menu=[buttons(on, on, on, off, off, off)])

# ----
# 15. I defined the support
# conditions (hinges)
supp_3 = SupportKaramba3D(PosInd=difference, menu=[buttons(off, off, off, off, off, off)])

supp_4 = SupportKaramba3D(PosInd=item, menu=[buttons(off, on, on, off, off, off)])

# ---- group: Loads (Karamba3D)
loads = LoadsKaramba3D(Vector=Z, Mesh=mesh_surface, LCase="LC0", mode="MeshLoad -Const.", menu=[buttons(off, off, on), buttons(on, off)])

loads_2 = LoadsKaramba3D(ForceVector=unit_z, Local=Toggle(True), PosInd=deconstruct_mesh.Vertices, LCase="LC0", mode="Point")

# ---- group: Assemble Model (Karamba3D)
# 16. Assemble Model
assemble = AssembleModelKaramba3D(
    Elem=flatten(mtoshell.Element),
    Support=flatten([supp_4, supp_3, supp_2, supp]),
    Load=flatten(loads),
    CrossSection=flatten(crosec),
    LimitDistance_m=0.005)  # -> Model, Info, Mass_kg, CentreOfGravity, LoadCaseNames

# ----
analyse = AnalyseKaramba3D(Model=assemble.Model)  # -> AnalysedModel, MaximumDisplacement_cm, ResultingForce_kN, ChangeOfElasticEnergy_kNm

# ----
# 18. Model View.
# I defined the parameters in order to see
# the deformed shape of the vault but also
# the thickness in the deformed shape,
# not only the Mesh.
modelview = ModelViewKaramba3D(Model=analyse.AnalysedModel)  # -> Model, DeformedMesh, DeformedAxes, DeformedModel, MaximumDeformation

# ---- group: Shell View (Karamba3D)
shellview = ShellViewKaramba3D(Model=modelview.Model, IndexOfLayer=0)  # -> Model, MeshesOfRenderedShells, LegendColours, LegendTags

# ----
reactview = ReactionViewKaramba3D(Model=modelview.Model)  # -> Model, LegendColours, LegendTags
legend = Legend(Colour=shellview.LegendColours, Tags=shellview.LegendTags, LegendType=1)
elemquery = ElementQueryKaramba3D(Model=modelview.Model)  # -> Model, Mass_kg, Area_m², Volume_m³, Meshes
s_forces = ShellSectionKaramba3D(
    Model=modelview.Model,
    LoadCaseCombination="LC0",
    IntersectionGeometry=planesrf,
    ProjectionDirection=Vector(0, 0, -1),
    mode="Forces",
    menu=[checkbox(on), checkbox(on), checkbox(on), slider(20), slider(0.13), slider(1.06), checkbox(off), checkbox(off), checkbox(off), checkbox(on), checkbox(on), checkbox(off), checkbox(off), checkbox(off), checkbox(off), slider(2.21)])  # -> Model, CuttingCurves, FaceIndices, MeshesOfRenderedResults, CurvesOfRenderedResults, simplify(Ntt_kN_m), simplify(Nnn_kN_m), simplify(Ntn_kN_m)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
s_forces_2 = ShellForcesKaramba3D(AnalysedModel=modelview.Model, mode="Local")  # -> Model, Nxx_kN_m, Nyy_kN_m, Nxy_kN_m, Mxx_kNm_m, Myy_kNm_m, Mxy_kNm_m, Vx_kN_m, Vy_kN_m, LoadCaseIndex
selectelems = SelectElementsKaramba3D(Model=s_forces_2.Model)  # -> Model, Elements

# ----
# These are the resultant internal forces in the shell
ntt_ny = Panel(s_forces.Ntt_kN_m)
nnn_nx = Panel(s_forces.Nnn_kN_m)
ntn_nxy = Panel(s_forces.Ntn_kN_m)
mtt_my = Panel(s_forces.Mtt_kNm_m)
mnn_mx = Panel(s_forces.Mnn_kNm_m)
mtn_mxy = Panel(s_forces.Mtn_kNm_m)

disassemble = DisassembleModelKaramba3D(Model=s_forces_2.Model)  # -> Model, Point, Beam, Shell, Support, Load, Line, Mesh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
relay = Relay()
nodedisp = NodalDisplacementsKaramba3D(AnalysedModel=analyse.AnalysedModel, PositionsIndexes=relay)  # -> Model, NodalTranslations_m, NodalRotations_rad, DisplacementPosition, LoadCaseIndex

# ----
# 19. Displacements.
# With the component "Nodal Displacements"
# I can evaluate the displacements per
# each node of the model. In input I have the
# position of the nodes previously sorted
# along the z direction, so now I can assign
# at each value of displacement an id but also
# the coordinates in the global system of
# reference.
point_3 = Point(relay)
point_list = PointList(Points=point_3)
panel_5 = Panel(nodedisp.NodalTranslations_m)
panel_6 = Panel(point_3)

point_list_2 = PointList(Points=point_3)
merge = Merge(
    Data1=simplify(graft(nnn_nx)),
    Data2=simplify(graft(ntt_ny)),
    Data3=simplify(graft(ntn_nxy)),
    Data4=simplify(graft(mnn_mx)),
    Data5=simplify(graft(mtt_my)),
    Data6=simplify(graft(mtn_mxy)))

# ----
# All forces
panel_7 = Panel(merge)

# ----
# Grid coordinates
panel_8 = Panel(deconstruct_mesh.Vertices)

# ----
# Node
M = Panel("""3.784763
0.16146
1.723731""")
N = Panel("""1096.369112
31.887524
-105.091932""")
material_properties = Panel("""20000
140000""")
shell_geometries = Panel("""0.1
0.025""")
py3 = Python3Script(N=N, M=M)  # -> out, a; inputs Geo: Double, Prop: Double, N: list of Double, M: list of Double, XYZ: Double
# ---------- py3: Python ----------
"""Grasshopper Script"""
import numpy as np
from scipy.optimize import minimize

tol=1
Objective_0=10**9


# units are kN and m

# INTERNAL FORCES
# #midspan top
# N=[-200,300,75]
# M =[-60,40,-20]
# mu=1
# Nx=mu*N[0]
# Ny=mu*N[1]
# Nxy=mu*N[2]
# Mx=mu*M[0]
# My=mu*M[1]
# Mxy=mu*M[2]

Nx=N[0]
Ny=N[1]
Nxy=N[2]
Mx=M[0]
My=M[1]
Mxy=M[2]

# INPUT DATA

# fc = 6895       #  kN/m2
# h = 0.254       #  m
# hxt = 0.1016    #  m
# hxb = 0.1016    #  m
# hyt = 0.1016    #  m
# hyb = 0.1016    #  m

#fcd = 3000       #  kN/m2
#fc = (0.6*(1-fcd/100/250))*100       #  kN/m2
fc = 20000       #  kN/m2
ftc=fc
fbc=fc
h = 0.1         #  m
c= 0.025         #  m
hxt = (h-2*c)/2     #  m
hxb = (h-2*c)/2     #  m
hyt = (h-2*c)/2     #  m
hyb = (h-2*c)/2     #  m

# PRINCIPAL DIRECTIONS

# Nxt=Nx-Mx/(0.8*h)
# Nyt=Ny-My/(0.8*h)
# Nxyt=Nxy-Mxy/(0.8*h)
# th_t=np.arctan(2*Nxyt/(Nxt-Nyt))/2
# th_t_grads=th_t*180/3.14
# print(th_t)
# print(th_t_grads)

# Nxb=Nx+Mx/(0.8*h)
# Nyb=Ny+My/(0.8*h)
# Nxyb=Nxy+Mxy/(0.8*h)
# th_b=np.arctan(2*Nxyb/(Nxb-Nyb))/2
# th_b_grads=th_b*180/3.14
# print(th_b)
# print(th_b_grads)

# OTHER EQUATIONS NOT USED

#Nxt=(hxb*Nx-Mx)/(hxt+hxb)
#Nxb=(hxt*Nx+Mx)/(hxt+hxb)
#Nyt=(hyb*Ny-My)/(hyt+hyb)
#Nyb=(hyt*Ny+My)/(hyt+hyb)
#Nxyt=((h-x[3])/2*Nxy-Mxy)/(h-(x[2]+x[3])/2)
#Nxyb=((h-x[2])/2*Nxy+Mxy)/(h-(x[2]+x[3])/2)

#Cxtt=(hxb+(h-x[2])/2)/(hxt+hxb)
#Cxtb=(hxb-(h-x[3])/2)/(hxt+hxb)
#Cxbt=(hxt-(h-x[2])/2)/(hxt+hxb)
#Cxbb=(hxt+(h-x[3])/2)/(hxt+hxb)
#Cytt=(hyb+(h-x[2])/2)/(hyt+hyb)
#Cytb=(hyb-(h-x[3])/2)/(hyt+hyb)
#Cybt=(hyt-(h-x[2])/2)/(hyt+hyb)
#Cybb=(hyt+(h-x[3])/2)/(hyt+hyb)

#Nxtr=(hxb*Nx-Mx)/(hxt+hxb)+(((h-x[3])/2*Nxy-Mxy)/(h-(x[2]+x[3])/2))*((hxb+(h-x[2])/2)/(hxt+hxb))*np.tan(x[0])+(((h-x[2])/2*Nxy+Mxy)/(h-(x[2]+x[3])/2))*((hxb-(h-x[3])/2)/(hxt+hxb))*np.tan(x[1])
#Nxbr=(hxt*Nx+Mx)/(hxt+hxb)+(((h-x[3])/2*Nxy-Mxy)/(h-(x[2]+x[3])/2))*((hxt-(h-x[2])/2)/(hxt+hxb))*np.tan(x[0])+(((h-x[2])/2*Nxy+Mxy)/(h-(x[2]+x[3])/2))*((hxt+(h-x[3])/2)/(hxt+hxb))*np.tan(x[1])
#Nytr=(hyb*Ny-My)/(hyt+hyb)+(((h-x[3])/2*Nxy-Mxy)/(h-(x[2]+x[3])/2))*((hyb+(h-x[2])/2)/(hyt+hyb))/np.tan(x[0])+(((h-x[2])/2*Nxy+Mxy)/(h-(x[2]+x[3])/2))*((hyb-(h-x[3])/2)/(hyt+hyb))/np.tan(x[1])
#Nybr=(hyt*Ny+My)/(hyt+hyb)+(((h-x[3])/2*Nxy-Mxy)/(h-(x[2]+x[3])/2))*((hyt-(h-x[2])/2)/(hyt+hyb))/np.tan(x[0])+(((h-x[2])/2*Nxy+Mxy)/(h-(x[2]+x[3])/2))*((hyt+(h-x[3])/2)/(hyt+hyb))/np.tan(x[1])

# FORCES IN REINFORCEMENT BASED ON EQUILIBRIUM IN FUNCTION OF 
#x[0]   # Theta t (crack direction at top)
#x[1]   # Theta b (crack direction at bottom)
#x[2]   # at      (depth of compressive stress block at top)
#x[3]   # ab      (depth of compressive stress block at bottom)

def Nxtr(x):
    return ((hxb*Nx-Mx)/(hxt+hxb)+((hxb+(h-x[2])/2)/(hxt+hxb))*x[2]*ftc*(np.sin(x[0]))**2+((hxb-(h-x[3])/2)/(hxt+hxb))*x[3]*fbc*(np.sin(x[1]))**2)

def Nxbr(x):
    return ((hxt*Nx+Mx)/(hxt+hxb)+((hxt-(h-x[2])/2)/(hxt+hxb))*x[2]*ftc*(np.sin(x[0]))**2+((hxt+(h-x[3])/2)/(hxt+hxb))*x[3]*fbc*(np.sin(x[1]))**2)

def Nytr(x):
    return ((hyb*Ny-My)/(hyt+hyb)+((hyb+(h-x[2])/2)/(hyt+hyb))*x[2]*ftc*(np.cos(x[0]))**2+((hyb-(h-x[3])/2)/(hyt+hyb))*x[3]*fbc*(np.cos(x[1]))**2)

def Nybr(x):
    return ((hyt*Ny+My)/(hyt+hyb)+((hyt-(h-x[2])/2)/(hyt+hyb))*x[2]*ftc*(np.cos(x[0]))**2+((hyt+(h-x[3])/2)/(hyt+hyb))*x[3]*fbc*(np.cos(x[1]))**2)

def Objective(x):
    return abs(Nxtr(x))+abs(Nxbr(x))+abs(Nytr(x))+abs(Nybr(x))

S=[[1,1],[1,-1],[-1,1],[-1,-1]]

s=0
x0 = np.zeros(4)

while s < 4:
    # initial guesses
    st=S[s][0]
    sb=S[s][1]
    x0[0] = st*3.14/4   # Theta top (th_t)
    x0[1] = sb*3.14/4   # Theta bottom (th_b)
    x0[2] = 0.2*h       # at
    x0[3] = 0.2*h       # ab

    if x0[0]>0:
        th_bounds_t = (0,1.57)
    else:
        th_bounds_t = (-1.57,0)
    
    if x0[1]>0:
        th_bounds_b = (0,1.57)
    else:
        th_bounds_b = (-1.57,0)

    # th_bounds_t = (-1.57,1.57)
    # th_bounds_b = (-1.57,1.57)

    # if Nxtr(x0)<0 and Nytr(x0)>0:
    #     th_t = Symbol('th_t')
    #     eqn = Eq((hxb*Nx-Mx)/(hxt+hxb)+(((h-x0[3])/2*Nxy-Mxy)/(h-(x0[2]+x0[3])/2))*((hxb+(h-x0[2])/2)/(hxt+hxb))*tan(th_t)+(((h-x0[2])/2*Nxy+Mxy)/(h-(x0[2]+x0[3])/2))*((hxb-(h-x0[3])/2)/(hxt+hxb))*tan(x0[1]), 0)
    #     th_t_0=solve(eqn)
    #     print('cond1')
    #     x0[0]=th_t_0[0]

    # if Nxbr(x0)<0 and Nybr(x0)>0:
    #     th_b = Symbol('th_b')
    #     eqn = Eq((hxt*Nx+Mx)/(hxt+hxb)+(((h-x0[3])/2*Nxy-Mxy)/(h-(x0[2]+x0[3])/2))*((hxt-(h-x0[2])/2)/(hxt+hxb))*tan(x0[0])+(((h-x0[2])/2*Nxy+Mxy)/(h-(x0[2]+x0[3])/2))*((hxt+(h-x0[3])/2)/(hxt+hxb))*tan(th_b), 0)
    #     th_b_0=solve(eqn)
    #     print(th_b_0)
    #     print('cond2')
    #     x0[1]=th_b_0[0]

    # if Nytr(x0)<0 and Nxtr(x0)>0:
    #     th_t = Symbol('th_t')
    #     eqn = Eq((hyb*Ny-My)/(hyt+hyb)+(((h-x0[3])/2*Nxy-Mxy)/(h-(x0[2]+x0[3])/2))*((hyb+(h-x0[2])/2)/(hyt+hyb))/tan(th_t)+(((h-x0[2])/2*Nxy+Mxy)/(h-(x0[2]+x0[3])/2))*((hyb-(h-x0[3])/2)/(hyt+hyb))/tan(x0[1]), 0)
    #     th_t_0=solve(eqn)
    #     print('cond3')
    #     x0[0]=th_t_0[0]

    # if Nybr(x0) < 0 and Nxbr(x0)>0:
    #     th_b = Symbol('th_b')
    #     eqn = Eq((hyt*Ny+My)/(hyt+hyb)+(((h-x0[3])/2*Nxy-Mxy)/(h-(x0[2]+x0[3])/2))*((hyt-(h-x0[2])/2)/(hyt+hyb))/np.tan(x0[0])+(((h-x0[2])/2*Nxy+Mxy)/(h-(x0[2]+x0[3])/2))*((hyt+(h-x0[3])/2)/(hyt+hyb))/np.tan(th_b), 0)
    #     th_b_0=solve(eqn)
    #     print('cond4')
    #     print(th_b_0)
    #     x0[1]=th_b_0[0]

    a_bounds = (0*h,0.99*h)

    B = (th_bounds_t, th_bounds_b, a_bounds, a_bounds)


    def Nx_f(x):
        return -abs(((hxb*Nx-Mx)/(hxt+hxb)+((hxb+(h-x[2])/2)/(hxt+hxb))*x[2]*ftc*(np.sin(x[0]))**2+((hxb-(h-x[3])/2)/(hxt+hxb))*x[3]*fbc*(np.sin(x[1]))**2)\
            +((hxt*Nx+Mx)/(hxt+hxb)+((hxt-(h-x[2])/2)/(hxt+hxb))*x[2]*ftc*(np.sin(x[0]))**2+((hxt+(h-x[3])/2)/(hxt+hxb))*x[3]*fbc*(np.sin(x[1]))**2)\
                +(-x[2]*fc)*(np.sin(x[0]))**2 + (-x[3]*fc)*(np.sin(x[1]))**2-Nx)+tol

    def Ny_f(x):
        return -abs(((hyb*Ny-My)/(hyt+hyb)+((hyb+(h-x[2])/2)/(hyt+hyb))*x[2]*ftc*(np.cos(x[0]))**2+((hyb-(h-x[3])/2)/(hyt+hyb))*x[3]*fbc*(np.cos(x[1]))**2)\
                +((hyt*Ny+My)/(hyt+hyb)+((hyt-(h-x[2])/2)/(hyt+hyb))*x[2]*ftc*(np.cos(x[0]))**2+((hyt+(h-x[3])/2)/(hyt+hyb))*x[3]*fbc*(np.cos(x[1]))**2)\
                    + (-x[2]*fc)*(np.cos(x[0]))**2 + (-x[3]*fc)*(np.cos(x[1]))**2-Ny)+tol

    def Nxy_f(x):
        return -abs(x[2]*fc*np.sin(x[0])*np.cos(x[0]) + x[3]*fc*np.sin(x[1])*np.cos(x[1])-Nxy)+tol

    def Mx_f(x):
        return -abs(-((hxb*Nx-Mx)/(hxt+hxb)+((hxb+(h-x[2])/2)/(hxt+hxb))*x[2]*ftc*(np.sin(x[0]))**2+((hxb-(h-x[3])/2)/(hxt+hxb))*x[3]*fbc*(np.sin(x[1]))**2)*hxt+\
                ((hxt*Nx+Mx)/(hxt+hxb)+((hxt-(h-x[2])/2)/(hxt+hxb))*x[2]*ftc*(np.sin(x[0]))**2+((hxt+(h-x[3])/2)/(hxt+hxb))*x[3]*fbc*(np.sin(x[1]))**2)*hxb\
                    + x[2]*fc*((h-x[2])/2)*(np.sin(x[0]))**2 - x[3]*fc*((h-x[3])/2)*(np.sin(x[1]))**2-Mx)+tol

    def My_f(x):
        return -abs(-((hyb*Ny-My)/(hyt+hyb)+((hyb+(h-x[2])/2)/(hyt+hyb))*x[2]*ftc*(np.cos(x[0]))**2+((hyb-(h-x[3])/2)/(hyt+hyb))*x[3]*fbc*(np.cos(x[1]))**2)*hyt+\
                    ((hyt*Ny+My)/(hyt+hyb)+((hyt-(h-x[2])/2)/(hyt+hyb))*x[2]*ftc*(np.cos(x[0]))**2+((hyt+(h-x[3])/2)/(hyt+hyb))*x[3]*fbc*(np.cos(x[1]))**2)*hyb\
                        + x[2]*fc*(h-x[2])/2*(np.cos(x[0]))**2 - x[3]*fc*(h-x[3])/2*(np.cos(x[1]))**2-My)+tol
    
    def Mxy_f(x):
        return -abs(-x[2]*fc*(h-x[2])/2*np.sin(x[0])*np.cos(x[0]) + x[3]*fc*(h-x[3])/2*np.sin(x[1])*np.cos(x[1])-Mxy)+tol
    
    def h_f(x):
        return h-x[2]-x[3]

    # con1 = {'type': 'ineq', 'fun': Nx_f}
    # con2 = {'type': 'ineq', 'fun': Ny_f}
    con3 = {'type': 'eq', 'fun': Nxy_f}
    # con4 = {'type': 'ineq', 'fun': Mx_f}
    # con5 = {'type': 'ineq', 'fun': My_f}
    con6 = {'type': 'eq', 'fun': Mxy_f}
    con7 = {'type': 'ineq', 'fun': h_f}
    con8 = {'type': 'ineq', 'fun': Nxtr}
    con9 = {'type': 'ineq', 'fun': Nxbr}
    con10 = {'type': 'ineq', 'fun': Nytr}
    con11 = {'type': 'ineq', 'fun': Nybr}

    cons = ([con3,con6,con7,con8,con9,con10,con11])

    # cons = ([con3,con6,con7])

    solution = minimize(Objective,x0,method='SLSQP',bounds=B,constraints=cons,options={'disp':False,'ftol':tol})

    # solution = minimize(Objective,x0,method='SLSQP',bounds=B,constraints=cons,options={'disp':False})

    x0_s = solution.x

    # if(solution.message=='Optimization terminated successfully'):
    if(solution.message=='Optimization terminated successfully' and Objective(x0_s)<Objective_0):        
        x0_i = x0
        message=solution.message
        print(x0_i)
        x0_f = x0_s
 
    s=s+1

    #x = solution.x

    # show final objective
    #print('Final SSE Objective: ' + str(objective(x)))

    # print solution
    #print('Solution')
    #print('x0 = ' + str(x[0]))
    #print('x1 = ' + str(x[1]))
    #print('x2 = ' + str(x[2]))
    #print('x3 = ' + str(x[3]))

print(message)
print(x0_f)
print(Objective(x0_f))
print(Nx_f(x0_f))
print(Ny_f(x0_f))
print(Nxy_f(x0_f))
print(Mx_f(x0_f))
print(My_f(x0_f))
print(Mxy_f(x0_f))

print(Nxtr(x0_f))
print(Nxbr(x0_f))
print(Nytr(x0_f))
print(Nybr(x0_f))
# ---------- end py3 ----------
optimal_solution = Panel(py3.out)

# ----
# Node
M_2 = Panel("""3.445961
0.151026
3.325593""")
N_2 = Panel("""901.999493
25.629763
-101.55341""")
py3_2 = Python3Script(N=N_2, M=M_2)  # -> out, a; inputs Geo: Double, Prop: Double, N: list of Double, M: list of Double, XYZ: Double; same code as py3
optimal_solution_2 = Panel(py3_2.out)

# ----
# Node
M_3 = Panel("""2.666422
0.119085
4.849687""")
N_3 = Panel("""545.870511
14.153979
-89.068886""")
py3_3 = Python3Script(N=N_3, M=M_3)  # -> out, a; inputs Geo: Double, Prop: Double, N: list of Double, M: list of Double, XYZ: Double; same code as py3
optimal_solution_3 = Panel(py3_3.out)

# ----
# Node
M_4 = Panel("""0.689471
0.439841
5.867932""")
N_4 = Panel("""45.635233
9.127047
-51.964632""")
py3_4 = Python3Script(N=N_4, M=M_4)  # -> out, a; inputs Geo: Double, Prop: Double, N: list of Double, M: list of Double, XYZ: Double
# ---------- py3_4: Python ----------
"""Grasshopper Script"""
import numpy as np
from scipy.optimize import minimize

tol=1

# units are kN and m

# INTERNAL FORCES
# #midspan top
# N=[-200,300,75]
# M =[-60,40,-20]
# mu=1
# Nx=mu*N[0]
# Ny=mu*N[1]
# Nxy=mu*N[2]
# Mx=mu*M[0]
# My=mu*M[1]
# Mxy=mu*M[2]

Nx=N[0]
Ny=N[1]
Nxy=N[2]
Mx=M[0]
My=M[1]
Mxy=M[2]

# INPUT DATA

# fc = 6895       #  kN/m2
# h = 0.254       #  m
# hxt = 0.1016    #  m
# hxb = 0.1016    #  m
# hyt = 0.1016    #  m
# hyb = 0.1016    #  m

#fcd = 3000       #  kN/m2
#fc = (0.6*(1-fcd/100/250))*100       #  kN/m2
fc = 20000       #  kN/m2
h = 0.1         #  m
c= 0.025         #  m
hxt = (h-2*c)/2     #  m
hxb = (h-2*c)/2     #  m
hyt = (h-2*c)/2     #  m
hyb = (h-2*c)/2     #  m

# PRINCIPAL DIRECTIONS

# Nxt=Nx-Mx/(0.8*h)
# Nyt=Ny-My/(0.8*h)
# Nxyt=Nxy-Mxy/(0.8*h)
# th_t=np.arctan(2*Nxyt/(Nxt-Nyt))/2
# th_t_grads=th_t*180/3.14
# print(th_t)
# print(th_t_grads)

# Nxb=Nx+Mx/(0.8*h)
# Nyb=Ny+My/(0.8*h)
# Nxyb=Nxy+Mxy/(0.8*h)
# th_b=np.arctan(2*Nxyb/(Nxb-Nyb))/2
# th_b_grads=th_b*180/3.14
# print(th_b)
# print(th_b_grads)

# OTHER EQUATIONS NOT USED

#Nxt=(hxb*Nx-Mx)/(hxt+hxb)
#Nxb=(hxt*Nx+Mx)/(hxt+hxb)
#Nyt=(hyb*Ny-My)/(hyt+hyb)
#Nyb=(hyt*Ny+My)/(hyt+hyb)
#Nxyt=((h-x[3])/2*Nxy-Mxy)/(h-(x[2]+x[3])/2)
#Nxyb=((h-x[2])/2*Nxy+Mxy)/(h-(x[2]+x[3])/2)

#Cxtt=(hxb+(h-x[2])/2)/(hxt+hxb)
#Cxtb=(hxb-(h-x[3])/2)/(hxt+hxb)
#Cxbt=(hxt-(h-x[2])/2)/(hxt+hxb)
#Cxbb=(hxt+(h-x[3])/2)/(hxt+hxb)
#Cytt=(hyb+(h-x[2])/2)/(hyt+hyb)
#Cytb=(hyb-(h-x[3])/2)/(hyt+hyb)
#Cybt=(hyt-(h-x[2])/2)/(hyt+hyb)
#Cybb=(hyt+(h-x[3])/2)/(hyt+hyb)

#Nxtr=(hxb*Nx-Mx)/(hxt+hxb)+(((h-x[3])/2*Nxy-Mxy)/(h-(x[2]+x[3])/2))*((hxb+(h-x[2])/2)/(hxt+hxb))*np.tan(x[0])+(((h-x[2])/2*Nxy+Mxy)/(h-(x[2]+x[3])/2))*((hxb-(h-x[3])/2)/(hxt+hxb))*np.tan(x[1])
#Nxbr=(hxt*Nx+Mx)/(hxt+hxb)+(((h-x[3])/2*Nxy-Mxy)/(h-(x[2]+x[3])/2))*((hxt-(h-x[2])/2)/(hxt+hxb))*np.tan(x[0])+(((h-x[2])/2*Nxy+Mxy)/(h-(x[2]+x[3])/2))*((hxt+(h-x[3])/2)/(hxt+hxb))*np.tan(x[1])
#Nytr=(hyb*Ny-My)/(hyt+hyb)+(((h-x[3])/2*Nxy-Mxy)/(h-(x[2]+x[3])/2))*((hyb+(h-x[2])/2)/(hyt+hyb))/np.tan(x[0])+(((h-x[2])/2*Nxy+Mxy)/(h-(x[2]+x[3])/2))*((hyb-(h-x[3])/2)/(hyt+hyb))/np.tan(x[1])
#Nybr=(hyt*Ny+My)/(hyt+hyb)+(((h-x[3])/2*Nxy-Mxy)/(h-(x[2]+x[3])/2))*((hyt-(h-x[2])/2)/(hyt+hyb))/np.tan(x[0])+(((h-x[2])/2*Nxy+Mxy)/(h-(x[2]+x[3])/2))*((hyt+(h-x[3])/2)/(hyt+hyb))/np.tan(x[1])

# FORCES IN REINFORCEMENT BASED ON EQUILIBRIUM IN FUNCTION OF 
#x[0]   # Theta t (crack direction at top)
#x[1]   # Theta b (crack direction at bottom)
#x[2]   # at      (depth of compressive stress block at top)
#x[3]   # ab      (depth of compressive stress block at bottom)

def Nxtr(x):
    return (hxb*Nx-Mx)/(hxt+hxb)+(((h-x[3])/2*Nxy-Mxy)/(h-(x[2]+x[3])/2))*((hxb+(h-x[2])/2)/(hxt+hxb))*np.tan(x[0])+(((h-x[2])/2*Nxy+Mxy)/(h-(x[2]+x[3])/2))*((hxb-(h-x[3])/2)/(hxt+hxb))*np.tan(x[1])

def Nxbr(x):
    return (hxt*Nx+Mx)/(hxt+hxb)+(((h-x[3])/2*Nxy-Mxy)/(h-(x[2]+x[3])/2))*((hxt-(h-x[2])/2)/(hxt+hxb))*np.tan(x[0])+(((h-x[2])/2*Nxy+Mxy)/(h-(x[2]+x[3])/2))*((hxt+(h-x[3])/2)/(hxt+hxb))*np.tan(x[1])

def Nytr(x):
    return (hyb*Ny-My)/(hyt+hyb)+(((h-x[3])/2*Nxy-Mxy)/(h-(x[2]+x[3])/2))*((hyb+(h-x[2])/2)/(hyt+hyb))/np.tan(x[0])+(((h-x[2])/2*Nxy+Mxy)/(h-(x[2]+x[3])/2))*((hyb-(h-x[3])/2)/(hyt+hyb))/np.tan(x[1])

def Nybr(x):
    return (hyt*Ny+My)/(hyt+hyb)+(((h-x[3])/2*Nxy-Mxy)/(h-(x[2]+x[3])/2))*((hyt-(h-x[2])/2)/(hyt+hyb))/np.tan(x[0])+(((h-x[2])/2*Nxy+Mxy)/(h-(x[2]+x[3])/2))*((hyt+(h-x[3])/2)/(hyt+hyb))/np.tan(x[1])

def Objective(x):
    return abs(Nxtr(x))+abs(Nxbr(x))+abs(Nytr(x))+abs(Nybr(x))

S=[[1,1],[1,-1],[-1,1],[-1,-1]]

s=0
x0 = np.zeros(4)

while s < 4:
    # initial guesses
    st=S[s][0]
    sb=S[s][1]
    x0[0] = st*3.14/4   # Theta top (th_t)
    x0[1] = sb*3.14/4   # Theta bottom (th_b)
    x0[2] = 0.2*h       # at
    x0[3] = 0.2*h       # ab

    if x0[0]>0:
        th_bounds_t = (0.15,1.4)
    else:
        th_bounds_t = (-1.4,-0.15)
    
    if x0[1]>0:
        th_bounds_b = (0.15,1.4)
    else:
        th_bounds_b = (-1.4,-0.15)

    # th_bounds_t = (-1.57,1.57)
    # th_bounds_b = (-1.57,1.57)

    # if Nxtr(x0)<0 and Nytr(x0)>0:
    #     th_t = Symbol('th_t')
    #     eqn = Eq((hxb*Nx-Mx)/(hxt+hxb)+(((h-x0[3])/2*Nxy-Mxy)/(h-(x0[2]+x0[3])/2))*((hxb+(h-x0[2])/2)/(hxt+hxb))*tan(th_t)+(((h-x0[2])/2*Nxy+Mxy)/(h-(x0[2]+x0[3])/2))*((hxb-(h-x0[3])/2)/(hxt+hxb))*tan(x0[1]), 0)
    #     th_t_0=solve(eqn)
    #     print('cond1')
    #     x0[0]=th_t_0[0]

    # if Nxbr(x0)<0 and Nybr(x0)>0:
    #     th_b = Symbol('th_b')
    #     eqn = Eq((hxt*Nx+Mx)/(hxt+hxb)+(((h-x0[3])/2*Nxy-Mxy)/(h-(x0[2]+x0[3])/2))*((hxt-(h-x0[2])/2)/(hxt+hxb))*tan(x0[0])+(((h-x0[2])/2*Nxy+Mxy)/(h-(x0[2]+x0[3])/2))*((hxt+(h-x0[3])/2)/(hxt+hxb))*tan(th_b), 0)
    #     th_b_0=solve(eqn)
    #     print(th_b_0)
    #     print('cond2')
    #     x0[1]=th_b_0[0]

    # if Nytr(x0)<0 and Nxtr(x0)>0:
    #     th_t = Symbol('th_t')
    #     eqn = Eq((hyb*Ny-My)/(hyt+hyb)+(((h-x0[3])/2*Nxy-Mxy)/(h-(x0[2]+x0[3])/2))*((hyb+(h-x0[2])/2)/(hyt+hyb))/tan(th_t)+(((h-x0[2])/2*Nxy+Mxy)/(h-(x0[2]+x0[3])/2))*((hyb-(h-x0[3])/2)/(hyt+hyb))/tan(x0[1]), 0)
    #     th_t_0=solve(eqn)
    #     print('cond3')
    #     x0[0]=th_t_0[0]

    # if Nybr(x0) < 0 and Nxbr(x0)>0:
    #     th_b = Symbol('th_b')
    #     eqn = Eq((hyt*Ny+My)/(hyt+hyb)+(((h-x0[3])/2*Nxy-Mxy)/(h-(x0[2]+x0[3])/2))*((hyt-(h-x0[2])/2)/(hyt+hyb))/np.tan(x0[0])+(((h-x0[2])/2*Nxy+Mxy)/(h-(x0[2]+x0[3])/2))*((hyt+(h-x0[3])/2)/(hyt+hyb))/np.tan(th_b), 0)
    #     th_b_0=solve(eqn)
    #     print('cond4')
    #     print(th_b_0)
    #     x0[1]=th_b_0[0]


    a_bounds = (0.01*h,0.99*h)

    B = (th_bounds_t, th_bounds_b, a_bounds, a_bounds)

    def Nx_f(x):
        return -abs((((hxb*Nx-Mx)/(hxt+hxb)+(((h-x[3])/2*Nxy-Mxy)/(h-(x[2]+x[3])/2))*((hxb+(h-x[2])/2)/(hxt+hxb))*np.tan(x[0])+(((h-x[2])/2*Nxy+Mxy)/(h-(x[2]+x[3])/2))*((hxb-(h-x[3])/2)/(hxt+hxb))*np.tan(x[1]))\
            +((hxt*Nx+Mx)/(hxt+hxb)+(((h-x[3])/2*Nxy-Mxy)/(h-(x[2]+x[3])/2))*((hxt-(h-x[2])/2)/(hxt+hxb))*np.tan(x[0])+(((h-x[2])/2*Nxy+Mxy)/(h-(x[2]+x[3])/2))*((hxt+(h-x[3])/2)/(hxt+hxb))*np.tan(x[1])))\
                +(-x[2]*fc)*(np.sin(x[0]))**2 + (-x[3]*fc)*(np.sin(x[1]))**2-Nx)+tol

    def Ny_f(x):
        return -abs((((hyb*Ny-My)/(hyt+hyb)+(((h-x[3])/2*Nxy-Mxy)/(h-(x[2]+x[3])/2))*((hyb+(h-x[2])/2)/(hyt+hyb))/np.tan(x[0])+(((h-x[2])/2*Nxy+Mxy)/(h-(x[2]+x[3])/2))*((hyb-(h-x[3])/2)/(hyt+hyb))/np.tan(x[1]))\
                +((hyt*Ny+My)/(hyt+hyb)+(((h-x[3])/2*Nxy-Mxy)/(h-(x[2]+x[3])/2))*((hyt-(h-x[2])/2)/(hyt+hyb))/np.tan(x[0])+(((h-x[2])/2*Nxy+Mxy)/(h-(x[2]+x[3])/2))*((hyt+(h-x[3])/2)/(hyt+hyb))/np.tan(x[1])))\
                    + (-x[2]*fc)*(np.cos(x[0]))**2 + (-x[3]*fc)*(np.cos(x[1]))**2-Ny)+tol

    def Nxy_f(x):
        return -abs(x[2]*fc*np.sin(x[0])*np.cos(x[0]) + x[3]*fc*np.sin(x[1])*np.cos(x[1])-Nxy)+tol

    def Mx_f(x):
        return -abs((-((hxb*Nx-Mx)/(hxt+hxb)+(((h-x[3])/2*Nxy-Mxy)/(h-(x[2]+x[3])/2))*((hxb+(h-x[2])/2)/(hxt+hxb))*np.tan(x[0])+(((h-x[2])/2*Nxy+Mxy)/(h-(x[2]+x[3])/2))*((hxb-(h-x[3])/2)/(hxt+hxb))*np.tan(x[1]))*hxt+\
                ((hxt*Nx+Mx)/(hxt+hxb)+(((h-x[3])/2*Nxy-Mxy)/(h-(x[2]+x[3])/2))*((hxt-(h-x[2])/2)/(hxt+hxb))*np.tan(x[0])+(((h-x[2])/2*Nxy+Mxy)/(h-(x[2]+x[3])/2))*((hxt+(h-x[3])/2)/(hxt+hxb))*np.tan(x[1]))*hxb)\
                    + x[2]*fc*((h-x[2])/2)*(np.sin(x[0]))**2 - x[3]*fc*((h-x[3])/2)*(np.sin(x[1]))**2-Mx)+tol

    def My_f(x):
        return -abs((-((hyb*Ny-My)/(hyt+hyb)+(((h-x[3])/2*Nxy-Mxy)/(h-(x[2]+x[3])/2))*((hyb+(h-x[2])/2)/(hyt+hyb))/np.tan(x[0])+(((h-x[2])/2*Nxy+Mxy)/(h-(x[2]+x[3])/2))*((hyb-(h-x[3])/2)/(hyt+hyb))/np.tan(x[1]))*hyt+\
                    ((hyt*Ny+My)/(hyt+hyb)+(((h-x[3])/2*Nxy-Mxy)/(h-(x[2]+x[3])/2))*((hyt-(h-x[2])/2)/(hyt+hyb))/np.tan(x[0])+(((h-x[2])/2*Nxy+Mxy)/(h-(x[2]+x[3])/2))*((hyt+(h-x[3])/2)/(hyt+hyb))/np.tan(x[1]))*hyb)\
                        + x[2]*fc*(h-x[2])/2*(np.cos(x[0]))**2 - x[3]*fc*(h-x[3])/2*(np.cos(x[1]))**2-My)+tol
    
    def Mxy_f(x):
        return -abs(-x[2]*fc*(h-x[2])/2*np.sin(x[0])*np.cos(x[0]) + x[3]*fc*(h-x[3])/2*np.sin(x[1])*np.cos(x[1])-Mxy)+tol
    
    def h_f(x):
        return h-x[2]-x[3]

    con1 = {'type': 'ineq', 'fun': Nx_f}
    con2 = {'type': 'ineq', 'fun': Ny_f}
    con3 = {'type': 'ineq', 'fun': Nxy_f}
    con4 = {'type': 'ineq', 'fun': Mx_f}
    con5 = {'type': 'ineq', 'fun': My_f}
    con6 = {'type': 'ineq', 'fun': Mxy_f}
    con7 = {'type': 'ineq', 'fun': h_f}
    con8 = {'type': 'ineq', 'fun': Nxtr}
    con9 = {'type': 'ineq', 'fun': Nxbr}
    con10 = {'type': 'ineq', 'fun': Nytr}
    con11 = {'type': 'ineq', 'fun': Nybr}

    cons = ([con1,con2,con3,con4,con5,con6,con7])

    solution = minimize(Objective,x0,method='SLSQP',bounds=B,constraints=cons,options={'disp':False,'ftol':1})

    x0_s = solution.x
    #print(x0)
    #print(x0_s)
    print(solution.message)

    if(solution.message=='Optimization terminated successfully'):
        
        Objective_0=Objective(x0_s)
        #print(solution.message)

        Nx_0=Nx_f(x0_s)
        Ny_0=Ny_f(x0_s)
        Nxy_0=Nxy_f(x0_s)
        Mx_0=Mx_f(x0_s)
        My_0=My_f(x0_s)
        Mxy_0=Mxy_f(x0_s)

        print(x0)
        print(x0_s)
    
        print(Objective_0)

        print(Nx_0)
        print(Ny_0)
        print(Nxy_0)
        print(Mx_0)
        print(My_0)
        print(Mxy_0)

        print(Nxtr(x0_s))
        print(Nxbr(x0_s))
        print(Nytr(x0_s))
        print(Nybr(x0_s))
        
    s=s+1

    #x = solution.x

    # show final objective
    #print('Final SSE Objective: ' + str(objective(x)))

    # print solution
    #print('Solution')
    #print('x0 = ' + str(x[0]))
    #print('x1 = ' + str(x[1]))
    #print('x2 = ' + str(x[2]))
    #print('x3 = ' + str(x[3]))
# ---------- end py3_4 ----------
optimal_solution_4 = Panel(py3_4.out)

# ----
# Node
M_5 = Panel("""3.89702
0.166744
0.100673""")
N_5 = Panel("""1165.739275
34.858188
-101.400917""")
py3_5 = Python3Script(N=N_5, M=M_5)  # -> out, a; inputs Geo: Double, Prop: Double, N: list of Double, M: list of Double, XYZ: Double; same code as py3
optimal_solution_5 = Panel(py3_5.out)

# ----
# Node
M_6 = Panel("""2.084446
-1.454139
1.801414""")
N_6 = Panel("""-16.533522
-9.039326
-73.912189""")
py3_6 = Python3Script(N=N_6, M=M_6)  # -> out, a; inputs Geo: Double, Prop: Double, N: list of Double, M: list of Double, XYZ: Double; same code as py3
optimal_solution_6 = Panel(py3_6.out)

# ----
# Node
M_7 = Panel("""1.817057
-1.285687
3.478908""")
N_7 = Panel("""-29.127131
-13.983304
-110.502768""")
py3_7 = Python3Script(N=N_7, M=M_7)  # -> out, a; inputs Geo: Double, Prop: Double, N: list of Double, M: list of Double, XYZ: Double; same code as py3
optimal_solution_7 = Panel(py3_7.out)

# ----
# Node
M_8 = Panel("""1.264074
-0.890372
5.063965""")
N_8 = Panel("""-32.231344
-23.518505
-143.750572""")
py3_8 = Python3Script(N=N_8, M=M_8)  # -> out, a; inputs Geo: Double, Prop: Double, N: list of Double, M: list of Double, XYZ: Double; same code as py3
optimal_solution_8 = Panel(py3_8.out)

# ----
# Check this
M_9 = Panel("""0.290565
0.037881
5.589117""")
N_9 = Panel("""-7.856548
-1.57131
-157.27284""")
py3_9 = Python3Script(N=N_9, M=M_9)  # -> out, a; inputs Geo: Double, Prop: Double, N: list of Double, M: list of Double, XYZ: Double; same code as py3
optimal_solution_9 = Panel(py3_9.out)

# ----
# Node
M_10 = Panel("""2.173756
-1.501031
0.093324""")
N_10 = Panel("""-10.28218
-7.540827
-35.001468""")
py3_10 = Python3Script(N=N_10, M=M_10)  # -> out, a; inputs Geo: Double, Prop: Double, N: list of Double, M: list of Double, XYZ: Double; same code as py3
optimal_solution_10 = Panel(py3_10.out)

# ----
# Node
M_11 = Panel("""-0.310434
-6.454676
1.574697""")
N_11 = Panel("""-243.234616
-42.977392
-26.880084""")
py3_11 = Python3Script(N=N_11, M=M_11)  # -> out, a; inputs Geo: Double, Prop: Double, N: list of Double, M: list of Double, XYZ: Double; same code as py3
optimal_solution_11 = Panel(py3_11.out)

# ----
# Node
M_12 = Panel("""-0.285351
-5.314366
2.997246""")
N_12 = Panel("""-193.056412
-43.580884
-49.885846""")
py3_12 = Python3Script(N=N_12, M=M_12)  # -> out, a; inputs Geo: Double, Prop: Double, N: list of Double, M: list of Double, XYZ: Double; same code as py3
optimal_solution_12 = Panel(py3_12.out)

# ----
# Node
M_13 = Panel("""-0.198743
-3.185285
4.139896""")
N_13 = Panel("""-104.940477
-43.655856
-65.189184""")
py3_13 = Python3Script(N=N_13, M=M_13)  # -> out, a; inputs Geo: Double, Prop: Double, N: list of Double, M: list of Double, XYZ: Double; same code as py3_4
optimal_solution_13 = Panel(py3_13.out)

# ----
# Check this
M_14 = Panel("""0.165592
-0.022195
4.203401""")
N_14 = Panel("""-9.255078
-1.851016
-75.564631""")
py3_14 = Python3Script(N=N_14, M=M_14)  # -> out, a; inputs Geo: Double, Prop: Double, N: list of Double, M: list of Double, XYZ: Double; same code as py3
optimal_solution_14 = Panel(py3_14.out)

# ----
# Node
M_15 = Panel("""-0.315531
-6.815001
0.053023""")
N_15 = Panel("""-260.871783
-42.987433
0.575785""")
py3_15 = Python3Script(N=N_15, M=M_15)  # -> out, a; inputs Geo: Double, Prop: Double, N: list of Double, M: list of Double, XYZ: Double
# ---------- py3_15: Python ----------
"""Grasshopper Script"""
import numpy as np
from scipy.optimize import minimize

tol=1
Objective_0=10**9

# units are kN and m

# INTERNAL FORCES
# #midspan top
# N=[-200,300,75]
# M =[-60,40,-20]
# mu=1
# Nx=mu*N[0]
# Ny=mu*N[1]
# Nxy=mu*N[2]
# Mx=mu*M[0]
# My=mu*M[1]
# Mxy=mu*M[2]

Nx=N[0]
Ny=N[1]
Nxy=N[2]
Mx=M[0]
My=M[1]
Mxy=M[2]

# INPUT DATA

# fc = 6895       #  kN/m2
# h = 0.254       #  m
# hxt = 0.1016    #  m
# hxb = 0.1016    #  m
# hyt = 0.1016    #  m
# hyb = 0.1016    #  m

#fcd = 3000       #  kN/m2
#fc = (0.6*(1-fcd/100/250))*100       #  kN/m2
fc = 20000       #  kN/m2
ftc=fc
fbc=fc
h = 0.1         #  m
c= 0.025         #  m
hxt = (h-2*c)/2     #  m
hxb = (h-2*c)/2     #  m
hyt = (h-2*c)/2     #  m
hyb = (h-2*c)/2     #  m

# PRINCIPAL DIRECTIONS

# Nxt=Nx-Mx/(0.8*h)
# Nyt=Ny-My/(0.8*h)
# Nxyt=Nxy-Mxy/(0.8*h)
# print(Nxt)
# print(Nyt)
# print(Nxyt)
# # print(th_t_grads)
# th_t=np.arctan(2*Nxyt/(Nxt-Nyt))/2
# th_t_grads=th_t*180/3.14
# # print(th_t)
# print(th_t_grads)

# Nxb=Nx+Mx/(0.8*h)
# Nyb=Ny+My/(0.8*h)
# Nxyb=Nxy+Mxy/(0.8*h)
# print(Nxb)
# print(Nyb)
# print(Nxyb)
# th_b=np.arctan(2*Nxyb/(Nxb-Nyb))/2
# th_b_grads=th_b*180/3.14
# # print(th_b)
# print(th_b_grads)

# OTHER EQUATIONS NOT USED

#Nxt=(hxb*Nx-Mx)/(hxt+hxb)
#Nxb=(hxt*Nx+Mx)/(hxt+hxb)
#Nyt=(hyb*Ny-My)/(hyt+hyb)
#Nyb=(hyt*Ny+My)/(hyt+hyb)
#Nxyt=((h-x[3])/2*Nxy-Mxy)/(h-(x[2]+x[3])/2)
#Nxyb=((h-x[2])/2*Nxy+Mxy)/(h-(x[2]+x[3])/2)

#Cxtt=(hxb+(h-x[2])/2)/(hxt+hxb)
#Cxtb=(hxb-(h-x[3])/2)/(hxt+hxb)
#Cxbt=(hxt-(h-x[2])/2)/(hxt+hxb)
#Cxbb=(hxt+(h-x[3])/2)/(hxt+hxb)
#Cytt=(hyb+(h-x[2])/2)/(hyt+hyb)
#Cytb=(hyb-(h-x[3])/2)/(hyt+hyb)
#Cybt=(hyt-(h-x[2])/2)/(hyt+hyb)
#Cybb=(hyt+(h-x[3])/2)/(hyt+hyb)

#Nxtr=(hxb*Nx-Mx)/(hxt+hxb)+(((h-x[3])/2*Nxy-Mxy)/(h-(x[2]+x[3])/2))*((hxb+(h-x[2])/2)/(hxt+hxb))*np.tan(x[0])+(((h-x[2])/2*Nxy+Mxy)/(h-(x[2]+x[3])/2))*((hxb-(h-x[3])/2)/(hxt+hxb))*np.tan(x[1])
#Nxbr=(hxt*Nx+Mx)/(hxt+hxb)+(((h-x[3])/2*Nxy-Mxy)/(h-(x[2]+x[3])/2))*((hxt-(h-x[2])/2)/(hxt+hxb))*np.tan(x[0])+(((h-x[2])/2*Nxy+Mxy)/(h-(x[2]+x[3])/2))*((hxt+(h-x[3])/2)/(hxt+hxb))*np.tan(x[1])
#Nytr=(hyb*Ny-My)/(hyt+hyb)+(((h-x[3])/2*Nxy-Mxy)/(h-(x[2]+x[3])/2))*((hyb+(h-x[2])/2)/(hyt+hyb))/np.tan(x[0])+(((h-x[2])/2*Nxy+Mxy)/(h-(x[2]+x[3])/2))*((hyb-(h-x[3])/2)/(hyt+hyb))/np.tan(x[1])
#Nybr=(hyt*Ny+My)/(hyt+hyb)+(((h-x[3])/2*Nxy-Mxy)/(h-(x[2]+x[3])/2))*((hyt-(h-x[2])/2)/(hyt+hyb))/np.tan(x[0])+(((h-x[2])/2*Nxy+Mxy)/(h-(x[2]+x[3])/2))*((hyt+(h-x[3])/2)/(hyt+hyb))/np.tan(x[1])

# The following solution is obtained from four equilibrium equations only, Nx, Ny, Mx, and My
#Nxtr=(hxb*Nx-Mx)/(hxt+hxb)+((hxb+(h-x[2])/2)/(hxt+hxb))*x[2]*ftc*np.sin**2(x[0])+((hxb-(h-x[3])/2)/(hxt+hxb))*x[3]*fbc*np.sin**2(x[1])
#Nxbr=(hxt*Nx+Mx)/(hxt+hxb)+((hxt-(h-x[2])/2)/(hxt+hxb))*x[2]*ftc*np.sin**2(x[0])+((hxt+(h-x[3])/2)/(hxt+hxb))*x[3]*fbc*np.sin**2(x[1])
#Nytr=(hyb*Ny-My)/(hyt+hyb)+((hyb+(h-x[2])/2)/(hyt+hyb))*x[2]*ftc*np.cos**2(x[0])+((hyb-(h-x[3])/2)/(hyt+hyb))*x[3]*fbc*np.cos**2(x[1])
#Nybr=(hyt*Ny+My)/(hyt+hyb)+((hyt-(h-x[2])/2)/(hyt+hyb))*x[2]*ftc*np.cos**2(x[0])+((hyt+(h-x[3])/2)/(hyt+hyb))*x[3]*fbc*np.cos**2(x[1])

# The following solution is obtained from four equilibrium equations only, Nx, Ny, Mx, and My
#Nxtr=(hxb*Nx-Mx)/(hxt+hxb)+((hxb+(h-x[2])/2)/(hxt+hxb))*x[2]*ftc*(np.sin(x[0]))**2+((hxb-(h-x[3])/2)/(hxt+hxb))*x[3]*fbc*(np.sin(x[1]))**2
#Nxbr=(hxt*Nx+Mx)/(hxt+hxb)+((hxt-(h-x[2])/2)/(hxt+hxb))*x[2]*ftc*(np.sin(x[0]))**2+((hxt+(h-x[3])/2)/(hxt+hxb))*x[3]*fbc*(np.sin(x[1]))**2
#Nytr=(hyb*Ny-My)/(hyt+hyb)+((hyb+(h-x[2])/2)/(hyt+hyb))*x[2]*ftc*(np.cos(x[0]))**2+((hyb-(h-x[3])/2)/(hyt+hyb))*x[3]*fbc*(np.cos(x[1]))**2
#Nybr=(hyt*Ny+My)/(hyt+hyb)+((hyt-(h-x[2])/2)/(hyt+hyb))*x[2]*ftc*(np.cos(x[0]))**2+((hyt+(h-x[3])/2)/(hyt+hyb))*x[3]*fbc*(np.cos(x[1]))**2


# FORCES IN REINFORCEMENT BASED ON EQUILIBRIUM IN FUNCTION OF 
#x[0]   # Theta t (crack direction at top)
#x[1]   # Theta b (crack direction at bottom)
#x[2]   # at      (depth of compressive stress block at top)
#x[3]   # ab      (depth of compressive stress block at bottom)


def Nxtr(x):
    return ((hxb*Nx-Mx)/(hxt+hxb)+((hxb+(h-x[2])/2)/(hxt+hxb))*x[2]*ftc*(np.sin(x[0]))**2+((hxb-(h-x[3])/2)/(hxt+hxb))*x[3]*fbc*(np.sin(x[1]))**2)

def Nxbr(x):
    return ((hxt*Nx+Mx)/(hxt+hxb)+((hxt-(h-x[2])/2)/(hxt+hxb))*x[2]*ftc*(np.sin(x[0]))**2+((hxt+(h-x[3])/2)/(hxt+hxb))*x[3]*fbc*(np.sin(x[1]))**2)

def Nytr(x):
    return ((hyb*Ny-My)/(hyt+hyb)+((hyb+(h-x[2])/2)/(hyt+hyb))*x[2]*ftc*(np.cos(x[0]))**2+((hyb-(h-x[3])/2)/(hyt+hyb))*x[3]*fbc*(np.cos(x[1]))**2)

def Nybr(x):
    return ((hyt*Ny+My)/(hyt+hyb)+((hyt-(h-x[2])/2)/(hyt+hyb))*x[2]*ftc*(np.cos(x[0]))**2+((hyt+(h-x[3])/2)/(hyt+hyb))*x[3]*fbc*(np.cos(x[1]))**2)

def Objective(x):
    return abs(Nxtr(x))+abs(Nxbr(x))+abs(Nytr(x))+abs(Nybr(x))

S=[[1,1],[1,-1],[-1,1],[-1,-1]]

s=0
x0 = np.zeros(4)

while s < 4:
    # initial guesses
    st=S[s][0]
    sb=S[s][1]
    x0[0] = st*3.14/4   # Theta top (th_t)
    x0[1] = sb*3.14/4   # Theta bottom (th_b)
    x0[2] = 0.2*h       # at
    x0[3] = 0.2*h       # ab

    if x0[0]>0:
        th_bounds_t = (0,1.57)
    else:
        th_bounds_t = (-1.57,0)
    
    if x0[1]>0:
        th_bounds_b = (0,1.57)
    else:
        th_bounds_b = (-1.57,0)

    # th_bounds_t = (-1.57,1.57)
    # th_bounds_b = (-1.57,1.57)

    # if Nxtr(x0)<0 and Nytr(x0)>0:
    #     th_t = Symbol('th_t')
    #     eqn = Eq((hxb*Nx-Mx)/(hxt+hxb)+(((h-x0[3])/2*Nxy-Mxy)/(h-(x0[2]+x0[3])/2))*((hxb+(h-x0[2])/2)/(hxt+hxb))*tan(th_t)+(((h-x0[2])/2*Nxy+Mxy)/(h-(x0[2]+x0[3])/2))*((hxb-(h-x0[3])/2)/(hxt+hxb))*tan(x0[1]), 0)
    #     th_t_0=solve(eqn)
    #     print('cond1')
    #     x0[0]=th_t_0[0]

    # if Nxbr(x0)<0 and Nybr(x0)>0:
    #     th_b = Symbol('th_b')
    #     eqn = Eq((hxt*Nx+Mx)/(hxt+hxb)+(((h-x0[3])/2*Nxy-Mxy)/(h-(x0[2]+x0[3])/2))*((hxt-(h-x0[2])/2)/(hxt+hxb))*tan(x0[0])+(((h-x0[2])/2*Nxy+Mxy)/(h-(x0[2]+x0[3])/2))*((hxt+(h-x0[3])/2)/(hxt+hxb))*tan(th_b), 0)
    #     th_b_0=solve(eqn)
    #     print(th_b_0)
    #     print('cond2')
    #     x0[1]=th_b_0[0]

    # if Nytr(x0)<0 and Nxtr(x0)>0:
    #     th_t = Symbol('th_t')
    #     eqn = Eq((hyb*Ny-My)/(hyt+hyb)+(((h-x0[3])/2*Nxy-Mxy)/(h-(x0[2]+x0[3])/2))*((hyb+(h-x0[2])/2)/(hyt+hyb))/tan(th_t)+(((h-x0[2])/2*Nxy+Mxy)/(h-(x0[2]+x0[3])/2))*((hyb-(h-x0[3])/2)/(hyt+hyb))/tan(x0[1]), 0)
    #     th_t_0=solve(eqn)
    #     print('cond3')
    #     x0[0]=th_t_0[0]

    # if Nybr(x0) < 0 and Nxbr(x0)>0:
    #     th_b = Symbol('th_b')
    #     eqn = Eq((hyt*Ny+My)/(hyt+hyb)+(((h-x0[3])/2*Nxy-Mxy)/(h-(x0[2]+x0[3])/2))*((hyt-(h-x0[2])/2)/(hyt+hyb))/np.tan(x0[0])+(((h-x0[2])/2*Nxy+Mxy)/(h-(x0[2]+x0[3])/2))*((hyt+(h-x0[3])/2)/(hyt+hyb))/np.tan(th_b), 0)
    #     th_b_0=solve(eqn)
    #     print('cond4')
    #     print(th_b_0)
    #     x0[1]=th_b_0[0]

    a_bounds = (0*h,0.99*h)

    B = (th_bounds_t, th_bounds_b, a_bounds, a_bounds)


    def Nx_f(x):
        return -abs(((hxb*Nx-Mx)/(hxt+hxb)+((hxb+(h-x[2])/2)/(hxt+hxb))*x[2]*ftc*(np.sin(x[0]))**2+((hxb-(h-x[3])/2)/(hxt+hxb))*x[3]*fbc*(np.sin(x[1]))**2)\
            +((hxt*Nx+Mx)/(hxt+hxb)+((hxt-(h-x[2])/2)/(hxt+hxb))*x[2]*ftc*(np.sin(x[0]))**2+((hxt+(h-x[3])/2)/(hxt+hxb))*x[3]*fbc*(np.sin(x[1]))**2)\
                +(-x[2]*fc)*(np.sin(x[0]))**2 + (-x[3]*fc)*(np.sin(x[1]))**2-Nx)+tol

    def Ny_f(x):
        return -abs(((hyb*Ny-My)/(hyt+hyb)+((hyb+(h-x[2])/2)/(hyt+hyb))*x[2]*ftc*(np.cos(x[0]))**2+((hyb-(h-x[3])/2)/(hyt+hyb))*x[3]*fbc*(np.cos(x[1]))**2)\
                +((hyt*Ny+My)/(hyt+hyb)+((hyt-(h-x[2])/2)/(hyt+hyb))*x[2]*ftc*(np.cos(x[0]))**2+((hyt+(h-x[3])/2)/(hyt+hyb))*x[3]*fbc*(np.cos(x[1]))**2)\
                    + (-x[2]*fc)*(np.cos(x[0]))**2 + (-x[3]*fc)*(np.cos(x[1]))**2-Ny)+tol

    def Nxy_f(x):
        return -abs(x[2]*fc*np.sin(x[0])*np.cos(x[0]) + x[3]*fc*np.sin(x[1])*np.cos(x[1])-Nxy)+tol

    def Mx_f(x):
        return -abs(-((hxb*Nx-Mx)/(hxt+hxb)+((hxb+(h-x[2])/2)/(hxt+hxb))*x[2]*ftc*(np.sin(x[0]))**2+((hxb-(h-x[3])/2)/(hxt+hxb))*x[3]*fbc*(np.sin(x[1]))**2)*hxt+\
                ((hxt*Nx+Mx)/(hxt+hxb)+((hxt-(h-x[2])/2)/(hxt+hxb))*x[2]*ftc*(np.sin(x[0]))**2+((hxt+(h-x[3])/2)/(hxt+hxb))*x[3]*fbc*(np.sin(x[1]))**2)*hxb\
                    + x[2]*fc*((h-x[2])/2)*(np.sin(x[0]))**2 - x[3]*fc*((h-x[3])/2)*(np.sin(x[1]))**2-Mx)+tol

    def My_f(x):
        return -abs(-((hyb*Ny-My)/(hyt+hyb)+((hyb+(h-x[2])/2)/(hyt+hyb))*x[2]*ftc*(np.cos(x[0]))**2+((hyb-(h-x[3])/2)/(hyt+hyb))*x[3]*fbc*(np.cos(x[1]))**2)*hyt+\
                    ((hyt*Ny+My)/(hyt+hyb)+((hyt-(h-x[2])/2)/(hyt+hyb))*x[2]*ftc*(np.cos(x[0]))**2+((hyt+(h-x[3])/2)/(hyt+hyb))*x[3]*fbc*(np.cos(x[1]))**2)*hyb\
                        + x[2]*fc*(h-x[2])/2*(np.cos(x[0]))**2 - x[3]*fc*(h-x[3])/2*(np.cos(x[1]))**2-My)+tol
    
    def Mxy_f(x):
        return -abs(-x[2]*fc*(h-x[2])/2*np.sin(x[0])*np.cos(x[0]) + x[3]*fc*(h-x[3])/2*np.sin(x[1])*np.cos(x[1])-Mxy)+tol
    
    def h_f(x):
        return h-x[2]-x[3]

    # con1 = {'type': 'ineq', 'fun': Nx_f}
    # con2 = {'type': 'ineq', 'fun': Ny_f}
    con3 = {'type': 'eq', 'fun': Nxy_f}
    # con4 = {'type': 'ineq', 'fun': Mx_f}
    # con5 = {'type': 'ineq', 'fun': My_f}
    con6 = {'type': 'eq', 'fun': Mxy_f}
    con7 = {'type': 'ineq', 'fun': h_f}
    con8 = {'type': 'ineq', 'fun': Nxtr}
    con9 = {'type': 'ineq', 'fun': Nxbr}
    con10 = {'type': 'ineq', 'fun': Nytr}
    con11 = {'type': 'ineq', 'fun': Nybr}

    cons = ([con3,con6,con7,con8,con9,con10,con11])

    # cons = ([con3,con6,con7])

    solution = minimize(Objective,x0,method='SLSQP',bounds=B,constraints=cons,options={'disp':False,'ftol':tol})

    # solution = minimize(Objective,x0,method='SLSQP',bounds=B,constraints=cons,options={'disp':False})

    x0_s = solution.x

    # if(solution.message=='Optimization terminated successfully'):
    if(solution.message=='Optimization terminated successfully' and Objective(x0_s)<Objective_0):        
        x0_i = x0
        message=solution.message
        print(x0_i)
        x0_f = x0_s
 
    s=s+1

    #x = solution.x

    # show final objective
    #print('Final SSE Objective: ' + str(objective(x)))

    # print solution
    #print('Solution')
    #print('x0 = ' + str(x[0]))
    #print('x1 = ' + str(x[1]))
    #print('x2 = ' + str(x[2]))
    #print('x3 = ' + str(x[3]))

print(message)
print(x0_f)
print(Objective(x0_f))
print(Nx_f(x0_f))
print(Ny_f(x0_f))
print(Nxy_f(x0_f))
print(Mx_f(x0_f))
print(My_f(x0_f))
print(Mxy_f(x0_f))

print(Nxtr(x0_f))
print(Nxbr(x0_f))
print(Nytr(x0_f))
print(Nybr(x0_f))
# ---------- end py3_15 ----------
optimal_solution_15 = Panel(py3_15.out)

# ----
# Node
M_16 = Panel("""-2.154531
-10.303465
0.911577""")
N_16 = Panel("""-125.297045
-55.003096
-1.149443""")
py3_16 = Python3Script(N=N_16, M=M_16)  # -> out, a; inputs Geo: Double, Prop: Double, N: list of Double, M: list of Double, XYZ: Double; same code as py3
optimal_solution_16 = Panel(py3_16.out)

# ----
# Node
M_17 = Panel("""-1.700195
-7.985378
1.70886""")
N_17 = Panel("""-92.2731
-50.916914
-7.462764""")
py3_17 = Python3Script(N=N_17, M=M_17)  # -> out, a; inputs Geo: Double, Prop: Double, N: list of Double, M: list of Double, XYZ: Double; same code as py3
optimal_solution_17 = Panel(py3_17.out)

# ----
# Node
M_18 = Panel("""-0.924532
-4.366562
2.23594""")
N_18 = Panel("""-46.072397
-46.356777
-11.173672""")
py3_18 = Python3Script(N=N_18, M=M_18)  # -> out, a; inputs Geo: Double, Prop: Double, N: list of Double, M: list of Double, XYZ: Double; same code as py3
optimal_solution_18 = Panel(py3_18.out)

# ----
# Node
M_19 = Panel("""0.124859
-0.046666
2.068464""")
N_19 = Panel("""-1.75097
-0.350194
-18.759677""")
py3_19 = Python3Script(N=N_19, M=M_19)  # -> out, a; inputs Geo: Double, Prop: Double, N: list of Double, M: list of Double, XYZ: Double; same code as py3
optimal_solution_19 = Panel(py3_19.out)

# ----
# Node
M_20 = Panel("""-2.307912
-11.096935
-0.003444""")
N_20 = Panel("""-138.563871
-56.602878
8.034339""")
py3_20 = Python3Script(N=N_20, M=M_20)  # -> out, a; inputs Geo: Double, Prop: Double, N: list of Double, M: list of Double, XYZ: Double; same code as py3
optimal_solution_20 = Panel(py3_20.out)

# ----
# Node
M_21 = Panel("""-2.782324
-11.435716
-0.103945""")
N_21 = Panel("""-40.283841
-53.377208
-0.255169""")
py3_21 = Python3Script(N=N_21, M=M_21)  # -> out, a; inputs Geo: Double, Prop: Double, N: list of Double, M: list of Double, XYZ: Double; same code as py3
optimal_solution_21 = Panel(py3_21.out)

# ----
# Node
M_22 = Panel("""-2.13493
-8.692099
-0.123006""")
N_22 = Panel("""-26.308703
-48.489752
0.218134""")
py3_22 = Python3Script(N=N_22, M=M_22)  # -> out, a; inputs Geo: Double, Prop: Double, N: list of Double, M: list of Double, XYZ: Double; same code as py3
optimal_solution_22 = Panel(py3_22.out)

# ----
# Node
M_23 = Panel("""-1.105305
-4.634504
-0.112559""")
N_23 = Panel("""-12.124159
-44.615396
0.316342""")
py3_23 = Python3Script(N=N_23, M=M_23)  # -> out, a; inputs Geo: Double, Prop: Double, N: list of Double, M: list of Double, XYZ: Double; same code as py3
optimal_solution_23 = Panel(py3_23.out)

# ----
# Node
M_24 = Panel("""0.116176
-0.051999
-0.316009""")
N_24 = Panel("""0.577489
0.115498
-2.296489""")
py3_24 = Python3Script(N=N_24, M=M_24)  # -> out, a; inputs Geo: Double, Prop: Double, N: list of Double, M: list of Double, XYZ: Double; same code as py3
optimal_solution_24 = Panel(py3_24.out)

# ----
# Node
M_25 = Panel("""3.096684
0.207755
0.615599""")
N_25 = Panel("""306.137963
-27.570548
58.811283""")
py3_25 = Python3Script(N=N_25, M=M_25)  # -> out, a; inputs Geo: Double, Prop: Double, N: list of Double, M: list of Double, XYZ: Double; same code as py3
optimal_solution_25 = Panel(py3_25.out)

viewer = ParamViewer(merge)

py3_26 = Python3Script(N=panel_7, M=panel_7)  # -> out, message; inputs Geo: Double, Prop: Double, N: list of Double, M: list of Double, XYZ: Double
# ---------- py3_26: Python ----------
"""Grasshopper Script"""
import numpy as np
from scipy.optimize import minimize

tol=1
Objective_0=10**9

# units are kN and m

Nx=N[0]
Ny=N[1]
Nxy=N[2]
Mx=M[3]
My=M[4]
Mxy=M[5]

# INPUT DATA

fc = 20000       #  kN/m2
ftc=fc
fbc=fc
h = 0.1         #  m
c= 0.025         #  m
hxt = (h-2*c)/2     #  m
hxb = (h-2*c)/2     #  m
hyt = (h-2*c)/2     #  m
hyb = (h-2*c)/2     #  m

# FORCES IN REINFORCEMENT BASED ON EQUILIBRIUM IN FUNCTION OF 
#x[0]   # Theta t (crack direction at top)
#x[1]   # Theta b (crack direction at bottom)
#x[2]   # at      (depth of compressive stress block at top)
#x[3]   # ab      (depth of compressive stress block at bottom)


def Nxtr(x):
    return ((hxb*Nx-Mx)/(hxt+hxb)+((hxb+(h-x[2])/2)/(hxt+hxb))*x[2]*ftc*(np.sin(x[0]))**2+((hxb-(h-x[3])/2)/(hxt+hxb))*x[3]*fbc*(np.sin(x[1]))**2)

def Nxbr(x):
    return ((hxt*Nx+Mx)/(hxt+hxb)+((hxt-(h-x[2])/2)/(hxt+hxb))*x[2]*ftc*(np.sin(x[0]))**2+((hxt+(h-x[3])/2)/(hxt+hxb))*x[3]*fbc*(np.sin(x[1]))**2)

def Nytr(x):
    return ((hyb*Ny-My)/(hyt+hyb)+((hyb+(h-x[2])/2)/(hyt+hyb))*x[2]*ftc*(np.cos(x[0]))**2+((hyb-(h-x[3])/2)/(hyt+hyb))*x[3]*fbc*(np.cos(x[1]))**2)

def Nybr(x):
    return ((hyt*Ny+My)/(hyt+hyb)+((hyt-(h-x[2])/2)/(hyt+hyb))*x[2]*ftc*(np.cos(x[0]))**2+((hyt+(h-x[3])/2)/(hyt+hyb))*x[3]*fbc*(np.cos(x[1]))**2)

def Objective(x):
    return abs(Nxtr(x))+abs(Nxbr(x))+abs(Nytr(x))+abs(Nybr(x))

S=[[1,1],[1,-1],[-1,1],[-1,-1]]

s=0
x0 = np.zeros(4)

while s < 4:
    
    # initial guesses

    st=S[s][0]
    sb=S[s][1]
    x0[0] = st*3.14/4   # Theta top (th_t)
    x0[1] = sb*3.14/4   # Theta bottom (th_b)
    x0[2] = 0.2*h       # at
    x0[3] = 0.2*h       # ab

    #bounds
    
    if x0[0]>0:
        th_bounds_t = (0,1.57)
    else:
        th_bounds_t = (-1.57,0)
    
    if x0[1]>0:
        th_bounds_b = (0,1.57)
    else:
        th_bounds_b = (-1.57,0)


    a_bounds = (0*h,0.99*h)

    B = (th_bounds_t, th_bounds_b, a_bounds, a_bounds)

    #EQUILIBRIUM EQUATIONS

    def Nx_f(x):
        return (((hxb*Nx-Mx)/(hxt+hxb)+((hxb+(h-x[2])/2)/(hxt+hxb))*x[2]*ftc*(np.sin(x[0]))**2+((hxb-(h-x[3])/2)/(hxt+hxb))*x[3]*fbc*(np.sin(x[1]))**2)\
            +((hxt*Nx+Mx)/(hxt+hxb)+((hxt-(h-x[2])/2)/(hxt+hxb))*x[2]*ftc*(np.sin(x[0]))**2+((hxt+(h-x[3])/2)/(hxt+hxb))*x[3]*fbc*(np.sin(x[1]))**2)\
                +(-x[2]*fc)*(np.sin(x[0]))**2 + (-x[3]*fc)*(np.sin(x[1]))**2-Nx)

    def Ny_f(x):
        return (((hyb*Ny-My)/(hyt+hyb)+((hyb+(h-x[2])/2)/(hyt+hyb))*x[2]*ftc*(np.cos(x[0]))**2+((hyb-(h-x[3])/2)/(hyt+hyb))*x[3]*fbc*(np.cos(x[1]))**2)\
                +((hyt*Ny+My)/(hyt+hyb)+((hyt-(h-x[2])/2)/(hyt+hyb))*x[2]*ftc*(np.cos(x[0]))**2+((hyt+(h-x[3])/2)/(hyt+hyb))*x[3]*fbc*(np.cos(x[1]))**2)\
                    + (-x[2]*fc)*(np.cos(x[0]))**2 + (-x[3]*fc)*(np.cos(x[1]))**2-Ny)

    def Nxy_f(x):
        return (x[2]*fc*np.sin(x[0])*np.cos(x[0]) + x[3]*fc*np.sin(x[1])*np.cos(x[1])-Nxy)

    def Mx_f(x):
        return (-((hxb*Nx-Mx)/(hxt+hxb)+((hxb+(h-x[2])/2)/(hxt+hxb))*x[2]*ftc*(np.sin(x[0]))**2+((hxb-(h-x[3])/2)/(hxt+hxb))*x[3]*fbc*(np.sin(x[1]))**2)*hxt+\
                ((hxt*Nx+Mx)/(hxt+hxb)+((hxt-(h-x[2])/2)/(hxt+hxb))*x[2]*ftc*(np.sin(x[0]))**2+((hxt+(h-x[3])/2)/(hxt+hxb))*x[3]*fbc*(np.sin(x[1]))**2)*hxb\
                    + x[2]*fc*((h-x[2])/2)*(np.sin(x[0]))**2 - x[3]*fc*((h-x[3])/2)*(np.sin(x[1]))**2-Mx)

    def My_f(x):
        return (-((hyb*Ny-My)/(hyt+hyb)+((hyb+(h-x[2])/2)/(hyt+hyb))*x[2]*ftc*(np.cos(x[0]))**2+((hyb-(h-x[3])/2)/(hyt+hyb))*x[3]*fbc*(np.cos(x[1]))**2)*hyt+\
                    ((hyt*Ny+My)/(hyt+hyb)+((hyt-(h-x[2])/2)/(hyt+hyb))*x[2]*ftc*(np.cos(x[0]))**2+((hyt+(h-x[3])/2)/(hyt+hyb))*x[3]*fbc*(np.cos(x[1]))**2)*hyb\
                        + x[2]*fc*(h-x[2])/2*(np.cos(x[0]))**2 - x[3]*fc*(h-x[3])/2*(np.cos(x[1]))**2-My)
    
    def Mxy_f(x):
        return (-x[2]*fc*(h-x[2])/2*np.sin(x[0])*np.cos(x[0]) + x[3]*fc*(h-x[3])/2*np.sin(x[1])*np.cos(x[1])-Mxy)
    
    def h_f(x):
        return h-x[2]-x[3]

    con1 = {'type': 'eq', 'fun': Nxy_f}
    con2 = {'type': 'eq', 'fun': Mxy_f}
    con3 = {'type': 'ineq', 'fun': h_f}
    con4 = {'type': 'ineq', 'fun': Nxtr}
    con5 = {'type': 'ineq', 'fun': Nxbr}
    con6 = {'type': 'ineq', 'fun': Nytr}
    con7 = {'type': 'ineq', 'fun': Nybr}

    # cons = ([con1,con2,con3,con4,con5,con6,con7])

    cons = ([con1,con2,con3])

    solution = minimize(Objective,x0,method='SLSQP',bounds=B,constraints=cons,options={'disp':False,'ftol':tol})

    x0_s = solution.x

    # if(solution.message=='Optimization terminated successfully'):
    if(solution.message=='Optimization terminated successfully' and Objective(x0_s)<Objective_0):        
        x0_i = x0
        message=solution.message
        print(x0_i)
        x0_f = x0_s
 
    s=s+1

print(message)
print(x0_f)
print(Objective(x0_f))
print(Nx_f(x0_f))
print(Ny_f(x0_f))
print(Nxy_f(x0_f))
print(Mx_f(x0_f))
print(My_f(x0_f))
print(Mxy_f(x0_f))

print(Nxtr(x0_f))
print(Nxbr(x0_f))
print(Nytr(x0_f))
print(Nybr(x0_f))
# ---------- end py3_26 ----------
optimal_solution_26 = Panel(py3_26.out)

panel_9 = Panel(py3_26.message)
