# Grasshopper definition FRP RC shell Optimization - JCC 2025.gh (Grasshopper 1.0.8)
# plug-ins: Karamba3D, MeshEdit Components, Bifocals

# 1) I modified the starting grid
# defining the two diaphgrams at the
# two external sides by writing
# in polar coordinates these points
# which must belong to a circle
# of radius variable and in an angle wide
# 100° (from 40° up to 140°)
# as in the book.
# 2) In this way we can check loads
# on the FDM and we can manage
# the loads to apply in the FE model
# 3) In this way we can check loads
# on the FDM and we can manage
# the loads to apply in the FE model
# 4) In this way we can evaluate
# forces acting in each bar, function of
# M (Materialisation list)
# and force densities
# 5) In this way we can evaluate
# vertical planes for visualisation
# of shell forces
# 6) In this way we can evaluate
# the point on the top
galapagos = Galapagos(fitness=addition_3, gene=[force_density_q_kn_m, column_b_h_m])

# ---- group: PARAMETERS
# (0) PARAMETERS
# Lx
# Ly
# b=h
# FD
# t
force_density_q_kn_m = Slider(502, range=100..1250)
lx_total_span_m = Slider(15, range=0..30)
ly_total_span_m = Slider(15, range=0..30)
column_b_h_m = Slider(1.58, range=1..2)
thickness_m = Slider(0.1, range=0.1..0.5)

# ----
# discretization
# u
# v
# number of points in x and y directions (u=nx and v=ny)
# one point per meter without considering the column size
u = Addition(A=lx_total_span_m, B=1)
v = Addition(A=ly_total_span_m, B=1)

number_slider = Slider(0.5, range=0..1)

subtraction = Subtraction(A=v, B=1)
subtraction_2 = Subtraction(A=u, B=1)

# ----
# effective spans
# Lx,e
# Ly,e
net_ly = Subtraction(A=ly_total_span_m, B=column_b_h_m)
# Points
# (FF)
net_lx = Subtraction(A=lx_total_span_m, B=column_b_h_m)

# ----
# FD
# FD
panel = Panel([force_density_q_kn_m, column_b_h_m, net_lx, thickness_m, lx_total_span_m, ly_total_span_m])
division = Division(A=net_lx, B=number_slider)
division_2 = Division(A=division, B=number_slider)

# ----
# II step - Form Finding with
# linear Force Density Method
# (1) FORM FINDING
# Define the boundary conditions
# in an automatic way
# I step - Geometry of the structure:
# 5. I performed the FDM
# 6. Visualisation of the results
# in terms of Points and Lines
# 3. I defined the loads for the form finding
# which are loads per projected area:
# - Dead Load (specific weight * thickness)
# - Variable loads
# Finally I defined the force density
# which represent the internal forces
# (forces per unit length)
python_3_script = Python3Script(nx=u, ny=v, Lx=net_lx, Ly=net_ly, b=column_b_h_m)  # -> P, P0, I_P, Points; inputs nx: Int32, ny: Int32, Lx: Double, Ly: Double, b: Double
# ---------- python_3_script: Python ----------
import rhinoscriptsyntax as rs
import math
#nX = nr. of points in Y direction
#nY = nr. of points in X direction
#Lx = Length of the grid in X direction in m
#Ly = Length of the grid in Y direction in m

sx = round(float(Lx / (nx - 1)), 5)
sy = round(float(Ly / (ny - 1)), 5)
nr_points = int(nx * ny)


#How to evaluate the coordinates of points along X direction
def iteration_for_x(k, sx, i):
    while k != ny:
        X.append(sx * i + b / 2)
        X0.append(sx * i + b / 2)
        k += 1


#How to evaluate the coordinates of points along Y direction    
def iteration_for_y(j, sy):
    while j != ny:
        Y.append(sy * j + b / 2)
        Y0.append(sy * j + b / 2)
        j += 1       




X = []
Y = []
X0 = []
Y0 = []
k = 0
i = 0
j = 0
h = 0
while i != nx:
    iteration_for_x(k, sx, i)
    i += 1
while h != nx:
    iteration_for_y(j, sy)
    h += 1
#Evaluate the Z coordinates
Z = []
for i in range(0, nx * ny):
    z = 0
    Z.append(z)
    i += 1




P = [X, Y, Z]
P0 = [X0, Y0]
I_P = [sx, sy, nr_points, nx, ny]

print(P)
print(P0)
print(I_P)

print(nr_points)

Points = []
for i in range(0, len(X)):
    point = rs.AddPoint(X[i], Y[i], Z[i])
    Points.append(point)
print(Points)
# ---------- end python_3_script ----------
max = Maximum(A=net_lx, B=net_ly)
python_3_script_2 = Python3Script(I_P=python_3_script.I_P)  # -> s; inputs I_P: list of Double
# ---------- python_3_script_2: Python ----------
s = I_P[1]
print(s)
# ---------- end python_3_script_2 ----------
permessible_deflection_m = Division(A=max, B=250)
python_3_script_3 = Python3Script(nx=u, ny=v)  # -> Diaphragm1, Diaphragm2, Edge1, Edge2, Corner; inputs nx: Int32, ny: Int32
# ---------- python_3_script_3: Python ----------
n = nx * ny

Diaphragm1 = []
for j in range(0, ny):
    d1 = j
    Diaphragm1.append(d1)

Diaphragm2 = []
for j in range(n - ny, n):
    d2 = j
    Diaphragm2.append(d2)

Edge1 = []
j = 0
while j <= (n - ny):
    e1 = j
    Edge1.append(e1)
    j += ny

Edge2 = []
j = ny - 1
while j <= n:
    e2 = j
    Edge2.append(e2)
    j += ny

Corner = [Diaphragm1[0], Diaphragm1[-1], Diaphragm2[0], Diaphragm2[-1]]
Diaphragm1.remove(Diaphragm1[0])
Diaphragm1.remove(Diaphragm1[-1])
Diaphragm2.remove(Diaphragm2[0])
Diaphragm2.remove(Diaphragm2[-1])
Edge1.remove(Edge1[0])
Edge1.remove(Edge1[-1])
Edge2.remove(Edge2[0])
Edge2.remove(Edge2[-1])


print(Diaphragm1)
print(Diaphragm2)
print(Edge1)
print(Edge2)
print(Corner)
# ---------- end python_3_script_3 ----------
qk_kn_m2 = Slider(1.5, range=0..10)
multiplication = Multiplication(A=thickness_m, B=python_3_script_2)

point_list = PointList(Points=python_3_script.Points)
python_3_script_4 = Python3Script()  # -> out, lista
# ---------- python_3_script_4: Python ----------
#lista = [13, 429, 221, 110, 318]
lista = []
# ---------- end python_3_script_4 ----------
# Nuova scrittura FDM
# 09/09/25
python_3_script_5 = Python3Script(
    Points=python_3_script.Points,
    XF_index=[python_3_script_3.Corner, python_3_script_3.Diaphragm2, python_3_script_3.Diaphragm1],
    YF_index=[python_3_script_3.Corner, python_3_script_3.Edge2, python_3_script_3.Edge1],
    ZF_index=[python_3_script_4.lista, python_3_script_3.Corner],
    q=force_density_q_kn_m,
    Qz=qk_kn_m2,
    A=multiplication,
    ro="2400")  # -> Points, Nurbs_y, Nurbs_x, Surface, z; inputs Points: list of Point3d, XF_index: list of Int32, YF_index: list of Int32, ZF_index: list of Int32, Qz: Double, A: Double, ro: Int32
# ---------- python_3_script_5: Python ----------
'''
                *** Force Density Method for GRASSHOPPER***
    
The Method and also the code is structured in this way:
1) Evaluate a Grid of (X Y Z) points by fixing Lx and Ly which represent the xy spacing (input values);
2) Evaluate the Branch-Node Matrix;
3) Evaluate the vector of external Loads (P) and the Diagonal Matrix of Force Densities (Q)
4) Evaluate the fixed and free vectors of Points
5) Solve the Linear system: (CNT * Q * CN) * XN = P - ((CNT * Q * CF) * XF)

For this application the method will be iterative because the own weight of the structure is function of
the length of bars (Load per unit area). The loop will stop when the residual force in the equilibrium
equation will be lower than a low value.    
    '''
import numpy as np


Bool = []
X_0 = []
Y_0 = []
Z_0 = []

for i in Points:
    X_0.append(i[0])
    Y_0.append(i[1])
    Z_0.append(i[2])
    Bool.append(True)


ny = 1
for i in range(len(Y_0)):
    if X_0[i + 1] - X_0[i] == 0:
        ny += 1
    else:
        break
nx = int(len(X_0) / ny)

nr_points = int(nx * ny)

sx = round((max(X_0) - min(X_0)) / (nx - 1), 5)
sy = round((max(Y_0) - min(Y_0)) / (ny - 1), 5)   

XF_index.sort(), YF_index.sort(), ZF_index.sort()

## BRANCH-NODE MATRIX ##

def definition_of_CT_x(j, X, Y):
  a = []
  for i in range(len(X)):
      if X[j] != X[i]:
          if round(abs(X[j] - X[i]), 5) == sx and round(abs(Y[j] - Y[i]), 5) == 0:
              cx = (X[i] - X[j]) / sx
          else:
              cx = 0
          a.append(cx)   
      i += 1  
  return a  

def definition_of_CT_y(j, X, Y):
  b = []
  for i in range(len(Y)):
      if Y[j] != Y[i]:
          if round(abs(Y[j] - Y[i]), 5) == sy and round(abs(X[j] - X[i]), 5) == 0:
              cy = (Y[i] - Y[j]) / sy
          else:
              cy = 0
          b.append(cy)   
      i += 1  
  return b

CT_x = []
for j in range(len(X_0)):
    CT_x.append(definition_of_CT_x(j, X_0, Y_0))
    j += 1
CT_y = []
for j in range(len(Y_0)):
    CT_y.append(definition_of_CT_y(j, X_0, Y_0))
    j += 1

k = 0
CT = []
for k in range(len(CT_y)):
    CT.append(CT_x[k] + CT_y[k])
    k += 1

Cx_T = Cy_T = Cz_T = CT.copy()
Bool_x = Bool.copy()
Bool_y = Bool.copy()
Bool_z = Bool.copy()


for i in range(len(Bool)):
    if i in XF_index:
        Bool_x[i] = False
for i in range(len(Bool)):
    if i in YF_index:
        Bool_y[i] = False
for i in range(len(Bool)):
    if i in ZF_index:
        Bool_z[i] = False    


CxF_T = []
CxN_T = []
XF = []
for i in range(len(Bool_x)):
    if Bool_x[i] == False:
        CxF_T.append(Cx_T[i])
        XF.append(X_0[i])
    else:
        CxN_T.append(Cx_T[i])

CyF_T = []
CyN_T = []
YF = []
for i in range(len(Bool_y)):
    if Bool_y[i] == False:
        CyF_T.append(Cy_T[i])
        YF.append(Y_0[i])
    else:
        CyN_T.append(Cy_T[i])

CzF_T = []
CzN_T = []
ZF = []
for i in range(len(Bool_z)):
    if Bool_z[i] == False:
        CzF_T.append(Cz_T[i])
        ZF.append(Z_0[i])
    else:
        CzN_T.append(Cz_T[i])


## LOADS ##

def function_y_Qk(j, X, Y):
    count = 0
    for i in range(0, nr_points):
        if Y[j] != Y[i]:
            if round(abs(X[i] - X[j]), 5) == 0 and round(abs(Y[i] - Y[j]), 5) == sy:
                count = count + 1
            ly = float(sy / 2 * count)
    return ly

def function_x_Qk(j, X, Y):
    count = 0
    for i in range(0, nr_points):
        if X[j] != X[i]:
            if round(abs(X[i] - X[j]), 5) == sx and round(abs(Y[i] - Y[j]), 5) == 0:
                count = count + 1
            lx = float(sx / 2 * count)
    return lx


PzQ = []
Ap = []
for j in range(nr_points):
    lx = function_x_Qk(j, X_0, Y_0)
    ly = function_y_Qk(j, X_0, Y_0)
    a = lx * ly
    Ap.append(a)
    pz_q = Qz * a
    PzQ.append(pz_q)
    j += 1

PzN_Q = []
for i in range(len(Bool_z)):
    if Bool_z[i] == True:
        PzN_Q.append(PzQ[i])


def u_function(CT, X):
    CT = np.array(CT)
    C = np.transpose(CT)
    X = np.array(X)
    u = np.matmul(C, X)
    return u

g = float(9.81) #m/s^2
u = u_function(CT, X_0)
v = u_function(CT, Y_0)
w = u_function(CT, Z_0)
l = (u ** 2 + v ** 2 + w ** 2) ** 0.5
Pz_G = np.matmul((0.5 * ro * g * A / 1000) * abs(np.array(CzN_T)), l).tolist()

P_z = []
for i in range(len(Pz_G)):
    P_z.append(Pz_G[i] + PzN_Q[i])

P_x = []
for i in range(len(CxN_T)):
    P_x.append(0)
P_y = []
for i in range(len(CyN_T)):
    P_y.append(0)

def evaluate_Q(ct, j):
    b = []
    for i in range(0, len(ct)):
        if i == j:
            q_ = q
        else:
            q_ = 0
        b.append(q_)
        i += 1
    return b

Q = []
for j in range(len(CT[0])):
    Q.append(evaluate_Q(CT[0], j))
    j += 1

def solution(CN_T, CF_T, XF, Q, P):
    CN_T = np.array(CN_T)
    CF_T = np.array(CF_T)
    Q = np.array(Q)
    XF = np.array(XF)
    P = np.array(P)
    
    CN = np.transpose(CN_T)
    CF = np.transpose(CF_T)
    DN = np.linalg.multi_dot([CN_T, Q, CN])
    DF = np.linalg.multi_dot([CN_T, Q, CF])
    XN = np.matmul(np.linalg.inv(DN), (P - np.matmul(DF, XF)))

    return XN, DN, DF


penalty = False

while penalty == False:
    
    XN, DN_X, DF_X = solution(CxN_T, CxF_T, XF, Q, P_x)
    YN, DN_Y, DF_Y = solution(CyN_T, CyF_T, YF, Q, P_y)
    ZN, DN_Z, DF_Z = solution(CzN_T, CzF_T, ZF, Q, P_z)

    X = []
    Y = []
    Z = []
    for i in range(len(Bool)):
        X.append(0)
        Y.append(0)
        Z.append(0)

    j = 0
    k = 0
    for i in range(len(Bool_x)):
        if Bool_x[i] is True:
            X[i] = XN[j]
            j += 1
        else:
            X[i] = XF[k]
            k += 1

    j = 0
    k = 0
    for i in range(len(Bool_y)):
        if Bool_y[i] is True:
            Y[i] = YN[j]
            j += 1
        else:
            Y[i] = YF[k]
            k += 1

    j = 0
    k = 0
    for i in range(len(Bool_z)):
        if Bool_z[i] is True:
            Z[i] = ZN[j]
            j += 1
        else:
            Z[i] = ZF[k]
            k += 1

    u = u_function(CT, X)
    v = u_function(CT, Y)
    w = u_function(CT, Z)
    l = (u ** 2 + v ** 2 + w ** 2) ** 0.5
    Pz_G = np.matmul((0.5 * ro * g * A / 1000) * abs(np.array(CzN_T)), l).tolist()
    P_z = []
    for i in range(len(Pz_G)):
        P_z.append(Pz_G[i] + PzN_Q[i])
    
    r_x = np.array(P_x) - np.matmul(DN_X, XN) - np.matmul(DF_X, np.array(XF))
    r_y = np.array(P_y) - np.matmul(DN_Y, YN) - np.matmul(DF_Y, np.array(YF))
    r_z = np.array(P_z) - np.matmul(DN_Z, ZN) - np.matmul(DF_Z, np.array(ZF))

    r_x.tolist()
    r_y.tolist()
    r_z.tolist()


    
    penalty = abs(max(r_z)) < 0.01 and abs(min(r_z)) < 0.01 and abs(max(r_x)) < 0.01 and abs(min(r_x)) < 0.01 and abs(max(r_y)) < 0.01 and abs(min(r_y)) < 0.01




import Rhino as rc

Points = []
for j in range(len(X)):
    Points.append(rc.Geometry.Point3d(X[j], Y[j], Z[j]))



def get_y_Points(count1, count2):
    a = []
    for j in range(count1, count2 + 1):
        a.append(Points[j])
    return  a

count1 = 0
count2 = (ny - 1)

Curves_y = []
for i in range(nx):
    Curves_y.append(get_y_Points(count1, count2))
    #print("at iteration", i, "the limits are", count1, ";", count2)
    count1 = count2 + 1
    count2 = count1 + (ny - 1)


Nurbs_y = []
for i in Curves_y:
    Nurbs_y.append(rc.Geometry.NurbsCurve.Create(False,1, i))


def get_x_Points(count1, count2):
    count = count1
    a = []
    while count <= count2:
        a.append(Points[count])
        #print("iteration", i, "count is", count)
        count += ny
    return a

count1 = 0
count2 = (nr_points - ny)
Curves_x = []
for i in range(ny):
    Curves_x.append(get_x_Points(count1, count2))
    #print("at iteration", i, "the limits are", count1, ";", count2)
    count1 += 1
    count2 += 1


Nurbs_x = []
for i in Curves_x:
    Nurbs_x.append(rc.Geometry.NurbsCurve.Create(False, 1, i))



Nurbs = Nurbs_x + Nurbs_y

Surface = rc.Geometry.NurbsSurface.CreateNetworkSurface(Nurbs,1,0.1,0.1,0.1)[0]

z = max(Z)
# ---------- end python_3_script_5 ----------
# Points
# (FF)
point = Point(python_3_script_5.Points)
# (3) FINITE ELEMENT ANALYSIS
panel_2 = Panel("1.35")
multiplication_2 = Multiplication(Gamma=panel_2, Gk="-1")
multiplication_3 = Multiplication(Gamma="1.5", Qk="-1.5")
unit_z = UnitZ(Factor=multiplication_2)
unit_z_2 = UnitZ(Factor=multiplication_3)
unit_z_3 = UnitZ(Factor="-1")
unit_z_4 = UnitZ(Factor="-1.5")

# ---- group: Loads (Karamba3D)
loads = LoadsKaramba3D(Vector=unit_z, LCase="ULS", mode="Gravity")

loads_2 = LoadsKaramba3D(Vector=unit_z_3, LCase="SLSg", mode="Gravity")

# ----
matselect = MaterialSelectionKaramba3D(menu=[dropdown(1), dropdown(7), dropdown(7)])
multiplication_4 = Multiplication(A=thickness_m, B=100)
panel_3 = Panel("""2.4
1.72""")
construct_point = ConstructPoint(XCoordinate=0, YCoordinate=0, ZCoordinate=0)
construct_point_2 = ConstructPoint(XCoordinate=lx_total_span_m, YCoordinate=ly_total_span_m, ZCoordinate=ly_total_span_m)
box_2pt = Box2Pt(PointA=construct_point, PointB=construct_point_2, Plane=PlaneXY(0, 0, 0))
multiplication_5 = Multiplication(A=python_3_script_5.z, B=2)

# ----
# ## NEW CODE 22_08
# 
# The output will be the input for the
# Reinforcement Design
# # Just for visualisation!
# NEW SCRIPT! 10_09_25
surface_from_points = SurfaceFromPoints(Points=point, UCount=u, Interpolate=True)

python_3_script_6 = Python3Script(
    Surface=surface_from_points,
    Lx=lx_total_span_m,
    Ly=ly_total_span_m,
    b=column_b_h_m,
    z_max=python_3_script_5.z,
    step_size=Slider(1, range=0..5))  # -> Line_x, Line_y, Points, BCs, u, v, PC_x, b; inputs Surface: Surface, Lx: Double, Ly: Double, b: Double
# ---------- python_3_script_6: Python ----------
import Rhino as rc




PC_x = []   #Control points in X
PC_y = []   #Control points in Y


Point = rc.Geometry.Point3d(Lx / 2, Ly / 2, z_max)
a = rc.Geometry.Surface.ClosestPoint(Surface, Point)
k = rc.Geometry.Surface.Evaluate(Surface, a[1], a[2], 1)[1]
z = k[2]


X = []
nx = Lx / step_size
if round(nx, ndigits=None) < nx:
    nx = round(nx, ndigits=None) + 1
else:
    nx = round(nx, ndigits=None)
step_x = Lx / nx
count_x = 0
while len(X) <= nx:
    X.append(count_x)
    count_x += step_x
if X[0] != b / 2:
    X.append(b / 2)
if X[-2] != Lx - b / 2:
    X.append(Lx - b / 2)
X.sort()
for i in X:
    PC_x.append(rc.Geometry.Point3d(i, Ly / 2, z))


Y = []
ny = Ly / step_size
if round(ny, ndigits=None) < ny:
    ny = round(ny, ndigits=None) + 1
else:
    ny = round(ny, ndigits=None)
step_y = Ly / ny
count_y = 0
while len(Y) <= ny:
    Y.append(count_y)
    count_y += step_y
if Y[0] != b / 2:
    Y.append(b / 2)
if Y[-2] != Ly - b / 2:
    Y.append(Ly - b / 2)
Y.sort()
for i in Y:
    PC_y.append(rc.Geometry.Point3d(Lx / 2, i, z))

x_index = []
for i in range(len(PC_x)):
    if PC_x[i][0] == b / 2:
        x_index.append(i)
    elif PC_x[i][0] == Lx - b / 2:
        x_index.append(i)

y_index = []
for i in range(len(PC_y)):
    if PC_y[i][1] == b / 2:
        y_index.append(i)
    elif PC_y[i][1] == Ly - b / 2:
        y_index.append(i)



from Rhino.Geometry import IsoStatus as iso
n, e, s, w = iso.North, iso.East, iso.South, iso.West 

s1 = rc.Geometry.Surface.Extend(Surface, n, b / 2, True)
s2 = rc.Geometry.Surface.Extend(s1, e, b / 2, True)
s3 = rc.Geometry.Surface.Extend(s2, s, b / 2, True)
s4 = rc.Geometry.Surface.Extend(s3, w, b / 2, True)

interval0 = rc.Geometry.Interval(0, Lx)
interval1 = rc.Geometry.Interval(0, Ly)

change_dominio0 = rc.Geometry.Surface.SetDomain(s4, 0, interval0)
change_dominio1 = rc.Geometry.Surface.SetDomain(s4, 1, interval1)


U = []
U_ = []

Line_x = []     #Nurbs curves in x
for j in range(len(PC_x)):
    u_ = rc.Geometry.Surface.LocalClosestPoint(s4, PC_x[j], PC_x[j][0], PC_x[j][1])
    u = rc.Geometry.Surface.LocalClosestPoint(s4, PC_x[j], PC_x[j][0], PC_x[j][1])[1]
    U.append(u)
    U_.append(u_)
    
    Line_x.append(rc.Geometry.Surface.IsoCurve(s4, 1, u))


Line_y = []     #Nurbs curves in y
for j in range(len(PC_y)):
    v = rc.Geometry.Surface.LocalClosestPoint(s4, PC_y[j], PC_y[j][0], PC_y[j][1])[2]
    Line_y.append(rc.Geometry.Surface.IsoCurve(s4, 0, v))

Points = []
def intersection(j):
    for i in range(len(PC_y)):
        intersection = rc.Geometry.Intersect.Intersection.CurveCurve(Line_x[j], Line_y[i], 0.5, 0.5)
        coordinate = intersection[0].PointA
        point = rc.Geometry.Point3d(coordinate[0], coordinate[1], coordinate[2]) 
        Points.append(point)
for j in range(len(PC_x)):
    intersection(j)


BCs = []
for i in x_index:
    for j in y_index:
        intersection = rc.Geometry.Intersect.Intersection.CurveCurve(Line_x[i], Line_y[j], 0.5, 0.5)
        coordinate = intersection[0].PointA
        bcs = rc.Geometry.Point3d(coordinate[0], coordinate[1], coordinate[2])
        BCs.append(bcs)


'''

##
EFFETTUO SOLO UNA PROVA PER CAPIRE SE RIESCO AD INVERTIRE L'ORDINE DI NUMERAZIONE - HA FUNZIONATO! 03/09
Points = []     #Intersection between nurbs in x and y
def intersection(j):
    for i in range(len(PC_x)):
        intersection = rc.Geometry.Intersect.Intersection.CurveCurve(Line_y[j], Line_x[i], 0.5, 0.5)
        coordinate = intersection[0].PointA
        point = rc.Geometry.Point3d(coordinate[0], coordinate[1], coordinate[2])
        Points.append(point)

for j in range(len(PC_y)):
    intersection(j)
##
'''
u = len(PC_x)
v = len(PC_y)
# ---------- end python_3_script_6 ----------
curve = Curve(python_3_script_6.Line_x)
curve_2 = Curve(python_3_script_6.Line_y)

point_2 = Point(python_3_script_6.PC_x)

subtraction_3 = Subtraction(A=python_3_script_6.v, B=1)
point_3 = Point(python_3_script_6.Points)
point_4 = Point(python_3_script_6.BCs)
mesh_frompoints = MeshFromPoints(Points=point_3, UDirection=python_3_script_6.u, VDirection=python_3_script_6.v)
face_normals = FaceNormals(Mesh=mesh_frompoints)  # -> Centers, Normals
list_length = ListLength(List=face_normals.Centers)
series = Series(Start=0, Step=1, Count=list_length)
text_tag = TextTag(Location=face_normals.Centers, Text=series)

subtraction_4 = Subtraction(A=python_3_script_6.u, B=1)
point_list_2 = PointList(Points=point_3)

# ---- group: Loads (Karamba3D)
loads_3 = LoadsKaramba3D(
    Vector=unit_z_2,
    Mesh=mesh_frompoints,
    LCase="ULS",
    mode="MeshLoad -Const.",
    menu=[buttons(off, off, on), buttons(on, on)])

# ----
loads_4 = LoadsKaramba3D(
    Vector=unit_z_4,
    Mesh=mesh_frompoints,
    LCase="SLSq",
    mode="MeshLoad -Const.",
    menu=[buttons(off, off, on), buttons(on, on)])
supp = SupportKaramba3D(PosInd=point_4, menu=[buttons(on, on, on, off, off, on)])
load_karamba3d = LoadKaramba3D(flatten([loads, loads_3, loads_2, loads_4]))
# (2) VOLUMETRIC GEOMETRIES GENERATION
python_3_script_7 = Python3Script(Surface=surface_from_points, b=column_b_h_m, Points=point, Lx=lx_total_span_m, Ly=ly_total_span_m, h=multiplication_4)  # -> Edge1, Edge2, Edge3, Edge4, Diagonal1, Diagonal2, Line1, Line2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; inputs Surface: Surface, b: Double, Points: list of Point3d, Lx: Int32, Ly: Double
# ---------- python_3_script_7: Python ----------
import Rhino as rc


h = h / 100

from Rhino.Geometry import IsoStatus as iso
n, e, s, w = iso.North, iso.East, iso.South, iso.West 

N = [w, e, s, n]


def Edges(i):
    Point = []
    S = rc.Geometry.Surface.Extend(Surface, i, b / 2, True)
    if i == w: 
        d = rc.Geometry.Surface.Domain(S, 0)[0]
        Lc = rc.Geometry.Surface.IsoCurve(S, 1, d)
    elif i == e:
        d = rc.Geometry.Surface.Domain(S, 0)[1]
        Lc = rc.Geometry.Surface.IsoCurve(S, 1, d)

    elif i == s:
        d = rc.Geometry.Surface.Domain(S, 1)[0]
        Lc = rc.Geometry.Surface.IsoCurve(S, 0, d)
    elif i == n:
        d = rc.Geometry.Surface.Domain(S, 1)[1]
        Lc = rc.Geometry.Surface.IsoCurve(S, 0, d)

    divisions = rc.Geometry.Curve.DivideByCount(Lc, 2, True)
    for j in range(3):
        p = rc.Geometry.Curve.PointAt(Lc, divisions[j])
        Point.append(p)
    
    Point[1][2] = Point[1][2] - h / 2
    if i == w:
        Point[0][0] = 0
        Point[0][1] = b
        Point[0][2] = 0

        Point[1][0] = 0

        Point[2][0] = 0
        Point[2][1] = Ly - b
        Point[2][2] = 0
    elif i == e:
        Point[0][0] = Lx
        Point[0][1] = b
        Point[0][2] = 0

        Point[1][0] = Lx

        Point[2][0] = Lx
        Point[2][1] = Ly - b
        Point[2][2] = 0
    elif i == s:
        Point[0][0] = b
        Point[0][1] = 0
        Point[0][2] = 0

        Point[1][1] = 0

        Point[2][0] = Lx - b
        Point[2][1] = 0
        Point[2][2] = 0
    elif i == n:
        Point[0][0] = b
        Point[0][1] = Ly
        Point[0][2] = 0

        Point[1][1] = Ly

        Point[2][0] = Lx - b
        Point[2][1] = Ly
        Point[2][2] = 0

    Edge = rc.Geometry.NurbsCurve.CreateParabolaFromPoints(Point[0], Point[1], Point[2])
    return Point, Edge

PointE1 = []
PointE2 = []
PointE2 = []
PointE4 = []

for i in N:
    if i == w:
        PointE1, Edge1 = Edges(i)
    elif i == e:
        PointE2, Edge2 = Edges(i)
    elif i == s:
        PointE3, Edge3 = Edges(i)
    elif i == n:
        PointE4, Edge4 = Edges(i)







Quote = []
for i in Points:
    Quote.append(i[2])
Z = max(Quote)
Top = rc.Geometry.Point3d(Lx / 2, Ly / 2, Z - h / 2)
a = rc.Geometry.Surface.ClosestPoint(Surface, Top)
k = rc.Geometry.Surface.Evaluate(Surface, a[1], a[2], 1)[1]
z = k[2]

def Diagonals(i):
    Point = []
    if i == 0:
        P1 = rc.Geometry.Point3d(b, b, 0)
        P2 = Top
        P3 = rc.Geometry.Point3d(Lx - b, Ly - b, 0)
    else:
        P1 = rc.Geometry.Point3d(Lx - b, b, 0)
        P2 = Top
        P3 = rc.Geometry.Point3d(b, Ly - b, 0)
    Point = [P1, P2 ,P3]
    Diagonal = rc.Geometry.NurbsCurve.CreateParabolaFromPoints(Point[0], Point[1], Point[2])
    return Point, Diagonal
PointD1 = []
PointD2 = []
for i in range(2):
    if i == 0:
        PointD1, Diagonal1 = Diagonals(i)
    else:
        PointD2, Diagonal2 = Diagonals(i)


line1_1 = rc.Geometry.Line(PointE1[0], PointD1[0])
line1_2 = rc.Geometry.Line(PointD1[0], PointE3[0])
Line1 = [line1_1, line1_2]


line2_1 = rc.Geometry.Line(PointE1[2], PointD2[2])
line2_2 = rc.Geometry.Line(PointD2[2], PointE4[0])
Line2 = [line2_1, line2_2]

line3_1 = rc.Geometry.Line(PointE3[2], PointD2[0])
line3_2 = rc.Geometry.Line(PointD2[0], PointE2[0])
Line3 = [line3_1, line3_2]

line4_1 = rc.Geometry.Line(PointE2[2], PointD1[2])
line4_2 = rc.Geometry.Line(PointD1[2], PointE4[2])
Line4 = [line4_1, line4_2]

Curve = [Edge1, Edge2, Edge3, Edge4, Diagonal1, Diagonal2, line1_1, line1_2, line2_1, line2_2, line3_1, line3_2, line4_1, line4_2]
# ---------- end python_3_script_7 ----------
python_3_script_8 = Python3Script(Surface=surface_from_points, b=column_b_h_m, Points=point, Lx=lx_total_span_m, Ly=ly_total_span_m, h=multiplication_4)  # -> Edge1, Edge2, Edge3, Edge4, Diagonal1, Diagonal2, Curve, Surface; inputs Surface: Surface, b: Double, Points: list of Point3d, Lx: Int32, Ly: Double
# ---------- python_3_script_8: Python ----------
import Rhino as rc


h = h / 100

from Rhino.Geometry import IsoStatus as iso
n, e, s, w = iso.North, iso.East, iso.South, iso.West 

N = [w, e, s, n]


def Edges(i):
    Point = []
    S = rc.Geometry.Surface.Extend(Surface, i, b / 2, True)
    if i == w: 
        d = rc.Geometry.Surface.Domain(S, 0)[0]
        Lc = rc.Geometry.Surface.IsoCurve(S, 1, d)
    elif i == e:
        d = rc.Geometry.Surface.Domain(S, 0)[1]
        Lc = rc.Geometry.Surface.IsoCurve(S, 1, d)

    elif i == s:
        d = rc.Geometry.Surface.Domain(S, 1)[0]
        Lc = rc.Geometry.Surface.IsoCurve(S, 0, d)
    elif i == n:
        d = rc.Geometry.Surface.Domain(S, 1)[1]
        Lc = rc.Geometry.Surface.IsoCurve(S, 0, d)

    divisions = rc.Geometry.Curve.DivideByCount(Lc, 2, True)
    for j in range(3):
        p = rc.Geometry.Curve.PointAt(Lc, divisions[j])
        Point.append(p)
    
    Point[1][2] = Point[1][2] + h / 2
    if i == w:
        Point[0][0] = 0
        Point[0][1] = 0
        Point[0][2] = 0

        Point[1][0] = 0

        Point[2][0] = 0
        Point[2][1] = Ly
        Point[2][2] = 0
    elif i == e:
        Point[0][0] = Lx
        Point[0][1] = 0
        Point[0][2] = 0

        Point[1][0] = Lx

        Point[2][0] = Lx
        Point[2][1] = Ly
        Point[2][2] = 0
    elif i == s:
        Point[0][0] = 0
        Point[0][1] = 0
        Point[0][2] = 0

        Point[1][1] = 0

        Point[2][0] = Lx
        Point[2][1] = 0
        Point[2][2] = 0
    elif i == n:
        Point[0][0] = 0
        Point[0][1] = Ly
        Point[0][2] = 0

        Point[1][1] = Ly

        Point[2][0] = Lx
        Point[2][1] = Ly
        Point[2][2] = 0

    Edge = rc.Geometry.NurbsCurve.CreateParabolaFromPoints(Point[0], Point[1], Point[2])
 
    return Point, Edge

PointE1 = []
PointE2 = []
PointE2 = []
PointE4 = []

for i in N:
    if i == w:
        PointE1, Edge1 = Edges(i)
    elif i == e:
        PointE2, Edge2 = Edges(i)
    elif i == s:
        PointE3, Edge3 = Edges(i)
    elif i == n:
        PointE4, Edge4 = Edges(i)




Quote = []
for i in Points:
    Quote.append(i[2])
Z = max(Quote)
Top = rc.Geometry.Point3d(Lx / 2, Ly / 2, Z + h / 2)
a = rc.Geometry.Surface.ClosestPoint(Surface, Top)
k = rc.Geometry.Surface.Evaluate(Surface, a[1], a[2], 1)[1]
z = k[2]

def Diagonals(i):
    Point = []
    if i == 0:
        P1 = rc.Geometry.Point3d(0, 0, 0)
        P2 = Top
        P3 = rc.Geometry.Point3d(Lx, Ly, 0)
    else:
        P1 = rc.Geometry.Point3d(Lx, 0, 0)
        P2 = Top
        P3 = rc.Geometry.Point3d(0, Ly, 0)
    Point = [P1, P2 ,P3]
    Diagonal = rc.Geometry.NurbsCurve.CreateParabolaFromPoints(Point[0], Point[1], Point[2])
    return Point, Diagonal
PointD1 = []
PointD2 = []
for i in range(2):
    if i == 0:
        PointD1, Diagonal1 = Diagonals(i)
    else:
        PointD2, Diagonal2 = Diagonals(i)


Curve = [Edge1, Edge2, Edge3, Edge4, Diagonal1, Diagonal2]

Surface = rc.Geometry.NurbsSurface.CreateNetworkSurface(Curve,1,0.1,0.1,0.1)[0]
# ---------- end python_3_script_8 ----------
curve_3 = Curve([python_3_script_7.Edge1, python_3_script_7.Edge2])
curve_4 = Curve(python_3_script_8.Curve)
curve_5 = Curve(python_3_script_7.Curve)
subtraction_5 = Subtraction(A=python_3_script_6.v, B=2)
subtraction_6 = Subtraction(A=python_3_script_6.u, B=2)

face_normals_2 = FaceNormals(Mesh=mesh_frompoints)  # -> Centers, Normals
deconstruct = Deconstruct(Point=face_normals_2.Centers)  # -> XComponent, YComponent, ZComponent

mesh = Mesh(mesh_frompoints)
deconstruct_mesh = DeconstructMesh(Mesh=mesh)  # -> Vertices, Faces, Colours, Normals
deconstruct_face = DeconstructFace(Face=deconstruct_mesh.Faces)  # -> CornerA, CornerB, CornerC, CornerD
python_3_script_9 = Python3Script(
    Vertices=deconstruct_mesh.Vertices,
    CornerA=deconstruct_face.CornerA,
    CornerB=deconstruct_face.CornerB,
    CornerC=deconstruct_face.CornerC,
    CornerD=deconstruct_face.CornerD)  # -> Polylines, Mesh; inputs Vertices: list of Point3d, CornerA: list of Int32, CornerB: list of Int32, CornerC: list of Int32, CornerD: list of Int32
# ---------- python_3_script_9: Python ----------
import Rhino as rc

def Polyline(i):
    index_1 = CornerA[i]
    index_2 = CornerB[i]
    index_3 = CornerC[i]
    index_4 = CornerD[i]

    line_1 = rc.Geometry.Line(Vertices[index_1], Vertices[index_2])
    line_2 = rc.Geometry.Line(Vertices[index_2], Vertices[index_3])
    line_3 = rc.Geometry.Line(Vertices[index_3], Vertices[index_4])
    line_4 = rc.Geometry.Line(Vertices[index_4], Vertices[index_1])


    lines = [line_1, line_2, line_3, line_4]
    polyline = rc.Geometry.Polyline.CreateByJoiningLines(lines, 0.001, True)
    for k in polyline:
        mesh = rc.Geometry.Mesh.CreateFromClosedPolyline(k)
    return polyline, mesh



Polylines = []
Mesh = []
for i in range(len(CornerA)):
    
    polyline, mesh = Polyline(i)
    Mesh.append(mesh)
    for j in polyline:
        Polylines.append(j)
# ---------- end python_3_script_9 ----------
deconstruct_mesh_2 = DeconstructMesh(Mesh=mesh)  # -> Vertices, Faces, Colours, Normals
deconstruct_face_2 = DeconstructFace(Face=deconstruct_mesh_2.Faces)  # -> CornerA, CornerB, CornerC, CornerD
python_3_script_10 = Python3Script(
    Vertices=deconstruct_mesh_2.Vertices,
    CornerA=deconstruct_face_2.CornerA,
    CornerB=deconstruct_face_2.CornerB,
    CornerC=deconstruct_face_2.CornerC,
    CornerD=deconstruct_face_2.CornerD)  # -> Mesh; inputs Vertices: list of Point3d, CornerA: list of Int32, CornerB: list of Int32, CornerC: list of Int32, CornerD: list of Int32; same code as python_3_script_9
mesh_area = MeshArea(Mesh=python_3_script_10)  # -> Area, Centroid

# ----
# Internal surface
# REMEMBER TO REDUCE FLEXIBILITY AND SPAN BEFORE LAUNCHING GALPAGOS
# extrados
# intrados
# External surface
subtraction_7 = Subtraction(A=u, B=0)
number_slider_2 = Slider(0.5, range=0..10)
multiplication_6 = Multiplication(A=subtraction_7, B=2)
panel_4 = Panel(multiplication_6)
boolean_toggle = BooleanToggle(False)
relay = Relay()
panel_5 = Panel(relay)

# ----
# Internal surface
# (OUTPUT)
patch = Patch(Curves=curve_5, Spans=panel_4, Flexibility=number_slider_2, Trim=boolean_toggle)

# ----
# External surface
# (OUTPUT)
patch_2 = Patch(Curves=curve_4, Spans=multiplication_6, Flexibility=number_slider_2, Trim=boolean_toggle)

# ----
# # u,v number of division
boolean_toggle_2 = BooleanToggle(False)

# ----
# (6) REINFORCEMENT DESIGN OPTIMIZATION
#      + EMBODIED CARBON CALCULATION DUE
#       TO SHELL (CONCRETE + FRP)
discritization_in_x = Panel(subtraction_2)
discritization_in_y = Panel(subtraction)
length_x_direction = Panel(lx_total_span_m)
length_y_direction = Panel(ly_total_span_m)

estradosso = Surface(patch_2)
evalsrf = EvaluateSurface(Surface=estradosso, Point="0.5,0.5,0}")  # -> Point, Normal, UDirection, VDirection, Frame
intradosso = Surface(patch)
evalsrf_2 = EvaluateSurface(Surface=intradosso, Point="0.5,0.5,0}")  # -> Point, Normal, UDirection, VDirection, Frame
devec = DeconstructVector(Vector=evalsrf_2.Normal)  # -> XComponent, YComponent, ZComponent
devec_2 = DeconstructVector(Vector=evalsrf.Normal)  # -> XComponent, YComponent, ZComponent
larger = LargerThan(FirstNumber=devec.ZComponent, SecondNumber=0)  # -> LargerThan, OrEqualTo
smaller = SmallerThan(FirstNumber=devec_2.ZComponent, SecondNumber=0)  # -> SmallerThan, OrEqualTo
reverse_surface = ReverseSurface(Surface=estradosso, U=False, V=False, W=smaller.OrEqualTo, ShowArrows=True)
solid_intersection = SolidIntersection(BrepsA=box_2pt, BrepsB=reverse_surface)
# VOLUME
# OF THE MIDDLE
# SURFACE
# EXTRUDED
panel_6 = Panel([devec_2.ZComponent, devec.ZComponent])
reverse_surface_2 = ReverseSurface(Surface=intradosso, U=False, V=False, W=larger.OrEqualTo, ShowArrows=True)
solid_intersection_2 = SolidIntersection(BrepsA=solid_intersection, BrepsB=reverse_surface_2)
volume = Volume(Geometry=solid_intersection_2)  # -> Volume, Centroid
multiplication_7 = Multiplication(A=volume.Volume, B=2500)
shell_mass_kg = Panel(multiplication_7)

# ----
# VOLUME
# (OUTPUT)
brep = Brep(solid_intersection_2)

# ----
# (3) EVALUATING UPDATED DEPTHS OF
# MESH ELEMENTS FROM ENGINEERING
#  SHAPE
panel_7 = Panel("-5")
construct_point_3 = ConstructPoint(XCoordinate=0, YCoordinate=0, ZCoordinate=panel_7)
line_sdl = LineSDL(Start=construct_point_3, Direction=Vector(0, 0, 1), Length=multiplication_5)
brep_2 = Brep(solid_intersection_2)
extrude_linear = ExtrudeLinear(Profile=python_3_script_9.Polylines, OrientationP=PlaneXY(0, 0, 0), Axis=line_sdl)
mesh_area_2 = MeshArea(Mesh=python_3_script_9.Mesh)  # -> Area, Centroid
volume_2 = Volume(Geometry=brep_2)  # -> Volume, Centroid

deconstruct_brep = DeconstructBrep(Brep=brep)  # -> Faces, Edges, Vertices
python_3_script_11 = Python3Script(Faces=deconstruct_brep.Faces, Lx=lx_total_span_m, Ly=ly_total_span_m)  # -> Index; inputs Faces: list of Surface, Lx: Int32, Ly: Int32
# ---------- python_3_script_11: Python ----------
import Rhino as rc

A = []
for i in Faces:
    b = []
    a = rc.Geometry.Surface.GetSurfaceSize(i)
    for j in a:
        if type(j) != bool:
            b.append(j)
    A.append(b)

Index = []
for k in A:
    if k[0] != Lx and k[0] != Ly and k[1] != Lx and k[1] != Ly:
        index = A.index(k)
        Index.append(index)
# ---------- end python_3_script_11 ----------
python_3_script_12 = Python3Script(Index=python_3_script_11, Faces=deconstruct_brep.Faces)  # -> Top, Bottom; inputs Index: list, Faces: list
# ---------- python_3_script_12: Python ----------
import Rhino as rc
top = Index[0]
bottom = Index[1]

Top = Faces[top]

Bottom = Faces[bottom]

print(Top, Bottom)
# ---------- end python_3_script_12 ----------
python_3_script_13 = Python3Script(Brep=brep_2, Extrusion=extrude_linear, j=Slider(89, range=0..100))  # -> Volume, v_prova; inputs Brep: Brep, Extrusion: list of Brep, j: Int32
# ---------- python_3_script_13: Python ----------
import Rhino as rc

Volume = []
for i in Extrusion:
    v = rc.Geometry.Brep.CreateBooleanDifference(Brep, i, 0.01)
    #Volume.append(v)
    
    for j in v:
        Volume.append(j)

#v_prova = rc.Geometry.Brep.CreateBooleanDifference(Brep, Extrusion[j], 0.1)


#a = rc.Geometry.Brep.CreateBooleanDifference(Extrusion[0], Brep, 0.01)
#b = rc.Geometry.Brep.CreateBooleanIntersection(Brep, Extrusion[0], 0.01)
# ---------- end python_3_script_13 ----------
brep_3 = Brep(python_3_script_13.v_prova)
brep_4 = Brep(python_3_script_13.Volume)
python_3_script_14 = Python3Script(Lx=lx_total_span_m, Ly=ly_total_span_m, Surface=python_3_script_12.Bottom, z_max=python_3_script_5.z, b=column_b_h_m)  # -> Line_x, Line_y, Points, u, v, PC_x, PC_y; inputs Lx: Double, Ly: Double, Surface: Surface, z_max: Double
# ---------- python_3_script_14: Python ----------
import Rhino as rc
interval0 = rc.Geometry.Interval(0, Lx)
interval1 = rc.Geometry.Interval(0, Ly)

change_dominio0 = rc.Geometry.Surface.SetDomain(Surface, 0, interval0)
change_dominio1 = rc.Geometry.Surface.SetDomain(Surface, 1, interval1)

print(rc.Geometry.Surface.Domain(Surface, 0))
Point = rc.Geometry.Point3d(Lx / 2, Ly / 2, z_max)

a = rc.Geometry.Surface.ClosestPoint(Surface, Point)
k = rc.Geometry.Surface.Evaluate(Surface, a[1], a[2], 1)[1]
z = k[2]

PC_x = []
PC_y = []

step_size = 1 #m
X = []
nx = Lx / step_size
if round(nx, ndigits=None) < nx:
    nx = round(nx, ndigits=None) + 1
else:
    nx = round(nx, ndigits=None)
step_x = Lx / nx
count_x = 0
while len(X) <= nx:
    X.append(count_x)
    count_x += step_x
if X[0] != b / 2:
    X.append(b / 2)
if X[-2] != Lx - b / 2:
    X.append(Lx - b / 2)
X.sort()
for i in X:
    PC_x.append(rc.Geometry.Point3d(i, Ly / 2, z))


Y = []
ny = Ly / step_size
if round(ny, ndigits=None) < ny:
    ny = round(ny, ndigits=None) + 1
else:
    ny = round(ny, ndigits=None)
step_y = Ly / ny
count_y = 0
while len(Y) <= ny:
    Y.append(count_y)
    count_y += step_y
if Y[0] != b / 2:
    Y.append(b / 2)
if Y[-2] != Ly - b / 2:
    Y.append(Ly - b / 2)
Y.sort()
for i in Y:
    PC_y.append(rc.Geometry.Point3d(Lx / 2, i, z))






CP_1_y = []
CP_2_y = []
Line_y = []     #Nurbs curves in y
for j in range(len(PC_x)):
    cp_y = rc.Geometry.Surface.LocalClosestPoint(Surface, PC_x[j], PC_x[j][0], PC_x[j][1])
    CP_1_y.append(cp_y[1])
    CP_2_y.append(cp_y[2])

avg_y = 0
for i in CP_1_y:
    avg_y += i

if round(avg_y / len(CP_1_y), 1) == round(CP_1_y[0], 1):
    for i in CP_2_y:
        Line_y.append(rc.Geometry.Surface.IsoCurve(Surface, 0, i))
else:
    for i in CP_1_y:
        Line_y.append(rc.Geometry.Surface.IsoCurve(Surface, 1, i))


CP_1_x = []
CP_2_x = []
Line_x = []     #Nurbs curves in x
for j in range(len(PC_y)):
    cp_x = rc.Geometry.Surface.LocalClosestPoint(Surface, PC_y[j], PC_y[j][0], PC_y[j][1])
    CP_1_x.append(cp_x[1])
    CP_2_x.append(cp_x[2])

avg_x = 0
for i in CP_1_x:
    avg_x += i

if round(avg_x / len(CP_1_x), 1) == round(CP_1_x[0], 1):    
    for i in CP_2_x:
        Line_x.append(rc.Geometry.Surface.IsoCurve(Surface, 0, i))
else:
    for i in CP_1_x:
        Line_x.append(rc.Geometry.Surface.IsoCurve(Surface, 1, i))


Points = []     #Intersection between nurbs in x and y
def intersection(j):
    for i in range(len(PC_y)):
        intersection = rc.Geometry.Intersect.Intersection.CurveCurve(Line_y[j], Line_x[i], 0.5, 0.5)
        coordinate = intersection[0].PointA
        if coordinate[2] >= 0:
            point = rc.Geometry.Point3d(coordinate[0], coordinate[1], coordinate[2])
        else:
            point = rc.Geometry.Point3d(coordinate[0], coordinate[1], 0)
        Points.append(point)

for j in range(len(PC_x)):
    intersection(j)


u = len(PC_x)
v = len(PC_y)
# ---------- end python_3_script_14 ----------
python_3_script_15 = Python3Script(Lx=lx_total_span_m, Ly=ly_total_span_m, Surface=python_3_script_12.Top, z_max=python_3_script_5.z, b=column_b_h_m)  # -> Line_x, Line_y, Points, u, v, PC_x, PC_y; inputs Lx: Double, Ly: Double, Surface: Surface, z_max: Double; same code as python_3_script_14
python_3_script_16 = Python3Script(Volume=brep_4)  # -> Values; inputs Volume: list of Brep
# ---------- python_3_script_16: Python ----------
import Rhino as rc

Values = []
for v in Volume:
    value = rc.Geometry.Brep.GetVolume(v)
    Values.append(value)

print(Values)
# ---------- end python_3_script_16 ----------

# ----
# list of heights
# (input for Karamba)
# units in cm!!!
python_3_script_17 = Python3Script(Volume=python_3_script_16, Area=mesh_area_2.Area)  # -> H; inputs Volume: list of Double, Area: list of Double
# ---------- python_3_script_17: Python ----------
h = []
for i in range(len(Volume)):
    h.append(round(Volume[i] / Area[i] * 100, 2))


H = h + h

print(H)
# ---------- end python_3_script_17 ----------

panel_8 = Panel(volume_2.Volume)
mesh_frompoints_2 = MeshFromPoints(Points=python_3_script_14.Points, UDirection=python_3_script_14.u, VDirection=python_3_script_14.v)
mesh_frompoints_3 = MeshFromPoints(Points=python_3_script_15.Points, UDirection=python_3_script_15.u, VDirection=python_3_script_15.v)
deconstruct_mesh_3 = DeconstructMesh(Mesh=mesh_frompoints_3)  # -> Vertices, Faces, Colours, Normals
deconstruct_mesh_4 = DeconstructMesh(Mesh=mesh_frompoints_2)  # -> Vertices, Faces, Colours, Normals
deconstruct_face_3 = DeconstructFace(Face=deconstruct_mesh_3.Faces)  # -> CornerA, CornerB, CornerC, CornerD
deconstruct_face_4 = DeconstructFace(Face=deconstruct_mesh_4.Faces)  # -> CornerA, CornerB, CornerC, CornerD
python_3_script_18 = Python3Script(
    Vertices=deconstruct_mesh_3.Vertices,
    CornerA=deconstruct_face_3.CornerA,
    CornerB=deconstruct_face_3.CornerB,
    CornerC=deconstruct_face_3.CornerC,
    CornerD=deconstruct_face_3.CornerD)  # -> Top; inputs Vertices: list of Point3d, CornerA: list of Int32, CornerB: list of Int32, CornerC: list of Int32, CornerD: list of Int32
# ---------- python_3_script_18: Python ----------
Top = [Vertices, CornerA, CornerB, CornerC, CornerD]
# ---------- end python_3_script_18 ----------
python_3_script_19 = Python3Script(
    Vertices=deconstruct_mesh_4.Vertices,
    CornerA=deconstruct_face_4.CornerA,
    CornerB=deconstruct_face_4.CornerB,
    CornerC=deconstruct_face_4.CornerC,
    CornerD=deconstruct_face_4.CornerD)  # -> Bottom; inputs Vertices: list of Point3d, CornerA: list of Int32, CornerB: list of Int32, CornerC: list of Int32, CornerD: list of Int32
# ---------- python_3_script_19: Python ----------
Bottom = [Vertices, CornerA, CornerB, CornerC, CornerD]
# ---------- end python_3_script_19 ----------

# ----
# New Code - 15_09_25!
python_3_script_20 = Python3Script(Top=python_3_script_18, Bottom=python_3_script_19)  # -> B, Values; inputs Top: list, Bottom: list
# ---------- python_3_script_20: Python ----------
import Rhino as rc

Vertices_top = Top[0]
CornerA_top = Top[1]
CornerB_top = Top[2]
CornerC_top = Top[3]
CornerD_top = Top[4]



Vertices_bottom = Bottom[0]
CornerA_bottom = Bottom[1]
CornerB_bottom = Bottom[2]
CornerC_bottom = Bottom[3]
CornerD_bottom = Bottom[4]


B = []
for j in range(len(CornerA_top)):
    points_top = [Vertices_top[CornerA_top[j]], Vertices_top[CornerB_top[j]],Vertices_top[CornerC_top[j]], Vertices_top[CornerD_top[j]]]
    points_bottom = [Vertices_bottom[CornerA_bottom[j]], Vertices_bottom[CornerB_bottom[j]],Vertices_bottom[CornerC_bottom[j]], Vertices_bottom[CornerD_bottom[j]]]
    points = points_top + points_bottom
    surf1 = rc.Geometry.NurbsSurface.CreateFromCorners(points[0], points[1], points[2], points[3])
    surf2 = rc.Geometry.NurbsSurface.CreateFromCorners(points[4], points[5], points[6], points[7])
    surf3 = rc.Geometry.NurbsSurface.CreateFromCorners(points[0], points[1], points[5], points[4])
    surf4 = rc.Geometry.NurbsSurface.CreateFromCorners(points[3], points[7], points[6], points[2])
    surf5 = rc.Geometry.NurbsSurface.CreateFromCorners(points[1], points[2], points[6], points[5])
    surf6 = rc.Geometry.NurbsSurface.CreateFromCorners(points[0], points[4], points[7], points[3])


    surf1 = rc.Geometry.Brep.CreateFromSurface(surf1)
    surf2 = rc.Geometry.Brep.CreateFromSurface(surf2)
    surf3 = rc.Geometry.Brep.CreateFromSurface(surf3)
    surf4 = rc.Geometry.Brep.CreateFromSurface(surf4)
    surf5 = rc.Geometry.Brep.CreateFromSurface(surf5)
    surf6 = rc.Geometry.Brep.CreateFromSurface(surf6)

    
    s = [surf1, surf2, surf3, surf4, surf5, surf6]
    b = rc.Geometry.Brep.CreateSolid(s,0.01)
    for k in b:
        B.append(k)


Values = []
for v in B:
    value = rc.Geometry.Brep.GetVolume(v)
    Values.append(value)
# ---------- end python_3_script_20 ----------
brep_5 = Brep(python_3_script_20.B)
python_3_script_21 = Python3Script(Volume=python_3_script_20.Values, Area=mesh_area.Area)  # -> H; inputs Volume: list of Double, Area: list of Double; same code as python_3_script_17
python_3_script_22 = Python3Script(x=python_3_script_20.Values)  # -> out, Total_Volume; inputs x: list of Double
# ---------- python_3_script_22: Python ----------
Total_Volume = 0
for i in x:
    Total_Volume += i
# ---------- end python_3_script_22 ----------

crosec = CrossSectionKaramba3D(FamilyNameOfCrossSection="DefaultCroSec", Materials=matselect, Heights_cm=python_3_script_21, mode="Shell - Var")
surfelem = CreateSurfaceElementKaramba3D(Mesh=mesh_frompoints, CrossSection=crosec, LimitDistance_m=0.005, Bending=True, mode="MeshToShell")  # -> Element, Points, Info
disassemble = DisassembleElementKaramba3D(Element=surfelem.Element)  # -> Element, ElementIdentifier, AxisOfElement, CrossSection, Joint, Material, LocalCoordinateSystem, ElementIsActive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

# ---- group: Assemble Model (Karamba3D)
assemble = AssembleModelKaramba3D(Elem=surfelem.Element, Support=supp, Load=load_karamba3d, LimitDistance_m=0.005)  # -> Model, Info, Mass_kg, CentreOfGravity, LoadCaseNames

# ----
disassemble_2 = DisassembleModelKaramba3D(Model=assemble.Model)  # -> Model, Point, Beam, Shell, Support, Load, Line, Mesh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
panel_9 = Panel(disassemble.Element)
mesh_2 = Mesh(disassemble_2.Mesh)
# NEW SCRIPT! 08_09_25
# (For a convergence test, eventually)
python_3_script_23 = Python3Script(Lx=lx_total_span_m, Ly=ly_total_span_m, mesh=mesh_2)  # -> pln_x, srf_x, srf_y; inputs Lx: Int32, Ly: Int32, mesh: Mesh
# ---------- python_3_script_23: Python ----------
import Rhino as rc


pt_center = rc.Geometry.Point3d(Lx / 2, Ly / 2, 0)
pt_top = rc.Geometry.Mesh.ClosestPoint(mesh, pt_center)

pt_origin_pln_x = rc.Geometry.Point3d(Lx / 2, Ly / 2, 0)
pt_xpoint_pln_x = rc.Geometry.Point3d(Lx / 2, Ly, 0)
pt_ypoint_pln_x = rc.Geometry.Point3d(Lx / 2, 0, pt_top[2])

pln_x = rc.Geometry.Plane(pt_origin_pln_x, pt_xpoint_pln_x, pt_ypoint_pln_x)
srf_x = rc.Geometry.PlaneSurface(pln_x)

interval_srf_x_0 = rc.Geometry.Interval(-Ly, Ly)
interval_srf_x_1 = rc.Geometry.Interval(- Lx, Lx)

srf_x.Extend(0, interval_srf_x_0)
srf_x.Extend(1, interval_srf_x_1)


pt_origin_pln_y = rc.Geometry.Point3d(Lx / 2, Ly / 2, 0)
pt_xpoint_pln_y = rc.Geometry.Point3d(Lx, Ly / 2, 0)
pt_ypoint_pln_y = rc.Geometry.Point3d(0, Ly / 2, pt_top[2])
pln_y = rc.Geometry.Plane(pt_origin_pln_y, pt_xpoint_pln_y, pt_ypoint_pln_y)
srf_y = rc.Geometry.PlaneSurface(pln_y)

interval_srf_y_0 = rc.Geometry.Interval(-Lx, Lx)
interval_srf_y_1 = rc.Geometry.Interval(- Ly, Ly)

srf_y.Extend(0, interval_srf_y_0)
srf_y.Extend(1, interval_srf_y_1)



'''
mesh_x = [rc.Geometry.Mesh.CreateFromSurface(srf_x)]

mesh = [mesh]

a = rc.Geometry.Mesh.CreateBooleanDifference(mesh_x, mesh)

#a = rc.Geometry.Mesh.DestroyPartition(mesh)

'''
# ---------- end python_3_script_23 ----------
face_normals_3 = FaceNormals(Mesh=mesh_2)  # -> Centers, Normals
panel_10 = Panel(assemble.Mass_kg)
division_3 = Division(A=panel_10, B=2400)

# ---- group: Analyse (Karamba3D)
analyse = AnalyseKaramba3D(Model=assemble.Model, LoadCases="ULS")  # -> AnalysedModel, MaximumDisplacement_cm, ResultingForce_kN, ChangeOfElasticEnergy_kNm

# ---- group: Analyse, Analyze
analyse_2 = AnalyseKaramba3D(Model=assemble.Model, LoadCases="SLSg")  # -> AnalysedModel, MaximumDisplacement_cm, ResultingForce_kN, ChangeOfElasticEnergy_kNm

# ----
analyse_3 = AnalyseKaramba3D(Model=assemble.Model, LoadCases="SLSq")  # -> AnalysedModel, MaximumDisplacement_cm, ResultingForce_kN, ChangeOfElasticEnergy_kNm
list_length_2 = ListLength(List=face_normals_3.Centers)
panel_11 = Panel(division_3)
s_forces = ShellSectionKaramba3D(
    Model=analyse_2.AnalysedModel,
    IntersectionGeometry=python_3_script_23.srf_y,
    ProjectionDirection=Vector(0, 0, -1),
    mode="Forces",
    menu=[checkbox(on), checkbox(on), checkbox(on), slider(20), slider(0.06), slider(1), checkbox(on), checkbox(off), checkbox(off), checkbox(off), checkbox(off), checkbox(off), checkbox(off), checkbox(off), checkbox(off), slider(1)])  # -> Model, CuttingCurves, simplify(FaceIndices), MeshesOfRenderedResults, CurvesOfRenderedResults, Ntt_kN_m, flatten(Nnn_kN_m), Ntn_kN_m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
series_2 = Series(Start=0, Step=1, Count=list_length_2)
multiplication_8 = Multiplication(A=analyse_2.MaximumDisplacement_cm, B=2.5)
addition = Addition(A=multiplication_8, B=analyse_3.MaximumDisplacement_cm)
text_tag_2 = TextTag(Location=face_normals_3.Centers, Text=series_2)
analyse_4 = AnalyseKaramba3D(Model=assemble.Model, LoadCases="SLS")  # -> AnalysedModel, MaximumDisplacement_cm, ResultingForce_kN, ChangeOfElasticEnergy_kNm
panel_12 = Panel(s_forces.Nnn_kN_m)

# ---- group: Model View (Karamba3D)
modelview = ModelViewKaramba3D(Model=analyse.AnalysedModel, LoadCase="ULS")  # -> Model, DeformedMesh, DeformedAxes, DeformedModel, MaximumDeformation

# ---- group: Shell View (Karamba3D)
shellview = ShellViewKaramba3D(Model=modelview.Model, IndexOfLayer=0)  # -> Model, MeshesOfRenderedShells, LegendColours, LegendTags

# ----
react = ReactionForcesKaramba3D(AnalysedModel=analyse_4.AnalysedModel, LoadCase="SLS")  # -> Model, simplify(graft(ReactionForces_kN)), ReactionMoments_kNm, SupportPosition, SumOfReactionForces_kN, SumOfReactionMoments_kNm, GoverningLoadCaseIndex
legend = Legend(Colour=shellview.LegendColours, Tags=shellview.LegendTags, LegendType=1)
panel_13 = Panel(react.ReactionForces_kN)

# ---- group: React, React
react_2 = ReactionForcesKaramba3D(AnalysedModel=shellview.Model, LoadCase="ULS")  # -> Model, simplify(graft(ReactionForces_kN)), ReactionMoments_kNm, SupportPosition, SumOfReactionForces_kN, SumOfReactionMoments_kNm, GoverningLoadCaseIndex

# ----
panel_14 = Panel(react_2.ReactionForces_kN)
s_forces_2 = ShellForcesKaramba3D(AnalysedModel=shellview.Model, LoadCase="ULS", mode="Local")  # -> Model, flatten(Nxx_kN_m), flatten(Nyy_kN_m), flatten(Nxy_kN_m), flatten(Mxx_kNm_m), flatten(Myy_kNm_m), flatten(Mxy_kNm_m), Vx_kN_m, Vy_kN_m, LoadCaseIndex
panel_15 = Panel(s_forces_2.Model)
rep = ReplaceText(Text=react_2.ReactionForces_kN, Find="{", RecursiveReplace=False)
rep_2 = ReplaceText(Text=rep, Find="}", RecursiveReplace=False)

# ----
# (5) COLUMN CHECK + EMBODIED
#       CARBON DUE TO COLUMNS
# Column Reactions (kN):
# Nx, Ny, Nz
split = TextSplit(Text=graft(rep_2), Separators=",")  # -> flatten(Result)
subset = SubList(List=split, Domain=Domain(0, 2), Wrap=True)  # -> List, Index
py3 = Python3Script(Ncol=subset.List, bcol=column_b_h_m)  # -> out, EC_Col, flatten(Col_Check); inputs Ncol: list of Double, bcol: Double
# ---------- py3: Python ----------
#Code for design of column under biaxial bending (applicable ONLY for square symmetric columns)

from numpy import pi
# from scipy.optimize import minimize

# from sympy import Eq, Symbol, solve
# from sympy import tan
# import math
# from sympy import symbols, solve

# units are kN and m

N=Ncol # Transfered forces from shell to column (kN)
# N=[300,300,364]
Nx=abs(N[0])
Ny=abs(N[1])
Nz=abs(N[2])

# INPUT DATA
b = bcol               #Width and depth of column (in m) We set the minimum column width for 0.5 m for saving computational time; however, this should typically set as 0.3 m
L = 3               #Length of column (in m)     
c = 0.025           #Clear concrete cover (in m)

fc = 35000          #Characteristic cylindrical strength of concrete (kN/m2)
fcd = 1*fc / 1.5 #Design strength of concrete (kN/m2) as per Eurocode
Ec = 34000000       #Elastic modulus of concrete (kN/m2)
Gammac = 25         #Density of concrete (kN/m3) for column design
Gamma_c = 2500       #Density of concrete (kg/m3) for embodied carbon calculation
ECF_c = 0.13       #  kgCO2e/kg (from Orr et al., 2020)
ffu = 1000000       #Ultimate tensile strength of FRP bars (kN/m2)
CE = 0.7          #Environmental reduction factor for glass FRP (concrete exposed to weather and earth)
Phi1 = 0.55       #Strength reduction factor for tension-controlled design
Phi2 = 0.65       #Strength reduction factor for compression-controlled design
ffd = CE * Phi2 * ffu #Design tensile strength of FRP rebars for tension-controlled section (kN/m2) (ACI 440.1R-15 Page 19) 
# ffd = 0.65 * ffu    #Design strength of FRP bars (kN/m2)      
Ef = 50000000       #Modulus of elasticity of FRP bars (in kN/m2)
Gamma_GFRP = 1900       #  kg/m3 
ECF_BFRP = 2            #  kgCO2e/kg (Initial Value)
ECF_GFRP = 2.7          #  kgCO2e/kg (Initial Value)


num = 36            #Number of FRP bars
Rho = 0.03          #Reinforcement ratio
As = Rho * b**2     #Reinforcement area (m2)
asb = As / num      #FRP bar area (m2)
dia = ( asb * 4 /pi )**0.5  # FRP bar diameter (m)
dia_sec = 0.008     #Stirrups diameter (m)

#Neutral Axis Calculations
#Effective depths of reinforcing bars
#Assume neutral axis depth
n = b/5                               #Just for saving our computational time, we are starting the neutral axis depth assumed value from b/5. In general, this should start from 1 cm
# n = symbols ('n')
while n <= b:
    d1 = c + dia_sec + dia / 2                                                               #Diagonal depth of bars from extreme column corner
    d2 = c + dia_sec + dia / 2 + (b - 2*c - 2*dia_sec - dia) / 9
    d3 = c + dia_sec + dia / 2 + 2 * (b - 2*c - 2*dia_sec - dia) / 9
    d4 = c + dia_sec + dia / 2 + 3 * (b - 2*c - 2*dia_sec - dia) / 9
    d5 = c + dia_sec + dia / 2 + 4 * (b - 2*c - 2*dia_sec - dia) / 9
    d6 = c + dia_sec + dia / 2 + 5 * (b - 2*c - 2*dia_sec - dia) / 9
    d7 = c + dia_sec + dia / 2 + 6 * (b - 2*c - 2*dia_sec - dia) / 9
    d8 = c + dia_sec + dia / 2 + 7 * (b - 2*c - 2*dia_sec - dia) / 9
    d9 = c + dia_sec + dia / 2 + 8 * (b - 2*c - 2*dia_sec - dia) / 9
    d10 = b - c - dia_sec - dia / 2
    d11 = b - c - dia_sec - dia / 2
    d12 = b - c - dia_sec - dia / 2
    d13 = b - c - dia_sec - dia / 2
    d14 = b - c - dia_sec - dia / 2
    d15 = b - c - dia_sec - dia / 2
    d16 = b - c - dia_sec - dia / 2
    d17 = b - c - dia_sec - dia / 2
    d18 = b - c - dia_sec - dia / 2
    d19 = b - c - dia_sec - dia / 2
    d20 = c + dia_sec + dia / 2 + 8 * (b - 2*c - 2*dia_sec - dia) / 9
    d21 = c + dia_sec + dia / 2 + 7 * (b - 2*c - 2*dia_sec - dia) / 9
    d22 = c + dia_sec + dia / 2 + 6 * (b - 2*c - 2*dia_sec - dia) / 9
    d23 = c + dia_sec + dia / 2 + 5 * (b - 2*c - 2*dia_sec - dia) / 9
    d24 = c + dia_sec + dia / 2 + 4 * (b - 2*c - 2*dia_sec - dia) / 9
    d25 = c + dia_sec + dia / 2 + 3 * (b - 2*c - 2*dia_sec - dia) / 9
    d26 = c + dia_sec + dia / 2 + 2 * (b - 2*c - 2*dia_sec - dia) / 9
    d27 = c + dia_sec + dia / 2 + (b - 2*c - 2*dia_sec - dia) / 9
    d28 = c + dia_sec + dia / 2
    d29 = c + dia_sec + dia / 2
    d30 = c + dia_sec + dia / 2
    d31 = c + dia_sec + dia / 2
    d32 = c + dia_sec + dia / 2
    d33 = c + dia_sec + dia / 2
    d34 = c + dia_sec + dia / 2
    d35 = c + dia_sec + dia / 2
    d36 = c + dia_sec + dia / 2

        # d2 = c + dia_sec + dia / 2
        # d3 = c + dia_sec + dia / 2 
        # d4 = c + dia_sec + dia / 2
        # d5 = c + (b - 2 * c) / 3
        # d6 = c + 2 * (b - 2 * c) / 3
        # d7 = b - (c + dia_sec + dia / 2)
        # d8 = b - (c + dia_sec + dia / 2)
        # d9 = b - (c + dia_sec + dia / 2)
        # d10 = b - (c + dia_sec + dia / 2)
        # d11 = c + 2 * (b - 2 * c) / 3
        # d12 = c + (b - 2 * c) / 3

        # print (d1,d2,d3,d4,d5,d6,d7,d8,d9,d10,d11,d12)

#Tensile strains in reinforcing bars
    Epsilon1 = min(0.0035 * (d1 - n) / n,ffd/Ef)
    Epsilon2 = min(0.0035 * (d2 - n) / n,ffd/Ef)
    Epsilon3 = min(0.0035 * (d3 - n) / n,ffd/Ef)
    Epsilon4 = min(0.0035 * (d4 - n) / n,ffd/Ef)
    Epsilon5 = min(0.0035 * (d5 - n) / n,ffd/Ef)
    Epsilon6 = min(0.0035 * (d6 - n) / n,ffd/Ef)
    Epsilon7 = min(0.0035 * (d7 - n) / n,ffd/Ef)
    Epsilon8 = min(0.0035 * (d8 - n) / n,ffd/Ef)
    Epsilon9 = min(0.0035 * (d9 - n) / n,ffd/Ef)
    Epsilon10 = min(0.0035 * (d10 - n) / n,ffd/Ef)
    Epsilon11 = min(0.0035 * (d11 - n) / n,ffd/Ef)
    Epsilon12 = min(0.0035 * (d12 - n) / n,ffd/Ef)
    Epsilon13 = min(0.0035 * (d13 - n) / n,ffd/Ef)
    Epsilon14 = min(0.0035 * (d14 - n) / n,ffd/Ef)
    Epsilon15 = min(0.0035 * (d15 - n) / n,ffd/Ef)
    Epsilon16 = min(0.0035 * (d16 - n) / n,ffd/Ef)
    Epsilon17 = min(0.0035 * (d17 - n) / n,ffd/Ef)
    Epsilon18 = min(0.0035 * (d18 - n) / n,ffd/Ef)
    Epsilon19 = min(0.0035 * (d19 - n) / n,ffd/Ef)
    Epsilon20 = min(0.0035 * (d20 - n) / n,ffd/Ef)
    Epsilon21 = min(0.0035 * (d21 - n) / n,ffd/Ef)
    Epsilon22 = min(0.0035 * (d22 - n) / n,ffd/Ef)
    Epsilon23 = min(0.0035 * (d23 - n) / n,ffd/Ef)
    Epsilon24 = min(0.0035 * (d24 - n) / n,ffd/Ef)
    Epsilon25 = min(0.0035 * (d25 - n) / n,ffd/Ef)
    Epsilon26 = min(0.0035 * (d26 - n) / n,ffd/Ef)
    Epsilon27 = min(0.0035 * (d27 - n) / n,ffd/Ef)
    Epsilon28 = min(0.0035 * (d28 - n) / n,ffd/Ef)
    Epsilon29 = min(0.0035 * (d29 - n) / n,ffd/Ef)
    Epsilon30 = min(0.0035 * (d30 - n) / n,ffd/Ef)
    Epsilon31 = min(0.0035 * (d31 - n) / n,ffd/Ef)
    Epsilon32 = min(0.0035 * (d32 - n) / n,ffd/Ef)
    Epsilon33 = min(0.0035 * (d33 - n) / n,ffd/Ef)
    Epsilon34 = min(0.0035 * (d34 - n) / n,ffd/Ef)
    Epsilon35 = min(0.0035 * (d35 - n) / n,ffd/Ef)
    Epsilon36 = min(0.0035 * (d36 - n) / n,ffd/Ef)

        # print (Epsilon1,Epsilon2,Epsilon3,Epsilon4,Epsilon5,Epsilon6,Epsilon7,Epsilon8,Epsilon9,Epsilon10,Epsilon11,Epsilon12)

# Tensile forces in reinforcing bars
    Ts1 = max(Epsilon1 * Ef * asb, 0)
    Ts2 = max(Epsilon2 * Ef * asb, 0)
    Ts3 = max(Epsilon3 * Ef * asb, 0)
    Ts4 = max(Epsilon4 * Ef * asb, 0)
    Ts5 = max(Epsilon5 * Ef * asb, 0)
    Ts6 = max(Epsilon6 * Ef * asb, 0)
    Ts7 = max(Epsilon7 * Ef * asb, 0)
    Ts8 = max(Epsilon8 * Ef * asb, 0)
    Ts9 = max(Epsilon9 * Ef * asb, 0)
    Ts10 = max(Epsilon10 * Ef * asb, 0)
    Ts11 = max(Epsilon11 * Ef * asb, 0)
    Ts12 = max(Epsilon12 * Ef * asb, 0)
    Ts13 = max(Epsilon13 * Ef * asb, 0)
    Ts14 = max(Epsilon14 * Ef * asb, 0)
    Ts15 = max(Epsilon15 * Ef * asb, 0)
    Ts16 = max(Epsilon16 * Ef * asb, 0)
    Ts17 = max(Epsilon17 * Ef * asb, 0)
    Ts18 = max(Epsilon18 * Ef * asb, 0)
    Ts19 = max(Epsilon19 * Ef * asb, 0)
    Ts20 = max(Epsilon20 * Ef * asb, 0)
    Ts21 = max(Epsilon21 * Ef * asb, 0)
    Ts22 = max(Epsilon22 * Ef * asb, 0)
    Ts23 = max(Epsilon23 * Ef * asb, 0)
    Ts24 = max(Epsilon24 * Ef * asb, 0)
    Ts25 = max(Epsilon25 * Ef * asb, 0)
    Ts26 = max(Epsilon26 * Ef * asb, 0)
    Ts27 = max(Epsilon27 * Ef * asb, 0)
    Ts28 = max(Epsilon28 * Ef * asb, 0)
    Ts29 = max(Epsilon29 * Ef * asb, 0)
    Ts30 = max(Epsilon30 * Ef * asb, 0)
    Ts31 = max(Epsilon31 * Ef * asb, 0)
    Ts32 = max(Epsilon32 * Ef * asb, 0)
    Ts33 = max(Epsilon33 * Ef * asb, 0)
    Ts34 = max(Epsilon34 * Ef * asb, 0)
    Ts35 = max(Epsilon35 * Ef * asb, 0)
    Ts36 = max(Epsilon36 * Ef * asb, 0)

    Ts = Ts1+Ts2+Ts3+Ts4+Ts5+Ts6+Ts7+Ts8+Ts9+Ts10+Ts11+Ts12+Ts13+Ts14+Ts15+Ts16+Ts17+Ts18+Ts19+Ts20\
        +Ts21+Ts22+Ts23+Ts24+Ts25+Ts26+Ts27+Ts28+Ts29+Ts30+Ts31+Ts32+Ts33+Ts34+Ts35+Ts36

        # print (Ts1,Ts2,Ts3,Ts4,Ts5,Ts6,Ts7,Ts8,Ts9,Ts10,Ts11,Ts12)
        # print (Ts)

#Compression in concrete
    Beta1 = max(0.85 - 0.05 * (fc/1000 - 27.5) / 6.9,0.65)
    # print (Beta1)
    Cc = 0.85 * fcd * b * Beta1 * n
    # print (Cc)

#Check Equilibrium
    if abs((Cc-Ts)-(Nz + b**2 * L * Gammac)/0.65) < 0.05*Nz:    #In pure flexure, Nz disappears from the picture and the equilibrium is only CC-Ts < 0 or a tolerance like the one we set (0.05Nz)
        break
    else:
        n = n + 0.0001

        # if abs (Cc-Ts)-(Nz + b**2 * L * Gammac)/0.65 < 0.01*Nz:
        #     break
        # else:
        #     n = n + 0.001


#Axial compressive capacity
Phi = 0.65                           #Strength reduction factor (ACI 318 Table 21.2.2)
Pn = Phi * (Cc - Ts)                 #Axial force capacity (kN)
Pu = Phi * b**2 * fcd                #Maximum axial force capacity in pure compression (kN) 
Ratio = (Nz + b**2*L*Gammac)/Pu
Alpha = 1 + (Ratio - 0.1) * (1.5 - 1) / (0.7 - 0.1)

#Moment capacity 
Mn = Phi * (Ts1*d1+Ts2*d2+Ts3*d3+Ts4*d4+Ts5*d5+Ts6*d6+Ts7*d7+Ts8*d8+Ts9*d9+Ts10*d10+Ts11*d11+Ts12*d12+Ts13*d13+Ts14*d14+Ts15*d15+Ts16*d16\
            +Ts17*d17+Ts18*d18+Ts19*d19+Ts20*d20+Ts21*d21+Ts22*d22+Ts23*d23+Ts24*d24+Ts25*d25+Ts26*d26+Ts27*d27+Ts28*d28+Ts29*d29+Ts30*d30\
                 +Ts31*d31+Ts32*d32+Ts33*d33+Ts34*d34+Ts35*d35+Ts36*d36 - Cc*Beta1*n/2)

Mx = Nx * L
My = Ny * L
    
BiaxialBendingCheck = 2 * ( Mx / Mn )**Alpha      #To check the sufficiency for biaxial bending 

Col_Check = BiaxialBendingCheck  
Deltax = Nx * L**3 / (3 * Ec * (b*b**3 / 12))
Deltay = Ny * L**3 / (3 * Ec * (b*b**3 / 12))
Delta = (Deltax**2 + Deltay**2)**0.5              #Lateral displacement (m)
    


# #Check axial compressive capacity and bending capacity
# # if Pn >= N[2] and Mn >= max(Mx,My) and BiaxialBendingCheck <= 1:
# if Mn >= max(Mx,My) and BiaxialBendingCheck <= 1 and Delta <= L/400:
#     break
#         # print ('Safe under Axial Compression')
# else:
#     b = b + 0.01 #We set the step to 1 cm just for the sake of comparision; however, this should be rounded to 5 cm increase each time

EC_Col = 4 * b**2 * L * Gamma_c * ECF_c + 4 * As * L * Gamma_GFRP * ECF_GFRP #Embodied carbon due to four corners columens (kg)

print ('results')                       
print(n)                        #Depth of nuetral axis for uniaxial bending (m)
print (Pn)                      #Axial force capacity in uniaxial bending (kN)
print (Pu)                      #Pure axial force capacity with no bending (kN) 
print (Alpha)                   #Exponentiation for the biaxial bending checking equation
print(Mn)                       #Uniaxial moment capacity (kN.m) (interaction of axial compression and one bending moment)
print (Mx)                      #External moment in X-direction (kN.m)
print (My)                      #External moment in Y-direction (kN.m) In our case, it is equal to Mx
print(BiaxialBendingCheck)      #Result of biaxial bending checking equation (<= 1)
print(Delta)                    #Lateral displacement (m)
print (b)                       #Resultant width of the column (m)
print(EC_Col)                   #Embodied carbon due to four corners columns (obtained from concrete + FRP, kg)
print(Pn)
print(Mn)
print(n)
# ---------- end py3 ----------

panel_16 = Panel(subset.List)
panel_17 = Panel(py3.Col_Check)

# ----
# Independent code
# including two loops
py3_2 = Python3Script(Ncol=subset.List)  # -> out, EC_Col; inputs Ncol: list of Double, bcol: Double
# ---------- py3_2: Python ----------
#Code for design of column under biaxial bending (applicable ONLY for square symmetric columns)

import numpy as np
from scipy.optimize import minimize

from sympy import Eq, Symbol, solve
from sympy import tan
import math
from sympy import symbols, solve

# units are kN and m

N=Ncol # Transfered forces from shell to column (kN)
# N=[300,300,364]
Nx=abs(N[0])
Ny=abs(N[1])
Nz=abs(N[2])

# INPUT DATA
b = 0.5               #Width and depth of column (in m) We set the minimum column width for 0.5 m for saving computational time; however, this should typically set as 0.3 m
L = 3               #Length of column (in m)     
c = 0.025           #Clear concrete cover (in m)

fc = 35000          #Characteristic cylindrical strength of concrete (kN/m2)
fcd = 1*fc / 1.5 #Design strength of concrete (kN/m2)
Ec = 34000000       #Elastic modulus of concrete (kN/m2)
Gammac = 25         #Density of concrete (kN/m3) for column design
Gamma_c = 2500       #Density of concrete (kg/m3) for embodied carbon calculation
ECF_c = 0.13       #  kgCO2e/kg (from Orr et al., 2020)
ffu = 1000000       #Ultimate tensile strength of FRP bars (kN/m2)
CE = 0.7          #Environmental reduction factor for glass FRP (concrete exposed to weather and earth)
Phi1 = 0.55       #Strength reduction factor for tension-controlled design
Phi2 = 0.65       #Strength reduction factor for compression-controlled design
ffd = CE * Phi2 * ffu #Design tensile strength of FRP rebars for tension-controlled section (kN/m2) (ACI 440.1R-15 Page 19) 
# ffd = 0.65 * ffu    #Design strength of FRP bars (kN/m2)      
Ef = 50000000       #Modulus of elasticity of FRP bars (in kN/m2)
Gamma_GFRP = 1900       #  kg/m3 
ECF_BFRP = 2            #  kgCO2e/kg (Initial Value)
ECF_GFRP = 2.7          #  kgCO2e/kg (Initial Value)


# Column = range(1, 2, 0.05)
while b<=2.5:
    num = 36            #Number of FRP bars
    Rho = 0.03          #Reinforcement ratio
    As = Rho * b**2     #Reinforcement area (m2)
    asb = As / num      #FRP bar area (m2)
    dia = ( asb * 4 /np.pi )**0.5  # FRP bar diameter (m)
    dia_sec = 0.008     #Stirrups diameter (m)

#Neutral Axis Calculations
#Effective depths of reinforcing bars
#Assume neutral axis depth
    n = b/5                               #Just for saving our computational time, we are starting the neutral axis depth assumed value from b/5. In general, this should start from 1 cm
# n = symbols ('n')
    while n <= b:
        d1 = c + dia_sec + dia / 2                                                               #Diagonal depth of bars from extreme column corner
        d2 = c + dia_sec + dia / 2 + (b - 2*c - 2*dia_sec - dia) / 9
        d3 = c + dia_sec + dia / 2 + 2 * (b - 2*c - 2*dia_sec - dia) / 9
        d4 = c + dia_sec + dia / 2 + 3 * (b - 2*c - 2*dia_sec - dia) / 9
        d5 = c + dia_sec + dia / 2 + 4 * (b - 2*c - 2*dia_sec - dia) / 9
        d6 = c + dia_sec + dia / 2 + 5 * (b - 2*c - 2*dia_sec - dia) / 9
        d7 = c + dia_sec + dia / 2 + 6 * (b - 2*c - 2*dia_sec - dia) / 9
        d8 = c + dia_sec + dia / 2 + 7 * (b - 2*c - 2*dia_sec - dia) / 9
        d9 = c + dia_sec + dia / 2 + 8 * (b - 2*c - 2*dia_sec - dia) / 9
        d10 = b - c - dia_sec - dia / 2
        d11 = b - c - dia_sec - dia / 2
        d12 = b - c - dia_sec - dia / 2
        d13 = b - c - dia_sec - dia / 2
        d14 = b - c - dia_sec - dia / 2
        d15 = b - c - dia_sec - dia / 2
        d16 = b - c - dia_sec - dia / 2
        d17 = b - c - dia_sec - dia / 2
        d18 = b - c - dia_sec - dia / 2
        d19 = b - c - dia_sec - dia / 2
        d20 = c + dia_sec + dia / 2 + 8 * (b - 2*c - 2*dia_sec - dia) / 9
        d21 = c + dia_sec + dia / 2 + 7 * (b - 2*c - 2*dia_sec - dia) / 9
        d22 = c + dia_sec + dia / 2 + 6 * (b - 2*c - 2*dia_sec - dia) / 9
        d23 = c + dia_sec + dia / 2 + 5 * (b - 2*c - 2*dia_sec - dia) / 9
        d24 = c + dia_sec + dia / 2 + 4 * (b - 2*c - 2*dia_sec - dia) / 9
        d25 = c + dia_sec + dia / 2 + 3 * (b - 2*c - 2*dia_sec - dia) / 9
        d26 = c + dia_sec + dia / 2 + 2 * (b - 2*c - 2*dia_sec - dia) / 9
        d27 = c + dia_sec + dia / 2 + (b - 2*c - 2*dia_sec - dia) / 9
        d28 = c + dia_sec + dia / 2
        d29 = c + dia_sec + dia / 2
        d30 = c + dia_sec + dia / 2
        d31 = c + dia_sec + dia / 2
        d32 = c + dia_sec + dia / 2
        d33 = c + dia_sec + dia / 2
        d34 = c + dia_sec + dia / 2
        d35 = c + dia_sec + dia / 2
        d36 = c + dia_sec + dia / 2

        # d2 = c + dia_sec + dia / 2
        # d3 = c + dia_sec + dia / 2 
        # d4 = c + dia_sec + dia / 2
        # d5 = c + (b - 2 * c) / 3
        # d6 = c + 2 * (b - 2 * c) / 3
        # d7 = b - (c + dia_sec + dia / 2)
        # d8 = b - (c + dia_sec + dia / 2)
        # d9 = b - (c + dia_sec + dia / 2)
        # d10 = b - (c + dia_sec + dia / 2)
        # d11 = c + 2 * (b - 2 * c) / 3
        # d12 = c + (b - 2 * c) / 3

        # print (d1,d2,d3,d4,d5,d6,d7,d8,d9,d10,d11,d12)

#Tensile strains in reinforcing bars
        Epsilon1 = min(0.0035 * (d1 - n) / n,ffd/Ef)
        Epsilon2 = min(0.0035 * (d2 - n) / n,ffd/Ef)
        Epsilon3 = min(0.0035 * (d3 - n) / n,ffd/Ef)
        Epsilon4 = min(0.0035 * (d4 - n) / n,ffd/Ef)
        Epsilon5 = min(0.0035 * (d5 - n) / n,ffd/Ef)
        Epsilon6 = min(0.0035 * (d6 - n) / n,ffd/Ef)
        Epsilon7 = min(0.0035 * (d7 - n) / n,ffd/Ef)
        Epsilon8 = min(0.0035 * (d8 - n) / n,ffd/Ef)
        Epsilon9 = min(0.0035 * (d9 - n) / n,ffd/Ef)
        Epsilon10 = min(0.0035 * (d10 - n) / n,ffd/Ef)
        Epsilon11 = min(0.0035 * (d11 - n) / n,ffd/Ef)
        Epsilon12 = min(0.0035 * (d12 - n) / n,ffd/Ef)
        Epsilon13 = min(0.0035 * (d13 - n) / n,ffd/Ef)
        Epsilon14 = min(0.0035 * (d14 - n) / n,ffd/Ef)
        Epsilon15 = min(0.0035 * (d15 - n) / n,ffd/Ef)
        Epsilon16 = min(0.0035 * (d16 - n) / n,ffd/Ef)
        Epsilon17 = min(0.0035 * (d17 - n) / n,ffd/Ef)
        Epsilon18 = min(0.0035 * (d18 - n) / n,ffd/Ef)
        Epsilon19 = min(0.0035 * (d19 - n) / n,ffd/Ef)
        Epsilon20 = min(0.0035 * (d20 - n) / n,ffd/Ef)
        Epsilon21 = min(0.0035 * (d21 - n) / n,ffd/Ef)
        Epsilon22 = min(0.0035 * (d22 - n) / n,ffd/Ef)
        Epsilon23 = min(0.0035 * (d23 - n) / n,ffd/Ef)
        Epsilon24 = min(0.0035 * (d24 - n) / n,ffd/Ef)
        Epsilon25 = min(0.0035 * (d25 - n) / n,ffd/Ef)
        Epsilon26 = min(0.0035 * (d26 - n) / n,ffd/Ef)
        Epsilon27 = min(0.0035 * (d27 - n) / n,ffd/Ef)
        Epsilon28 = min(0.0035 * (d28 - n) / n,ffd/Ef)
        Epsilon29 = min(0.0035 * (d29 - n) / n,ffd/Ef)
        Epsilon30 = min(0.0035 * (d30 - n) / n,ffd/Ef)
        Epsilon31 = min(0.0035 * (d31 - n) / n,ffd/Ef)
        Epsilon32 = min(0.0035 * (d32 - n) / n,ffd/Ef)
        Epsilon33 = min(0.0035 * (d33 - n) / n,ffd/Ef)
        Epsilon34 = min(0.0035 * (d34 - n) / n,ffd/Ef)
        Epsilon35 = min(0.0035 * (d35 - n) / n,ffd/Ef)
        Epsilon36 = min(0.0035 * (d36 - n) / n,ffd/Ef)

        # print (Epsilon1,Epsilon2,Epsilon3,Epsilon4,Epsilon5,Epsilon6,Epsilon7,Epsilon8,Epsilon9,Epsilon10,Epsilon11,Epsilon12)

# Tensile forces in reinforcing bars
        Ts1 = max(Epsilon1 * Ef * asb, 0)
        Ts2 = max(Epsilon2 * Ef * asb, 0)
        Ts3 = max(Epsilon3 * Ef * asb, 0)
        Ts4 = max(Epsilon4 * Ef * asb, 0)
        Ts5 = max(Epsilon5 * Ef * asb, 0)
        Ts6 = max(Epsilon6 * Ef * asb, 0)
        Ts7 = max(Epsilon7 * Ef * asb, 0)
        Ts8 = max(Epsilon8 * Ef * asb, 0)
        Ts9 = max(Epsilon9 * Ef * asb, 0)
        Ts10 = max(Epsilon10 * Ef * asb, 0)
        Ts11 = max(Epsilon11 * Ef * asb, 0)
        Ts12 = max(Epsilon12 * Ef * asb, 0)
        Ts13 = max(Epsilon13 * Ef * asb, 0)
        Ts14 = max(Epsilon14 * Ef * asb, 0)
        Ts15 = max(Epsilon15 * Ef * asb, 0)
        Ts16 = max(Epsilon16 * Ef * asb, 0)
        Ts17 = max(Epsilon17 * Ef * asb, 0)
        Ts18 = max(Epsilon18 * Ef * asb, 0)
        Ts19 = max(Epsilon19 * Ef * asb, 0)
        Ts20 = max(Epsilon20 * Ef * asb, 0)
        Ts21 = max(Epsilon21 * Ef * asb, 0)
        Ts22 = max(Epsilon22 * Ef * asb, 0)
        Ts23 = max(Epsilon23 * Ef * asb, 0)
        Ts24 = max(Epsilon24 * Ef * asb, 0)
        Ts25 = max(Epsilon25 * Ef * asb, 0)
        Ts26 = max(Epsilon26 * Ef * asb, 0)
        Ts27 = max(Epsilon27 * Ef * asb, 0)
        Ts28 = max(Epsilon28 * Ef * asb, 0)
        Ts29 = max(Epsilon29 * Ef * asb, 0)
        Ts30 = max(Epsilon30 * Ef * asb, 0)
        Ts31 = max(Epsilon31 * Ef * asb, 0)
        Ts32 = max(Epsilon32 * Ef * asb, 0)
        Ts33 = max(Epsilon33 * Ef * asb, 0)
        Ts34 = max(Epsilon34 * Ef * asb, 0)
        Ts35 = max(Epsilon35 * Ef * asb, 0)
        Ts36 = max(Epsilon36 * Ef * asb, 0)

        Ts = Ts1+Ts2+Ts3+Ts4+Ts5+Ts6+Ts7+Ts8+Ts9+Ts10+Ts11+Ts12+Ts13+Ts14+Ts15+Ts16+Ts17+Ts18+Ts19+Ts20\
            +Ts21+Ts22+Ts23+Ts24+Ts25+Ts26+Ts27+Ts28+Ts29+Ts30+Ts31+Ts32+Ts33+Ts34+Ts35+Ts36

        # print (Ts1,Ts2,Ts3,Ts4,Ts5,Ts6,Ts7,Ts8,Ts9,Ts10,Ts11,Ts12)
        # print (Ts)

#Compression in concrete
        Beta1 = max(0.85 - 0.05 * (fc/1000 - 27.5) / 6.9,0.65)
        # print (Beta1)
        Cc = 0.85 * fcd * b * Beta1 * n
        # print (Cc)

#Check Equilibrium
        if abs((Cc-Ts)-(Nz + b**2 * L * Gammac)/0.65) < 0.1*Nz:    #In pure flexure, Nz disappears from the picture and the equilibrium is only CC-Ts < 0 or a tolerance like the one we set (0.05Nz)
            break
        else:
            n = n + 0.001

        # if abs (Cc-Ts)-(Nz + b**2 * L * Gammac)/0.65 < 0.01*Nz:
        #     break
        # else:
        #     n = n + 0.001


#Axial compressive capacity
    Phi = 0.65                           #Strength reduction factor (ACI 318 Table 21.2.2)
    Pn = Phi * (Cc - Ts)                 #Axial force capacity (kN)
    Pu = Phi * b**2 * fcd                #Maximum axial force capacity in pure compression (kN) 
    Ratio = (Nz + b**2*L*Gammac)/Pu
    Alpha = 1 + (Ratio - 0.1) * (1.5 - 1) / (0.7 - 0.1)

#Moment capacity 
    Mn = Phi * (Ts1*d1+Ts2*d2+Ts3*d3+Ts4*d4+Ts5*d5+Ts6*d6+Ts7*d7+Ts8*d8+Ts9*d9+Ts10*d10+Ts11*d11+Ts12*d12+Ts13*d13+Ts14*d14+Ts15*d15+Ts16*d16\
                +Ts17*d17+Ts18*d18+Ts19*d19+Ts20*d20+Ts21*d21+Ts22*d22+Ts23*d23+Ts24*d24+Ts25*d25+Ts26*d26+Ts27*d27+Ts28*d28+Ts29*d29+Ts30*d30\
                     +Ts31*d31+Ts32*d32+Ts33*d33+Ts34*d34+Ts35*d35+Ts36*d36 - Cc*Beta1*n/2)

    Mx = Nx * L
    My = Ny * L
    
    BiaxialBendingCheck = 2 * ( Mx / Mn )**Alpha      #To check the sufficiency for biaxial bending 
    
    Deltax = Nx * L**3 / (3 * Ec * (b*b**3 / 12))
    Deltay = Ny * L**3 / (3 * Ec * (b*b**3 / 12))
    Delta = (Deltax**2 + Deltay**2)**0.5              #Lateral displacement (m)
    


#Check axial compressive capacity and bending capacity
# if Pn >= N[2] and Mn >= max(Mx,My) and BiaxialBendingCheck <= 1:
    if Mn >= max(Mx,My) and BiaxialBendingCheck <= 1 and Delta <= L/400:
        break
        # print ('Safe under Axial Compression')
    else:
        b = b + 0.01 #We set the step to 1 cm just for the sake of comparision; however, this should be rounded to 5 cm increase each time

EC_Col = 4 * b**2 * L * Gamma_c * ECF_c + 4 * As * L * Gamma_GFRP * ECF_GFRP #Embodied carbon due to four corners columens (kg)

print ('results')                       
print(n)                        #Depth of nuetral axis for uniaxial bending (m)
print (Pn)                      #Axial force capacity in uniaxial bending (kN)
print (Pu)                      #Pure axial force capacity with no bending (kN) 
print (Alpha)                   #Exponentiation for the biaxial bending checking equation
print(Mn)                       #Uniaxial moment capacity (kN.m) (interaction of axial compression and one bending moment)
print (Mx)                      #External moment in X-direction (kN.m)
print (My)                      #External moment in Y-direction (kN.m) In our case, it is equal to Mx
print(BiaxialBendingCheck)      #Result of biaxial bending checking equation (<= 1)
print(Delta)                    #Lateral displacement (m)
print (b)                       #Resultant width of the column (m)
print(EC_Col)                   #Embodied carbon due to four corners columns (obtained from concrete + FRP, kg)
# ---------- end py3_2 ----------

python_3_script_24 = Python3Script(
    nxx=s_forces_2.Nxx_kN_m,
    nyy=s_forces_2.Nyy_kN_m,
    nxy=s_forces_2.Nxy_kN_m,
    mxx=s_forces_2.Mxx_kNm_m,
    myy=s_forces_2.Myy_kNm_m,
    mxy=s_forces_2.Mxy_kNm_m,
    H=python_3_script_21,
    u=subtraction_4,
    v=subtraction_3,
    X=deconstruct.XComponent,
    Y=deconstruct.YComponent,
    visualisation=boolean_toggle_2)  # -> Nxx, Nyy, Nxy, Mxx, Myy, Mxy, simplify(graft(H)), X, Y; inputs nxx: list of Double, nyy: list of Double, nxy: list of Double, mxx: list of Double, myy: list of Double, mxy: list of Double, H: list of Double, u: Int32, v: Int32, X: list of Double, Y: list of Double, visualisation: Boolean
# ---------- python_3_script_24: Python ----------
'''
this is the 2.0 version of the previous code. Here we only added the cleaning function which allows us to remove the edge Finite elements in order to get only higher values near the corners.


NB. inputs u and v are the number of divisions of the mesh!
 We need to remove 2 elements, because the previous code adds 2 elements
now u and v are 17

'''


#Metodo poco ortodosso!
X = X + X
Y = Y + Y 

for i in range(len(H)):
    H[i] = H[i] / 100


def cleaning(a, A):
    Bool = []
    count = 1
    for i in range(len(a)):
        Bool.append(True)
    
    for j in range(int(len(a) / 2)):
        
        if j < v:
            Bool[j] = False
            Bool[j + int(len(a) / 2)] = False
        elif j >= v:
            if j % v == 0:
                Bool[j] = False
                Bool[j + int(len(a) / 2)] = False
            elif j == (v - 1) + count * v:
                Bool[j] = False
                Bool[j + int(len(a) / 2)] = False
                count += 1
            elif j > (int(len(a) / 2) - v) and j < int(len(a) / 2):
                Bool[j] = False
                Bool[j + int(len(a) / 2)] = False

    A = []
    for t in range(len(Bool)):
        if Bool[t] is True:
            A.append(a[t])
        #elif Bool[t] is False:
            #print(t)
    return A



Nxx_clean = []
Nyy_clean = []
Nxy_clean = []
Mxx_clean = []
Myy_clean = []
Mxy_clean = []
H_clean = []
X_clean = []
Y_clean = []



Nxx_clean = cleaning(nxx, Nxx_clean)
Nyy_clean = cleaning(nyy, Nyy_clean)
Nxy_clean = cleaning(nxy, Nxy_clean)
Mxx_clean = cleaning(mxx, Mxx_clean)
Myy_clean = cleaning(myy, Myy_clean)
Mxy_clean = cleaning(mxy, Mxy_clean)
H_clean = cleaning(H, H_clean)
X_clean = cleaning(X, X_clean)
Y_clean = cleaning(Y, Y_clean)




c = int(len(Nxx_clean) / 2) #Obviously I could replace nxx with nxy or nyy, it was the same, I just needed the 12000 integer. 

Nxx = []
for i in range(c):
    Nxx.append((Nxx_clean[i] + Nxx_clean[i + c]) / 2)
Nyy = []
for i in range(c):
    Nyy.append((Nyy_clean[i] + Nyy_clean[i + c]) / 2)
Nxy = []
for i in range(c):
    Nxy.append((Nxy_clean[i] + Nxy_clean[i + c]) / 2)

Mxx = []
for i in range(c):
    Mxx.append((Mxx_clean[i] + Mxx_clean[i + c]) / 2)
Myy = []
for i in range(c):
    Myy.append((Myy_clean[i] + Myy_clean[i + c]) / 2)
Mxy = []
for i in range(c):
    Mxy.append((Mxy_clean[i] + Mxy_clean[i + c]) / 2)
H = []
for i in range(c):
    H.append((H_clean[i] + H_clean[i + c]) / 2)


X = []
for i in range(c):
    X.append((X_clean[i] + X_clean[i + c]) / 2)
Y = []
for i in range(c):
    Y.append((Y_clean[i] + Y_clean[i + c]) / 2)





## PLOT ##

if visualisation is True:
    u_clean = u - 2
    v_clean = v - 2
    print(len(X))
    x = []
    i = 0
    while i < len(X):
        x.append(X[i])
        i += v_clean
        print(i)

    y = []
    i = 0
    while i < v_clean:
        y.append(Y[i])
        i += 1

    
    def f(count, N):
        a = []
        lim1 = count
        lim2 = len(Nxx) - (v_clean - 1) + count
        j = lim1
        while j <= lim2:
            a.append(N[j])
            j += v_clean
        return a


    Nxx_plot = []
    Nyy_plot = []
    Nxy_plot = []
    Mxx_plot = []
    Myy_plot = []
    Mxy_plot = []
    H_plot = []
    count = 0
    for i in range(v_clean):
        Nxx_plot.append(f(count, Nxx))
        Nyy_plot.append(f(count, Nyy))
        Nxy_plot.append(f(count, Nxy))
        Mxx_plot.append(f(count, Mxx))
        Myy_plot.append(f(count, Myy))
        Mxy_plot.append(f(count, Mxy))
        H_plot.append(f(count, H))
        count += 1


    

    
    

    
    Plot = [x, y, Nxx_plot, Nyy_plot, Nxy_plot, Mxx_plot, Myy_plot, Mxy_plot, H_plot, visualisation]

else:
    Plot = []



'''4. Plot the three graphs by using matplotlib.
Further informations: 
- https://matplotlib.org/stable/api/_as_gen/matplotlib.pyplot.contourf.html  (contour filled)
- https://matplotlib.org/stable/api/_as_gen/matplotlib.pyplot.contour.html  (contour)

Very interesting tutorial:
https://www.youtube.com/watch?v=jzOjn6wrmY0 (Matplotlib Tutorial - Part 13: Contour Plots [Amir Charkhi])


'''


if len(Plot) != 0:
    x = Plot[0]
    y = Plot[1]
    Nxx_plot = Plot[2]
    Nyy_plot = Plot[3]
    Nxy_plot = Plot[4]
    Mxx_plot = Plot[5]
    Myy_plot = Plot[6]
    Mxy_plot = Plot[7]
    H_plot = Plot[8]
    visualisation = Plot[9]


    if visualisation is True:

        import matplotlib.pyplot as plt
        import numpy as np


        x_lim = max(X) + min(X)
        y_lim = max(Y) + min(Y)

        x = np.array(x)
        y = np.array(y)
        Nxx_plot = np.array(Nxx_plot)
        Nyy_plot = np.array(Nyy_plot)
        Nxy_plot = np.array(Nxy_plot)
        Mxx_plot = np.array(Mxx_plot)
        Myy_plot = np.array(Myy_plot)
        Mxy_plot = np.array(Mxy_plot)
    

        H_plot = np.array(H_plot)

        
       
        
        
        plt.figure(figsize=(10,5))
        plt.contour(x, y, Nxx_plot, colors="black", alpha=0.7, linewidths=0.5, linestyles="solid")
        cs = plt.contourf(x, y, Nxx_plot, cmap="Blues_r")
        plt.colorbar(cs)
        plt.title("Normal forces in X direction - $N_{xx}$[kN/m]", fontsize=16)
        plt.xlabel("X [m]")
        plt.ylabel("Y [m]")
        plt.xlim(0, x_lim)
        plt.ylim(0, y_lim)
        #plt.xticks([0,4,8,12,16,20])
        #plt.ylim(0, 20)


        plt.figure(figsize=(10,5))
        plt.contour(x, y, Nyy_plot, colors="black", alpha=0.7, linewidths=0.5, linestyles="solid")
        cs = plt.contourf(x, y, Nyy_plot, cmap="Reds_r")
        plt.colorbar(cs)
        plt.title("Normal forces in Y direction - $N_{yy}$[kN/m]", fontsize=16)
        plt.xlabel("X [m]")
        plt.ylabel("Y [m]")
        #plt.xticks([0,4,8,12,16,20])
        #plt.ylim(0, 20)
        plt.xlim(0, x_lim)
        plt.ylim(0, y_lim)


        plt.figure(figsize=(10,5))
        plt.contour(x, y, Nxy_plot, colors="black", alpha=0.7, linewidths=0.5, linestyles="solid")
        cs = plt.contourf(x, y, Nxy_plot, cmap="Greens_r")
        plt.colorbar(cs)
        plt.title("Shear forces in XY plane - $N_{xy}$[kN/m]", fontsize=16)
        plt.xlabel("X [m]")
        plt.ylabel("Y [m]")
        #plt.xticks([0,4,8,12,16,20])
        #plt.ylim(0, 20)
        plt.xlim(0, x_lim)
        plt.ylim(0, y_lim)


        plt.figure(figsize=(10,5))
        plt.contour(x, y, Mxx_plot, colors="black", alpha=0.7, linewidths=0.5, linestyles="solid")
        cs = plt.contourf(x, y, Mxx_plot, cmap="Blues_r")
        plt.colorbar(cs)
        plt.title("Bending Moment in X direction - $M_{xx}$[kN.m/m]", fontsize=16)
        plt.xlabel("X [m]")
        plt.ylabel("Y [m]")
        #plt.xticks([0,4,8,12,16,20])
        #plt.ylim(0, 20)
        plt.xlim(0, x_lim)
        plt.ylim(0, y_lim)


        plt.figure(figsize=(10,5))
        plt.contour(x, y, Myy_plot, colors="black", alpha=0.7, linewidths=0.5, linestyles="solid")
        cs = plt.contourf(x, y, Myy_plot, cmap="Blues_r")
        plt.colorbar(cs)
        plt.title("Bending Moment in Y direction - $M_{yy}$[kN.m/m]", fontsize=16)
        plt.xlabel("X [m]")
        plt.ylabel("Y [m]")
        #plt.xticks([0,4,8,12,16,20])
        #plt.ylim(0, 20)
        plt.xlim(0, x_lim)
        plt.ylim(0, y_lim)


        plt.figure(figsize=(10,5))
        plt.contour(x, y, Mxy_plot, colors="black", alpha=0.7, linewidths=0.5, linestyles="solid")
        cs = plt.contourf(x, y, Mxy_plot, cmap="Blues_r")
        plt.colorbar(cs)
        plt.title("Torsion Moment - $M_{xy}$[kN.m/m]", fontsize=16)
        plt.xlabel("X [m]")
        plt.ylabel("Y [m]")
        #plt.xticks([0,4,8,12,16,20])
        #plt.ylim(0, 20)
        plt.xlim(0, x_lim)
        plt.ylim(0, y_lim)


        plt.figure(figsize=(10,5))
        plt.contour(x, y, H_plot, colors="black", alpha=0.7, linewidths=0.5, linestyles="solid")
        cs = plt.contourf(x, y, H_plot, cmap="Blues_r")
        plt.colorbar(cs)
        plt.title("Thickness of the shell - $t$[m]", fontsize=16)
        plt.xlabel("X [m]")
        plt.ylabel("Y [m]")
        #plt.xticks([0,4,8,12,16,20])
        #plt.ylim(0, 20)
        plt.xlim(0, x_lim)
        plt.ylim(0, y_lim)


        plt.show()
# ---------- end python_3_script_24 ----------
merge = Merge(
    Data1=simplify(graft(python_3_script_24.Nxx)),
    Data2=simplify(graft(python_3_script_24.Nyy)),
    Data3=simplify(graft(python_3_script_24.Nxy)))
# NEW! 03/09/2025
# Thickness in m
merge_2 = Merge(
    Data1=simplify(graft(python_3_script_24.Mxx)),
    Data2=simplify(graft(python_3_script_24.Myy)),
    Data3=simplify(graft(python_3_script_24.Mxy)))
panel_18 = Panel(python_3_script_24.H)
python_3_script_25 = Python3Script(X=python_3_script_24.X, Y=python_3_script_24.Y, v=subtraction_3, u=subtraction_4, Nxx=python_3_script_24.Nxx)  # -> a; inputs X: list of Double, Y: list of Double, v: Int32, u: Int32, Nxx: list; disabled
# ---------- python_3_script_25: Python ----------
import numpy as np
import matplotlib.pyplot as plt

'''
visualisation = True
if visualisation is True:
    u_clean = u - 2
    v_clean = v - 2
    x = []
    i = 0
    while i < len(X):
        x.append(X[i])
        i += v_clean

    y = []
    i = 0
    while i < v_clean:
        y.append(Y[i])
        i += 1


#print(x)
#print(y)


print(len(x))
print(len(y))





def f(count, N):
        a = []
        lim1 = count
        lim2 = len(Nxx) - (v_clean - 1) + count
        j = lim1
        while j <= lim2:
            a.append(N[j])
            j += v_clean
        return a


Nxx_plot = []

count = 0
for i in range(v_clean):
    Nxx_plot.append(f(count, Nxx))
    count += 1

'''

#print(Nxx_plot)

fig1, axs1 = plt.subplots(2, 1)
fig2, axs2 = plt.subplots(2, 1)
fig3, axs3 = plt.subplots(1,1)

#plt.figure(fig1, figsize=(5, 5))

#plt.show()

Lx = 15
Ly = 25
Nxx_plot = []
yy = 5
count = yy
while len(Nxx_plot) < Lx:
    Nxx_plot.append(Nxx[count])
    count += Ly




print(Nxx_plot)
c = Nxx_plot
c= np.array(c)

#plt.figure(figsize=(3,3))
#plt.plot(c)


#plt.show()

'''
i = 8
a = y[i]
b = y

c = Nxx_plot[i]


#a = np.array(a)
#b = np.array(b)
#c = np.array(c)
#plt.plot(c)
#plt.show()


plt.figure(figsize=(3,3))
plt.plot(c)
#plt.contour(x, y, Nxx_plot, colors="black", alpha=0.7, linewidths=0.5, linestyles="solid")
#cs = plt.contourf(x, y, Nxx_plot, cmap="Blues_r")
#plt.colorbar(cs)
plt.title("Normal forces in X direction - $N_{xx}$[kN/m]", fontsize=16)
plt.xlabel("X [m]")
plt.ylabel("Y [m]")
#plt.xlim(0, x_lim)
#plt.ylim(0, y_lim)
#plt.xticks([0,4,8,12,16,20])
        #plt.ylim(0, 20)
plt.show()'''
# ---------- end python_3_script_25 ----------

panel_19 = Panel(assemble.Mass_kg)

# ----
# New Code - 15_09_25!
# Backup
python_3_script_26 = Python3Script(Top=python_3_script_18, Bottom=python_3_script_19, j=Slider(0, range=0..50))  # -> points, B; inputs Top: list, Bottom: list, j: Int32
# ---------- python_3_script_26: Python ----------
import Rhino as rc

Vertices_top = Top[0]
CornerA_top = Top[1]
CornerB_top = Top[2]
CornerC_top = Top[3]
CornerD_top = Top[4]



Vertices_bottom = Bottom[0]
CornerA_bottom = Bottom[1]
CornerB_bottom = Bottom[2]
CornerC_bottom = Bottom[3]
CornerD_bottom = Bottom[4]


points_top = [Vertices_top[CornerA_top[j]], Vertices_top[CornerB_top[j]],Vertices_top[CornerC_top[j]], Vertices_top[CornerD_top[j]]]

points_bottom = [Vertices_bottom[CornerA_bottom[j]], Vertices_bottom[CornerB_bottom[j]],Vertices_bottom[CornerC_bottom[j]], Vertices_bottom[CornerD_bottom[j]]]

points = points_top + points_bottom


surf1 = rc.Geometry.NurbsSurface.CreateFromCorners(points[0], points[1], points[2], points[3])
surf2 = rc.Geometry.NurbsSurface.CreateFromCorners(points[4], points[5], points[6], points[7])
surf3 = rc.Geometry.NurbsSurface.CreateFromCorners(points[0], points[1], points[5], points[4])
surf4 = rc.Geometry.NurbsSurface.CreateFromCorners(points[3], points[7], points[6], points[2])
surf5 = rc.Geometry.NurbsSurface.CreateFromCorners(points[1], points[2], points[6], points[5])
surf6 = rc.Geometry.NurbsSurface.CreateFromCorners(points[7], points[4], points[0], points[3])


surf1 = rc.Geometry.Brep.CreateFromSurface(surf1)
surf2 = rc.Geometry.Brep.CreateFromSurface(surf2)
surf3 = rc.Geometry.Brep.CreateFromSurface(surf3)
surf4 = rc.Geometry.Brep.CreateFromSurface(surf4)
surf5 = rc.Geometry.Brep.CreateFromSurface(surf5)
surf6 = rc.Geometry.Brep.CreateFromSurface(surf6)


s = [surf1, surf2, surf3, surf4, surf5, surf6]
B = rc.Geometry.Brep.CreateSolid(s,0.001)
# ---------- end python_3_script_26 ----------
brep_6 = Brep(python_3_script_26.B)
point_list_3 = PointList(Points=python_3_script_26.points)

panel_20 = Panel(python_3_script_22.Total_Volume)
panel_21 = Panel(python_3_script_21)
item = ListItem(List=addition, Index=1, Wrap=True)  # -> flatten(Item)

expression = Expression(x=panel_19, y="0", Expression="If(x=y, 1000000000, 0)")
panel_22 = Panel(expression)

m_cls_kg = Panel(assemble.Mass_kg)
ec_col = Panel(py3.EC_Col)

frp_design = Python3Script(
    N=merge,
    M=merge_2,
    H=python_3_script_24.H,
    L_x=length_x_direction,
    n_x=discritization_in_x,
    L_y=length_y_direction,
    n_y=discritization_in_y,
    Mass_c=multiplication_7,
    RF=react_2.ReactionForces_kN)  # -> out, message, EC_c, EC_GFRP, EC_Col, Axtr, Axbr, Aytr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; inputs Geo: Double, Prop: Double, N: list of Double, M: list of Double, XYZ: Double, L_x: Double, n_x: Double, L_y: Double, n_y: Double, Mass_c: Double
# ---------- frp_design: Python ----------
"""Grasshopper Script"""
#Design Optimization of Shell with FRP Reinforcement
import numpy as np
from scipy.optimize import minimize
import numpy as np
from scipy.optimize import minimize

from sympy import Eq, Symbol, solve
from sympy import tan
import math
from sympy import symbols, solve

Norm = np.linalg.norm(N,ord=2)
tol = Norm*0.01
print(tol)
Objective_0=Norm*10**9

# units are kN and m

Nx=N[0]
Ny=N[1]
Nxy=N[2]
Mx=-M[0]
My=-M[1]
Mxy=M[2]

# Reaction Forces (at Corners) in X- and Y-Directions
Rx = RF[0]
Ry = RF[1]
Rz = RF[2]

# INPUT DATA

fc  = 35000      # Cylindrical compressive strength of concrete (kN/m2)
fckcube  = 45000     # Cubic compressive strength of concrete (kN/m2)
fcd  = 1* fc / 1.5      #  Design compressive strength of concrete (kN/m2)
# Note: the 0.85 is given as 1 in the Eurocode
fcd1 = 0.85 * (1 - (fc / 1000) / 250) * fcd   # For uncracked zones
fcd2 = 0.6  * (1 - (fc / 1000) / 250) * fcd   # For cracked zones
ftc=fcd2
fbc=fcd2
Gamma_c = 2500          #  kg/m3
ECF_c = 0.13            #  kgCO2e/kg (Hammond et al., 2011)
print(fcd1,fcd2)
h = H         #  Shell thickness (m)
# fu_GFRP = 500000        #  kN/m2
ffu = 1000000     #Ultimate tensile strength of FRP rebars (kN/m2)
CE = 0.7          #Environmental reduction factor for glass FRP (concrete exposed to weather and earth)
Phi1 = 0.55       #Strength reduction factor for tension-controlled design
Phi2 = 0.65       #Strength reduction factor for compression-controlled design
ffd = CE * Phi2 * ffu #Design tensile strength of FRP rebars for tension-controlled section (kN/m2) (ACI 440.1R-15 Page 19) 
# ffd = 550000      #Design tensile strength of FRP rebars (kN/m2) 0.55*ffu (ACI 440.1R-15 Page 19) 
print(ffd)
E_BFRP = 50000000        #  kN/m2
Gamma_FRP = 1900       #  kg/m3 
ECF_BFRP = 2            #  kgCO2e/kg (Initial Value)
ECF_GFRP = 2.7          #  kgCO2e/kg (Initial Value)
# h = 0.1                 #  m
c= 0.015                #  m
hxt = (h-2*c)/2         #  m
hxb = (h-2*c)/2         #  m
hyt = (h-2*c)/2         #  m
hyb = (h-2*c)/2         #  m

# FORCES IN REINFORCEMENT BASED ON EQUILIBRIUM IN FUNCTION OF 
#x[0]   # Theta t (crack direction at top)
#x[1]   # Theta b (crack direction at bottom)
#x[2]   # at      (depth of compressive stress block at top)
#x[3]   # ab      (depth of compressive stress block at bottom)


def Nxtr(x):
    return max(((hxb*Nx-Mx)/(hxt+hxb)+((hxb+(h-x[2])/2)/(hxt+hxb))*x[2]*ftc*(np.sin(x[0]))**2+((hxb-(h-x[3])/2)/(hxt+hxb))*x[3]*fbc*(np.sin(x[1]))**2),0)

def Nxbr(x):
    return max(((hxt*Nx+Mx)/(hxt+hxb)+((hxt-(h-x[2])/2)/(hxt+hxb))*x[2]*ftc*(np.sin(x[0]))**2+((hxt+(h-x[3])/2)/(hxt+hxb))*x[3]*fbc*(np.sin(x[1]))**2),0)

def Nytr(x):
    return max(((hyb*Ny-My)/(hyt+hyb)+((hyb+(h-x[2])/2)/(hyt+hyb))*x[2]*ftc*(np.cos(x[0]))**2+((hyb-(h-x[3])/2)/(hyt+hyb))*x[3]*fbc*(np.cos(x[1]))**2),0)

def Nybr(x):
    return max(((hyt*Ny+My)/(hyt+hyb)+((hyt-(h-x[2])/2)/(hyt+hyb))*x[2]*ftc*(np.cos(x[0]))**2+((hyt+(h-x[3])/2)/(hyt+hyb))*x[3]*fbc*(np.cos(x[1]))**2),0)

def Objective(x):
    return abs(Nxtr(x))+abs(Nxbr(x))+abs(Nytr(x))+abs(Nybr(x))

S=[[1,1],[1,-1],[-1,1],[-1,-1]]

s=0
x0 = np.zeros(4)

while s < 4:
    
    # initial guesses

    st=S[s][0]
    sb=S[s][1]
    x0[0] = st*3.14/4   # Theta top (th_t)
    x0[1] = sb*3.14/4   # Theta bottom (th_b)
    x0[2] = 0.2*h       # at
    x0[3] = 0.2*h       # ab

    #bounds
    
    if x0[0]>0:
        th_bounds_t = (0,1.57)
    else:
        th_bounds_t = (-1.57,0)
    
    if x0[1]>0:
        th_bounds_b = (0,1.57)
    else:
        th_bounds_b = (-1.57,0)


    a_bounds = (0.1*h,0.99*h)

    B = (th_bounds_t, th_bounds_b, a_bounds, a_bounds)

    #EQUILIBRIUM EQUATIONS

    def Nx_f(x):
        return (((hxb*Nx-Mx)/(hxt+hxb)+((hxb+(h-x[2])/2)/(hxt+hxb))*x[2]*ftc*(np.sin(x[0]))**2+((hxb-(h-x[3])/2)/(hxt+hxb))*x[3]*fbc*(np.sin(x[1]))**2)\
            +((hxt*Nx+Mx)/(hxt+hxb)+((hxt-(h-x[2])/2)/(hxt+hxb))*x[2]*ftc*(np.sin(x[0]))**2+((hxt+(h-x[3])/2)/(hxt+hxb))*x[3]*fbc*(np.sin(x[1]))**2)\
                +(-x[2]*fc)*(np.sin(x[0]))**2 + (-x[3]*fc)*(np.sin(x[1]))**2-Nx)

    def Ny_f(x):
        return (((hyb*Ny-My)/(hyt+hyb)+((hyb+(h-x[2])/2)/(hyt+hyb))*x[2]*ftc*(np.cos(x[0]))**2+((hyb-(h-x[3])/2)/(hyt+hyb))*x[3]*fbc*(np.cos(x[1]))**2)\
                +((hyt*Ny+My)/(hyt+hyb)+((hyt-(h-x[2])/2)/(hyt+hyb))*x[2]*ftc*(np.cos(x[0]))**2+((hyt+(h-x[3])/2)/(hyt+hyb))*x[3]*fbc*(np.cos(x[1]))**2)\
                    + (-x[2]*fc)*(np.cos(x[0]))**2 + (-x[3]*fc)*(np.cos(x[1]))**2-Ny)

    def Nxy_f(x):
        return (x[2]*fc*np.sin(x[0])*np.cos(x[0]) + x[3]*fc*np.sin(x[1])*np.cos(x[1])-Nxy)

    def Mx_f(x):
        return (-((hxb*Nx-Mx)/(hxt+hxb)+((hxb+(h-x[2])/2)/(hxt+hxb))*x[2]*ftc*(np.sin(x[0]))**2+((hxb-(h-x[3])/2)/(hxt+hxb))*x[3]*fbc*(np.sin(x[1]))**2)*hxt+\
                ((hxt*Nx+Mx)/(hxt+hxb)+((hxt-(h-x[2])/2)/(hxt+hxb))*x[2]*ftc*(np.sin(x[0]))**2+((hxt+(h-x[3])/2)/(hxt+hxb))*x[3]*fbc*(np.sin(x[1]))**2)*hxb\
                    + x[2]*fc*((h-x[2])/2)*(np.sin(x[0]))**2 - x[3]*fc*((h-x[3])/2)*(np.sin(x[1]))**2-Mx)

    def My_f(x):
        return (-((hyb*Ny-My)/(hyt+hyb)+((hyb+(h-x[2])/2)/(hyt+hyb))*x[2]*ftc*(np.cos(x[0]))**2+((hyb-(h-x[3])/2)/(hyt+hyb))*x[3]*fbc*(np.cos(x[1]))**2)*hyt+\
                    ((hyt*Ny+My)/(hyt+hyb)+((hyt-(h-x[2])/2)/(hyt+hyb))*x[2]*ftc*(np.cos(x[0]))**2+((hyt+(h-x[3])/2)/(hyt+hyb))*x[3]*fbc*(np.cos(x[1]))**2)*hyb\
                        + x[2]*fc*(h-x[2])/2*(np.cos(x[0]))**2 - x[3]*fc*(h-x[3])/2*(np.cos(x[1]))**2-My)
    
    def Mxy_f(x):
        return (-x[2]*fc*(h-x[2])/2*np.sin(x[0])*np.cos(x[0]) + x[3]*fc*(h-x[3])/2*np.sin(x[1])*np.cos(x[1])-Mxy)

    def h_f(x):
        return h-x[2]-x[3]

    con1 = {'type': 'eq', 'fun': Nxy_f}
    con2 = {'type': 'eq', 'fun': Mxy_f}
    con3 = {'type': 'ineq', 'fun': h_f}

    cons = ([con1,con2,con3])

    solution = minimize(Objective,x0,method='SLSQP',bounds=B,constraints=cons,options={'disp':False,'ftol':tol})

    x0_s = solution.x

    # if(solution.message=='Optimization terminated successfully'):
    if(solution.message=='Optimization terminated successfully' and Objective(x0_s)<Objective_0):        
        x0_i = x0
        message=solution.message
        print(x0_i)
        x0_f = x0_s
 
    s=s+1



print(message)
print(x0_f)
# print(Objective(x0_f))

print(Nx_f)
print(Ny_f)
print(Nxy_f)
print(Mx_f)
print(My_f)
print(Mxy_f)

print(Nxtr)
print(Nxbr)
print(Nytr)
print(Nybr)

V_c = L_x * L_y * h
W_c = V_c * Gamma_c
EC_c = ECF_c * W_c
print (W_c)
print (EC_c)

EC_c = ECF_c * Mass_c
print (Mass_c)
print (EC_c)

Axtr = max((Nxtr(x0_f) / ffd, 0.0018 * L_y / n_y * (h - c)))   #Minimum reinforcement area (0.0018bd)
# Axtr = Nxtr(x0_f) / ffd
Vxtr = Axtr * L_x / n_x
Wxtr = Vxtr * Gamma_FRP
ECxtr_FRP = Wxtr * ECF_GFRP

Axbr = max((Nxbr(x0_f) / ffd, 0.0018 * L_y / n_y * (h - c)))   #Minimum reinforcement area (0.0018bd)
# Axbr = Nxbr(x0_f) / ffd
Vxbr = Axbr * L_x / n_x
Wxbr = Vxbr * Gamma_FRP
ECxbr_FRP = Wxbr * ECF_GFRP

Aytr = max((Nytr(x0_f) / ffd, 0.0018 * L_x / n_x * (h - c)))   #Minimum reinforcement area (0.0018bd)
# Aytr = Nytr(x0_f) / ffd
Vytr = Aytr * L_y / n_y
Wytr = Vytr * Gamma_FRP
ECytr_FRP = Wytr * ECF_GFRP

Aybr = max((Nybr(x0_f) / ffd, 0.0018 * L_x / n_x * (h - c)))   #Minimum reinforcement area (0.0018bd)
# Aybr = Nybr(x0_f) / ffd
Vybr = Aybr * L_y / n_y
Wybr = Vybr * Gamma_FRP
ECybr_FRP = Wybr * ECF_GFRP

# print(Nx_f(x0_f))
# print(Ny_f(x0_f))
# print(Nxy_f(x0_f))
# print(Mx_f(x0_f))
# print(My_f(x0_f))
# print(Mxy_f(x0_f))

# print(Nxtr(x0_f))
# print(Nxbr(x0_f))
# print(Nytr(x0_f))
# print(Nybr(x0_f))

# V_c = L_x * L_y * h
# W_c = V_c * Gamma_c
# EC_c = ECF_c * W_c
# print (W_c)
# print (EC_c)

# EC_c = ECF_c * Mass_c
# print (Mass_c)
# print (EC_c)

# Axtr = max((Nxtr(x0_f) / ffd, 0.0018 * L_y / n_y * (h - c)))   #Minimum reinforcement area (0.0018bd)
# # Axtr = Nxtr(x0_f) / ffd
# Vxtr = Axtr * L_x / n_x
# Wxtr = Vxtr * Gamma_FRP
# ECxtr_FRP = Wxtr * ECF_GFRP

# Axbr = max((Nxbr(x0_f) / ffd, 0.0018 * L_y / n_y * (h - c)))   #Minimum reinforcement area (0.0018bd)
# # Axbr = Nxbr(x0_f) / ffd
# Vxbr = Axbr * L_x / n_x
# Wxbr = Vxbr * Gamma_FRP
# ECxbr_FRP = Wxbr * ECF_GFRP

# Aytr = max((Nytr(x0_f) / ffd, 0.0018 * L_x / n_x * (h - c)))   #Minimum reinforcement area (0.0018bd)
# # Aytr = Nytr(x0_f) / ffd
# Vytr = Aytr * L_y / n_y
# Wytr = Vytr * Gamma_FRP
# ECytr_FRP = Wytr * ECF_GFRP

# Aybr = max((Nybr(x0_f) / ffd, 0.0018 * L_x / n_x * (h - c)))   #Minimum reinforcement area (0.0018bd)
# # Aybr = Nybr(x0_f) / ffd
# Vybr = Aybr * L_y / n_y
# Wybr = Vybr * Gamma_FRP
# ECybr_FRP = Wybr * ECF_GFRP



# EC_TB = ECrxTB + ECryTB + ECrdiagonalTB

# Total

EC_GFRP = ECxtr_FRP + ECxbr_FRP + ECytr_FRP + ECybr_FRP


print(Axbr)
print(Aybr)
print(Axtr)
print(Aytr)
at=x0_f[2]
ab=x0_f[3]
# ---------- end frp_design ----------
flatten_tree = FlattenTree(Tree=frp_design.Axtr, Path="{0}")
flatten_tree_2 = FlattenTree(Tree=frp_design.Axbr, Path="{0}")
flatten_tree_3 = FlattenTree(Tree=frp_design.Aytr, Path="{0}")
flatten_tree_4 = FlattenTree(Tree=frp_design.Aybr, Path="{0}")
embodied_carbon_of_concrete = Panel(frp_design.EC_c)
panel_23 = Panel(flatten_tree)
ma = MassAddition(Input=flatten(embodied_carbon_of_concrete))  # -> Result, PartialResults
lng = ListLength(List=flatten(embodied_carbon_of_concrete))
division_4 = Division(A=ma.Result, B=lng)
ec_due_to_concrete = Panel(division_4)
ec_due_to_columns = Panel(py3.EC_Col)

panel_24 = Panel(frp_design.at)
panel_25 = Panel(frp_design.ab)

# ----
# MIRRORED
# NON-MIRRORED
boolean_toggle_3 = BooleanToggle(False)
# REINFORCEMENT PLOT
python_3_script_27 = Python3Script(
    X=python_3_script_24.X,
    Y=python_3_script_24.Y,
    v=subtraction,
    Axbr=flatten_tree_2,
    Aybr=flatten_tree_4,
    Axtr=flatten_tree,
    Aytr=flatten_tree_3,
    visualisation=boolean_toggle_3)  # inputs X: list of Double, Y: list of Double, v: Int32, Axbr: list of Double, Aybr: list of Double, Axtr: list of Double, Aytr: list of Double, visualisation: Boolean
# ---------- python_3_script_27: Python ----------
if visualisation is True:

    import numpy as np
    import matplotlib.pyplot as plt


    def f(count, N):
        a = []
        lim1 = count
        lim2 = len(N) - (v - 1) + count
        j = lim1
        while j <= lim2:
            a.append(N[j])
            j += v
        return a


    Axtr_plot = []
    Aytr_plot = []
    Axbr_plot = []
    Aybr_plot = []
    count = 0
    for i in range(v):
        Axtr_plot.append(f(count, Axtr))
        Axbr_plot.append(f(count, Axbr))
        Aytr_plot.append(f(count, Aytr))
        Aybr_plot.append(f(count, Aybr))
        count += 1

        
    x = []
    i = 0
    while i < len(X):
        x.append(X[i])
        i += v

    y = []
    i = 0
    while i < v:
        y.append(Y[i])
        i += 1

    x = np.array(x)
    y = np.array(y)


    x_lim = max(X) + min(X)
    y_lim = max(Y) + min(Y)

    

    Axtr_plot = np.array(Axtr_plot)
    Axbr_plot = np.array(Axbr_plot)
    Aytr_plot = np.array(Aytr_plot)
    Aybr_plot = np.array(Aybr_plot)

    plt.figure(figsize=(12,6))
    font1 = {'family':'times new roman','color':'black','size':19}
    font2 = {'family':'times new roman','color':'black','size':20}
    plt.contour(x, y, Axbr_plot, colors="black", alpha=0.7, linewidths=0.5, linestyles="solid")
    #levels = [40, 50, 60, 70]
    cs = plt.contourf(x, y, Axbr_plot, cmap="Reds")
    plt.colorbar(cs)
    plt.title("Reinforcement Area in X direction (Bottom) - $\mathregular{A_{xbr}}$ (m²/m)", fontdict = font1)
    plt.xlabel("X (m)", fontdict = font2)
    plt.ylabel("Y (m)", fontdict = font2)
    #plt.xticks([0,4,8,12,16,20])
    #plt.yticks([0,2,4,6,8,10,12])
    plt.xticks(fontname = 'times new roman', fontsize=20)
    plt.yticks(fontname = 'times new roman', fontsize=20)
    plt.ylim(0, round(y_lim))
    plt.xlim(0, round(x_lim))




    plt.figure(figsize=(12,6))
    font1 = {'family':'times new roman','color':'black','size':19}
    font2 = {'family':'times new roman','color':'black','size':20}
    plt.contour(x, y, Axtr_plot, colors="black", alpha=0.7, linewidths=0.5, linestyles="solid")
    #levels = [40, 50, 60, 70]
    cs = plt.contourf(x, y, Axtr_plot, cmap="Reds")
    plt.colorbar(cs)
    plt.title("Reinforcement Area in X direction (Top) - $\mathregular{A_{xtr}}$ (m²/m)", fontdict = font1)
    plt.xlabel("X (m)", fontdict = font2)
    plt.ylabel("Y (m)", fontdict = font2)
    #plt.xticks([0,4,8,12,16,20])
    #plt.yticks([0,2,4,6,8,10,12])
    plt.xticks(fontname = 'times new roman', fontsize=20)
    plt.yticks(fontname = 'times new roman', fontsize=20)
    plt.ylim(0, round(y_lim))
    plt.xlim(0, round(x_lim))


    plt.figure(figsize=(12,6))
    font1 = {'family':'times new roman','color':'black','size':19}
    font2 = {'family':'times new roman','color':'black','size':20}
    plt.contour(x, y, Aybr_plot, colors="black", alpha=0.7, linewidths=0.5, linestyles="solid")
    #levels = [40, 50, 60, 70]
    cs = plt.contourf(x, y, Aybr_plot, cmap="Reds")
    plt.colorbar(cs)
    plt.title("Reinforcement Area in Y direction (Bottom) - $\mathregular{A_{ybr}}$ (m²/m)", fontdict = font1)
    plt.xlabel("X (m)", fontdict = font2)
    plt.ylabel("Y (m)", fontdict = font2)
    #plt.xticks([0,4,8,12,16,20])
    #plt.yticks([0,2,4,6,8,10,12])
    plt.xticks(fontname = 'times new roman', fontsize=20)
    plt.yticks(fontname = 'times new roman', fontsize=20)
    plt.ylim(0, round(y_lim))
    plt.xlim(0, round(x_lim))


    plt.figure(figsize=(12,6))
    font1 = {'family':'times new roman','color':'black','size':19}
    font2 = {'family':'times new roman','color':'black','size':20}
    plt.contour(x, y, Aytr_plot, colors="black", alpha=0.7, linewidths=0.5, linestyles="solid")
    #levels = [40, 50, 60, 70]
    cs = plt.contourf(x, y, Aytr_plot, cmap="Reds")
    plt.colorbar(cs)
    plt.title("Reinforcement Area in Y direction (Top) - $\mathregular{A_{ytr}}$ (m²/m)", fontdict = font1)
    plt.xlabel("X (m)", fontdict = font2)
    plt.ylabel("Y (m)", fontdict = font2)
    #plt.xticks([0,4,8,12,16,20])
    #plt.yticks([0,2,4,6,8,10,12])
    plt.xticks(fontname = 'times new roman', fontsize=20)
    plt.yticks(fontname = 'times new roman', fontsize=20)
    plt.ylim(0, round(y_lim))
    plt.xlim(0, round(x_lim))



    plt.show()
# ---------- end python_3_script_27 ----------
python_3_script_28 = Python3Script(
    X=python_3_script_24.X,
    Y=python_3_script_24.Y,
    v=ly_total_span_m,
    Axbr=flatten_tree_2,
    Aybr=flatten_tree_4,
    Axtr=flatten_tree,
    Aytr=flatten_tree_3,
    visualisation=Toggle(False))  # -> Axtr, Aytr, Axbr, Aybr; inputs X: list of Double, Y: list of Double, v: Int32, Axbr: list of Double, Aybr: list of Double, Axtr: list of Double, Aytr: list of Double, visualisation: Boolean
# ---------- python_3_script_28: Python ----------
#import pandas as pd
import numpy as np



def f(count, N):
    a = []
    lim1 = count
    lim2 = len(N) - (v - 1) + count
    j = lim1
    while j <= lim2:
        a.append(N[j])
        j += v
    return a


Axtr_plot = []
Aytr_plot = []
Axbr_plot = []
Aybr_plot = []
count = 0
for i in range(v):
    Axtr_plot.append(f(count, Axtr))
    Axbr_plot.append(f(count, Axbr))
    Aytr_plot.append(f(count, Aytr))
    Aybr_plot.append(f(count, Aybr))
    count += 1




rows = len(Axtr_plot)
columns = len(Axtr_plot[0])




# with this if statements I evaluate the arguments of the functions below! (Faster approach)

var_case = ""
if rows % 2 != 0:
    if columns % 2 != 0:
        var_case = "Case 1"
        #print("Case 1 means that Lx and Ly are both odd numbers!")
        bc = int((columns - 1) / 2)
        br = int((rows - 1) / 2)
    elif columns % 2 == 0:
        var_case = "Case 2"
        #print("Case 2 means that Lx is even and Ly is an odd number")
        bc = int(columns / 2)
        br = int((rows - 1) / 2)
elif rows % 2 == 0:
    if columns % 2 != 0:
        var_case = "Case 3"
        #print("Case 3 means that Lx is odd and Ly is even")    
        bc = int((columns - 1) / 2)
        br = int(rows / 2)
    elif columns % 2 == 0:
        var_case = "Case 4"
        #print("Case 4 means that Lx and Ly are both even numbers!")
        bc = int(columns / 2)
        br = int(rows / 2)





## NOTA: La funzione extract è indipendente dal case perchè dipende da bc e da br
### Extract the first matrix (minor) on the top, left
def extract(A, i, bc):
    b = []
    for j in range(bc):
        b.append(A[i][j])
    return b


def mirror_vertical(a, A, i, bc, var_case):
    count = (bc - 1)
    if var_case == "Case 1":
        for j in range(columns):
            if j == bc:
                a[i].append(A[i][j])
            elif j > bc:
                a[i].append(a[i][count])
                count -= 1
            j += 1
    elif var_case == "Case 2":
    	for j in range(columns):
            if j >= bc:
                a[i].append(a[i][count])
                count -= 1
            j += 1
    elif var_case == "Case 3":
    	for j in range(columns):
            if j == bc:
                a[i].append(A[i][j])
            elif j > bc:
                a[i].append(a[i][count])
                count -= 1
            j += 1
    elif var_case == "Case 4":
        for j in range(columns):
            if j >= bc:
                a[i].append(a[i][count])
                count -= 1
            j += 1
    return a
    

def mirror_horizontal(a, A, i, br, var_case, count2):
    count = (bc - 1)
    b = []
    if var_case == "Case 1":
        if i == br:
            for j in range(columns):
                if j <= bc:
                    b.append(A[i][j])
                else:
                    b.append(b[count])
                    count -= 1
        elif i > br:
            b.append(a[count2])
            count2 -= 1
        if i == br:
            a.append(b)
        else:
            a += b
    elif var_case == "Case 2":
        if i == br:
            for j in range(columns):
                if j < bc:
                    b.append(A[i][j])
                else:
                    b.append(b[count])
                    count -= 1
        elif i > br:
            b.append(a[count2])
            count2 -= 1
        if i == br:
            a.append(b)
        else:
            a += b

    elif var_case == "Case 3":
        b.append(a[count2])
        count2 -= 1
        a += b
    elif var_case == "Case 4":
        b.append(a[count2])
        count2 -= 1
        a += b
    return a, count2

print(var_case)

Axtr = []
Aytr = []
Axbr = []
Aybr = []

for i in range(br):
    Axtr.append(extract(Axtr_plot, i, bc))
    Aytr.append(extract(Aytr_plot, i, bc))
    Axbr.append(extract(Axbr_plot, i, bc))
    Aybr.append(extract(Aybr_plot, i, bc))


for i in range(br):
    Axtr = mirror_vertical(Axtr, Axtr_plot, i, bc, var_case)
    Aytr = mirror_vertical(Aytr, Aytr_plot, i, bc, var_case)
    Axbr = mirror_vertical(Axbr, Axbr_plot, i, bc, var_case)
    Aybr = mirror_vertical(Aybr, Aybr_plot, i, bc, var_case)



count2 = (br - 1)
for i in range(br, rows):
	Axtr, count2 = mirror_horizontal(Axtr, Axtr_plot, i, br, var_case, count2)
count2 = (br - 1)
for i in range(br, rows):
	Aytr, count2 = mirror_horizontal(Aytr, Aytr_plot, i, br, var_case, count2)
count2 = (br - 1)
for i in range(br, rows):
	Axbr, count2 = mirror_horizontal(Axbr, Axbr_plot, i, br, var_case, count2)   
count2 = (br - 1)
for i in range(br, rows):
	Aybr, count2 = mirror_horizontal(Aybr, Aybr_plot, i, br, var_case, count2)   

#print("before", np.array(Axtr))


Axtr_plot, Aytr_plot, Axbr_plot, Aybr_plot = Axtr.copy(), Aytr.copy(), Axbr.copy(), Aybr.copy()

def f2(A):
    a = []
    for i in A:
        a += i
    return a

Axtr, Aytr, Axbr, Aybr = f2(Axtr), f2(Aytr), f2(Axbr), f2(Aybr)



#print("after", np.array(f2(Axtr)))


if visualisation is True:

    import numpy as np
    import matplotlib.pyplot as plt


    x = []
    i = 0
    while i < len(X):
        x.append(X[i])
        i += v

    y = []
    i = 0
    while i < v:
        y.append(Y[i])
        i += 1

    x = np.array(x)
    y = np.array(y)


    x_lim = max(X) + min(X)
    y_lim = max(Y) + min(Y)

    
    


    #Axtr_plot = []
    #Aytr_plot = []
    #Axbr_plot = []
    #Aybr_plot = []
    #count = 0
    #for i in range(v):
        #Axtr_plot.append(f(count, Axtr))
        #Axbr_plot.append(f(count, Axbr))
        #Aytr_plot.append(f(count, Aytr))
        #Aybr_plot.append(f(count, Aybr))
        #count += 1

    Axtr_plot = np.array(Axtr_plot)
    Axbr_plot = np.array(Axbr_plot)
    Aytr_plot = np.array(Aytr_plot)
    Aybr_plot = np.array(Aybr_plot)

    
    plt.figure(figsize=(12,6))
    font1 = {'family':'times new roman','color':'black','size':19}
    font2 = {'family':'times new roman','color':'black','size':20}
    plt.contour(x, y, Axbr_plot, colors="black", alpha=0.7, linewidths=0.5, linestyles="solid")
    #levels = [40, 50, 60, 70]
    cs = plt.contourf(x, y, Axbr_plot, cmap="Reds")
    plt.colorbar(cs)
    plt.title("Reinforcement Area in X direction (Bottom) - $\mathregular{A_{xbr}}$ (m²/m)", fontdict = font1)
    plt.xlabel("X (m)", fontdict = font2)
    plt.ylabel("Y (m)", fontdict = font2)
    #plt.xticks([0,4,8,12,16,20])
    #plt.yticks([0,2,4,6,8,10,12])
    plt.xticks(fontname = 'times new roman', fontsize=20)
    plt.yticks(fontname = 'times new roman', fontsize=20)
    plt.ylim(0, round(y_lim))
    plt.xlim(0, round(x_lim))




    plt.figure(figsize=(12,6))
    font1 = {'family':'times new roman','color':'black','size':19}
    font2 = {'family':'times new roman','color':'black','size':20}
    plt.contour(x, y, Axtr_plot, colors="black", alpha=0.7, linewidths=0.5, linestyles="solid")
    #levels = [40, 50, 60, 70]
    cs = plt.contourf(x, y, Axtr_plot, cmap="Reds")
    plt.colorbar(cs)
    plt.title("Reinforcement Area in X direction (Top) - $\mathregular{A_{xtr}}$ (m²/m)", fontdict = font1)
    plt.xlabel("X (m)", fontdict = font2)
    plt.ylabel("Y (m)", fontdict = font2)
    #plt.xticks([0,4,8,12,16,20])
    #plt.yticks([0,2,4,6,8,10,12])
    plt.xticks(fontname = 'times new roman', fontsize=20)
    plt.yticks(fontname = 'times new roman', fontsize=20)
    plt.ylim(0, round(y_lim))
    plt.xlim(0, round(x_lim))


    plt.figure(figsize=(12,6))
    font1 = {'family':'times new roman','color':'black','size':19}
    font2 = {'family':'times new roman','color':'black','size':20}
    plt.contour(x, y, Aybr_plot, colors="black", alpha=0.7, linewidths=0.5, linestyles="solid")
    #levels = [40, 50, 60, 70]
    cs = plt.contourf(x, y, Aybr_plot, cmap="Reds")
    plt.colorbar(cs)
    plt.title("Reinforcement Area in Y direction (Bottom) - $\mathregular{A_{ybr}}$ (m²/m)", fontdict = font1)
    plt.xlabel("X (m)", fontdict = font2)
    plt.ylabel("Y (m)", fontdict = font2)
    #plt.xticks([0,4,8,12,16,20])
    #plt.yticks([0,2,4,6,8,10,12])
    plt.xticks(fontname = 'times new roman', fontsize=20)
    plt.yticks(fontname = 'times new roman', fontsize=20)
    plt.ylim(0, round(y_lim))
    plt.xlim(0, round(x_lim))


    plt.figure(figsize=(12,6))
    font1 = {'family':'times new roman','color':'black','size':19}
    font2 = {'family':'times new roman','color':'black','size':20}
    plt.contour(x, y, Aytr_plot, colors="black", alpha=0.7, linewidths=0.5, linestyles="solid")
    #levels = [40, 50, 60, 70]
    cs = plt.contourf(x, y, Aytr_plot, cmap="Reds")
    plt.colorbar(cs)
    plt.title("Reinforcement Area in Y direction (Top) - $\mathregular{A_{ytr}}$ (m²/m)", fontdict = font1)
    plt.xlabel("X (m)", fontdict = font2)
    plt.ylabel("Y (m)", fontdict = font2)
    #plt.xticks([0,4,8,12,16,20])
    #plt.yticks([0,2,4,6,8,10,12])
    plt.xticks(fontname = 'times new roman', fontsize=20)
    plt.yticks(fontname = 'times new roman', fontsize=20)
    plt.ylim(0, round(y_lim))
    plt.xlim(0, round(x_lim))



    plt.show()
# ---------- end python_3_script_28 ----------

# ----
# #TOP REINFORCEMENT
# 25/08/25
# #BOTTOM REINFORCEMENT
# 25/08/25
geo = Geometry(solid_intersection_2)
deconstruct_brep_2 = DeconstructBrep(Brep=geo)  # -> Faces, Edges, Vertices
cover_m = Slider(0.015, range=0..0.5)
multiplication_9 = Multiplication(A=cover_m, B=-1)
multiplication_10 = Multiplication(A=cover_m, B=-1)
diameter_mm = Slider(10, range=0..100)

# ----
# (8) REBARS PROVISION & VISUALIZATION
python_3_script_29 = Python3Script(Faces=deconstruct_brep_2.Faces, Lx=lx_total_span_m, Ly=ly_total_span_m)  # -> Index; inputs Faces: list of Surface, Lx: Int32, Ly: Int32; same code as python_3_script_11

python_3_script_30 = Python3Script(Index=python_3_script_29, Faces=deconstruct_brep_2.Faces)  # -> Top, Bottom; inputs Index: list, Faces: list; same code as python_3_script_12
surface = Surface(python_3_script_30.Bottom)
surface_2 = Surface(python_3_script_30.Top)
offset_surface = OffsetSurface(Surface=surface_2, Distance=multiplication_9, Retrim=True)
offset_surface_2 = OffsetSurface(Surface=surface, Distance=multiplication_10, Retrim=True)
python_3_script_31 = Python3Script(Lx=lx_total_span_m, Ly=ly_total_span_m, Surface=offset_surface, cover=cover_m, z_max=python_3_script_5.z)  # -> Line_x, Line_y, Points, u, v, PC_x, PC_y; inputs Lx: Double, Ly: Double, Surface: Surface, cover: Double, z_max: Double
# ---------- python_3_script_31: Python ----------
import Rhino as rc
interval0 = rc.Geometry.Interval(0, Lx)
interval1 = rc.Geometry.Interval(0, Ly)

change_dominio0 = rc.Geometry.Surface.SetDomain(Surface, 0, interval0)
change_dominio1 = rc.Geometry.Surface.SetDomain(Surface, 1, interval1)

print(rc.Geometry.Surface.Domain(Surface, 0))
Point = rc.Geometry.Point3d(Lx / 2, Ly / 2, z_max)

a = rc.Geometry.Surface.ClosestPoint(Surface, Point)
k = rc.Geometry.Surface.Evaluate(Surface, a[1], a[2], 1)[1]
z = k[2]

PC_x = []
PC_y = []

step_size = 1 #m
step_x = 0
step_y = 0
while step_x <= (Lx):
    PC_x.append(rc.Geometry.Point3d(step_x, Ly / 2, z))
    step_x += step_size

while step_y <= (Ly):
    PC_y.append(rc.Geometry.Point3d(Lx / 2, step_y, z))
    step_y += step_size





CP_1_y = []
CP_2_y = []
Line_y = []     #Nurbs curves in y
for j in range(len(PC_x)):
    cp_y = rc.Geometry.Surface.LocalClosestPoint(Surface, PC_x[j], PC_x[j][0], PC_x[j][1])
    CP_1_y.append(cp_y[1])
    CP_2_y.append(cp_y[2])

avg_y = 0
for i in CP_1_y:
    avg_y += i

if round(avg_y / len(CP_1_y), 1) == round(CP_1_y[0], 1):
    for i in CP_2_y:
        Line_y.append(rc.Geometry.Surface.IsoCurve(Surface, 0, i))
else:
    for i in CP_1_y:
        Line_y.append(rc.Geometry.Surface.IsoCurve(Surface, 1, i))


CP_1_x = []
CP_2_x = []
Line_x = []     #Nurbs curves in x
for j in range(len(PC_y)):
    cp_x = rc.Geometry.Surface.LocalClosestPoint(Surface, PC_y[j], PC_y[j][0], PC_y[j][1])
    CP_1_x.append(cp_x[1])
    CP_2_x.append(cp_x[2])

avg_x = 0
for i in CP_1_x:
    avg_x += i

if round(avg_x / len(CP_1_x), 1) == round(CP_1_x[0], 1):    
    for i in CP_2_x:
        Line_x.append(rc.Geometry.Surface.IsoCurve(Surface, 0, i))
else:
    for i in CP_1_x:
        Line_x.append(rc.Geometry.Surface.IsoCurve(Surface, 1, i))


Points = []     #Intersection between nurbs in x and y
def intersection(j):
    for i in range(len(PC_x)):
        intersection = rc.Geometry.Intersect.Intersection.CurveCurve(Line_y[i], Line_x[j], 0.5, 0.5)
        coordinate = intersection[0].PointA
        if coordinate[2] >= 0:
            point = rc.Geometry.Point3d(coordinate[0], coordinate[1], coordinate[2])
        else:
            point = rc.Geometry.Point3d(coordinate[0], coordinate[1], cover)
        Points.append(point)

for j in range(len(PC_y)):
    intersection(j)


u = len(PC_y)
v = len(PC_x)
# ---------- end python_3_script_31 ----------
python_3_script_32 = Python3Script(Lx=lx_total_span_m, Ly=ly_total_span_m, Surface=offset_surface_2, cover=cover_m, z_max=python_3_script_5.z)  # -> Line_x, Line_y, Points, u, v, PC_x, PC_y; inputs Lx: Double, Ly: Double, Surface: Surface, cover: Double
# ---------- python_3_script_32: Python ----------
import Rhino as rc
interval0 = rc.Geometry.Interval(0, Lx)
interval1 = rc.Geometry.Interval(0, Ly)

change_dominio0 = rc.Geometry.Surface.SetDomain(Surface, 0, interval0)
change_dominio1 = rc.Geometry.Surface.SetDomain(Surface, 1, interval1)

print(rc.Geometry.Surface.Domain(Surface, 0))
Point = rc.Geometry.Point3d(Lx / 2, Ly / 2, z_max)

a = rc.Geometry.Surface.ClosestPoint(Surface, Point)
k = rc.Geometry.Surface.Evaluate(Surface, a[1], a[2], 1)[1]
z = k[2]

PC_x = []
PC_y = []

step_size = 1 #m
step_x = 0
step_y = 0
while step_x <= (Lx):
    PC_x.append(rc.Geometry.Point3d(step_x, Ly / 2, z))
    step_x += step_size

while step_y <= (Ly):
    PC_y.append(rc.Geometry.Point3d(Lx / 2, step_y, z))
    step_y += step_size

PC_x[0][0] = cover
PC_x[-1][0] = Lx - cover

PC_y[0][1] = cover
PC_y[-1][1] = Ly - cover


CP_1_y = []
CP_2_y = []
Line_y = []     #Nurbs curves in y
for j in range(len(PC_x)):
    cp_y = rc.Geometry.Surface.LocalClosestPoint(Surface, PC_x[j], PC_x[j][0], PC_x[j][1])
    CP_1_y.append(cp_y[1])
    CP_2_y.append(cp_y[2])

avg_y = 0
for i in CP_1_y:
    avg_y += i

if round(avg_y / len(CP_1_y), 1) == round(CP_1_y[0], 1):
    for i in CP_2_y:
        Line_y.append(rc.Geometry.Surface.IsoCurve(Surface, 0, i))
else:
    for i in CP_1_y:
        Line_y.append(rc.Geometry.Surface.IsoCurve(Surface, 1, i))


CP_1_x = []
CP_2_x = []
Line_x = []     #Nurbs curves in x
for j in range(len(PC_y)):
    cp_x = rc.Geometry.Surface.LocalClosestPoint(Surface, PC_y[j], PC_y[j][0], PC_y[j][1])
    CP_1_x.append(cp_x[1])
    CP_2_x.append(cp_x[2])

avg_x = 0
for i in CP_1_x:
    avg_x += i

if round(avg_x / len(CP_1_x), 1) == round(CP_1_x[0], 1):    
    for i in CP_2_x:
        Line_x.append(rc.Geometry.Surface.IsoCurve(Surface, 0, i))
else:
    for i in CP_1_x:
        Line_x.append(rc.Geometry.Surface.IsoCurve(Surface, 1, i))


Points = []     #Intersection between nurbs in x and y
def intersection(j):
    for i in range(len(PC_x)):
        intersection = rc.Geometry.Intersect.Intersection.CurveCurve(Line_y[i], Line_x[j], 0.5, 0.5)
        coordinate = intersection[0].PointA
        if coordinate[2] >= 0:
            point = rc.Geometry.Point3d(coordinate[0], coordinate[1], coordinate[2])
        else:
            point = rc.Geometry.Point3d(coordinate[0], coordinate[1], cover)
        Points.append(point)

for j in range(len(PC_y)):
    intersection(j)


u = len(PC_y)
v = len(PC_x)
# ---------- end python_3_script_32 ----------
point_5 = Point(python_3_script_32.Points)
mesh_frompoints_4 = MeshFromPoints(Points=python_3_script_31.Points, UDirection=python_3_script_31.u, VDirection=python_3_script_31.v)
mesh_frompoints_5 = MeshFromPoints(Points=point_5, UDirection=python_3_script_32.u, VDirection=python_3_script_32.v)
mesh_3 = Mesh(mesh_frompoints_4)
mesh_4 = Mesh(mesh_frompoints_5)
deconstruct_mesh_5 = DeconstructMesh(Mesh=mesh_3)  # -> Vertices, Faces, Colours, Normals
deconstruct_mesh_6 = DeconstructMesh(Mesh=mesh_4)  # -> Vertices, Faces, Colours, Normals
deconstruct_2 = Deconstruct(Point=deconstruct_mesh_5.Vertices)  # -> XComponent, YComponent, ZComponent
deconstruct_face_5 = DeconstructFace(Face=deconstruct_mesh_5.Faces)  # -> CornerA, CornerB, CornerC, CornerD
deconstruct_3 = Deconstruct(Point=deconstruct_mesh_6.Vertices)  # -> XComponent, YComponent, ZComponent
deconstruct_face_6 = DeconstructFace(Face=deconstruct_mesh_6.Faces)  # -> CornerA, CornerB, CornerC, CornerD
python_3_script_33 = Python3Script(
    Axtr=python_3_script_28.Axtr,
    Aytr=python_3_script_28.Aytr,
    X=deconstruct_2.XComponent,
    Y=deconstruct_2.YComponent,
    Z=deconstruct_2.ZComponent,
    CornerA=deconstruct_face_5.CornerA,
    CornerB=deconstruct_face_5.CornerB,
    CornerC=deconstruct_face_5.CornerC,
    CornerD=deconstruct_face_5.CornerD,
    d=diameter_mm)  # -> Lx_top, Ly_top; inputs Axtr: list of Double, Aytr: list of Double, X: list of Double, Y: list of Double, Z: list of Double, CornerA: list of Int32, CornerB: list of Int32, CornerC: list of Int32, CornerD: list of Int32, d: Int32
# ---------- python_3_script_33: Python ----------
import rhinoscriptsyntax as rs
from math import pi
import Rhino as rc



## First step: I create a list which contains, for each mesh element, the id of the points on the corners (4 because the mesh is quadrangular)

Mesh = []
for i in range(len(CornerA)):
    m = [CornerA[i], CornerB[i], CornerC[i], CornerD[i]]    
    Mesh.append(m)


## Second step: Define a function which gives in output, for each mesh element, the length of the edges (2 edges "along x" and 2 edges "along y") and the Points
## (2 Points for each edge). Starting from these points we'll add additional points for additional reinforcements.

def f(list): ### This code cannot be the ultimate one, because it is strictly function on our way to discretise the mesh!! That's the reason why later we'll need some more complicated code,
            ### with a local branch node matrix or local Floyd-Warshall algorithm.
    lx = []
    ly = []
    a = list[0]
    b = list[1]
    c = list[2]
    d = list[3]

    lx1 = ((X[a] - X[b]) ** 2 + (Y[a] - Y[b]) ** 2 + (Z[a] - Z[b]) ** 2) ** 0.5
    lx2 = ((X[c] - X[d]) ** 2 + (Y[c] - Y[d]) ** 2 + (Z[c] - Z[d]) ** 2) ** 0.5
    ly1 = ((X[a] - X[d]) ** 2 + (Y[a] - Y[d]) ** 2 + (Z[a] - Z[d]) ** 2) ** 0.5
    ly2 = ((X[b] - X[c]) ** 2 + (Y[b] - Y[c]) ** 2 + (Z[b] - Z[c]) ** 2) ** 0.5

    Px1 = [[X[a], Y[a], Z[a]], [X[b], Y[b], Z[b]]]
    Px2 = [[X[d], Y[d], Z[d]], [X[c], Y[c], Z[c]]]
    Py1 = [[X[a], Y[a], Z[a]], [X[d], Y[d], Z[d]]]
    Py2 = [[X[b], Y[b], Z[b]], [X[c], Y[c], Z[c]]]

    return lx1, lx2, ly1, ly2, Px1, Px2, Py1, Py2


Px1 = []
Px2 = []
Py1 = []
Py2 = []

Lx1 = []
Lx2 = []
Ly1 = []
Ly2 = []

for j in range(len(Mesh)):
    lx1, lx2, ly1, ly2, px1, px2, py1, py2 = f(Mesh[j])
    Lx1.append(lx1)
    Lx2.append(lx2)
    Ly1.append(ly1)
    Ly2.append(ly2)
    Px1.append(px1)
    Px2.append(px2)
    Py1.append(py1)
    Py2.append(py2)



## Third step: evaluate, for each mesh element, the quantity of reinforcement in terms of number of rebars, in top and bottom, x and y with a simple criterion: if the ratio between the required Area
## and the Area of one rebar is a float, it has to be rounded to the greatest integer (es. 4.3 --> 5)

As = pi * d ** 2 / 4 #mm**2



Ax_top = []
for i in range(len(Axtr)):
    if Axtr[i] * 1000000/ As > round((Axtr[i]) * 1000000/ As,ndigits=None):
        ax_top = round((Axtr[i]) * 1000000/ As,ndigits=None) + 1
        Ax_top.append(ax_top)
    else:
         ax_top = round((Axtr[i]) * 1000000/ As,ndigits=None)
         Ax_top.append(ax_top)

Ay_top = []
for i in range(len(Aytr)):
    if Aytr[i] * 1000000/ As > round((Aytr[i]) * 1000000/ As,ndigits=None):
        ay_top = round((Aytr[i]) * 1000000/ As,ndigits=None) + 1
        Ay_top.append(ay_top)
    else:
         ay_top = round((Aytr[i]) * 1000000/ As,ndigits=None)
         Ay_top.append(ay_top)


''' Fourth step: the main function. With this function we create our grid of reinforcement in x, y, top and bottom (depends on the input parameters of the function).
First of all we assign to the mesh element the minimum reinforcement required, in function of the maximum spacing between rebars (in this case 30 cm), and then we add reinforcement
by inserting additional rebars in the free spaces. (If the minimum number of reinforcement is 5, but we have in total 12 rebars, first of all we insert 5 rebars, then we have 4 spaces for adding other 4 bars
and so we have to add only 3 rebars. In order to have always symmetric reinforcement, we round this 3 into the highest even number, which is 4 and add these rebars putting one rebar in the first and one in the last space
, another one in the second and the last one in the last space - 1). There are some loops at the end because we iterate along all the mesh elements, in top and bottom, x and y, but finally
what we really need are the lists Lx and Ly top and bottom, which contain lines, which represent our reinforcement. Obviously the z coordinate of each starting/ending point of reinforcement
is +- h / 2 due to the top/bottom case


IMPORTANT!:

- With this method we are not considering the cover (both in vertical and lateral edges);
- With this method we gave only a lower bound to the number of rebars, but not an upper bound! (for example, if we set as input a diameter of 100 mm or higher, 
 automatically we'll have the minimum required reinforcement in all the shell, even if with this kind of rebars (theoretically) we'd need probably only one rebar for each mesh element, or less 
 (which is obviously from a practical point of view impossible), because of we set a minimum which is function of the maximum spacing between bars.  Instead, if we use lower diameters, as 6 mm, we would need up to 40 rebars
 which from a practical point of view cannot be used in 1 m, because they're too much (1 bar each 3 cm (axis / axis), which is quite impossible!!);
- With this method we create some duplicate lines so it is better to use the Karamba Tool remove duplicates;
- The reinforcement is not completely symmetric because the input Area is not symmetric.

PROBABLY later it will be better to optimise the code because there are too many variables which are useless!

'''
def building_reinforcement(j, A, L1, L2, P1, P2):
   
    #print("We are in the step", j)
    l1 = L1[j]
    l2 = L2[j]
    spacing_max = 0.3 #m
    #print("l1 is", l1)
    #print("l2 is", l2)
    nr_min = max(l1, l2) / spacing_max
     ## Additional code! ## - 25_08_25 ## We add an if condition in order to have always minimum 4 rebars and not more than 4! (We assume 1m divisions, even if sometimes I have 1.22)
    ## 1 is 1 m ## !!
    if max(l1, l2) > 1 or max(l1, l2) < 1:
        nr_min = 1 / spacing_max
    ###
    
    if nr_min > round(nr_min, ndigits=None):
        nr_min = round(nr_min, ndigits=None) + 1
    else:
        nr_min = round(nr_min, ndigits=None)
    
   
    

    if A[j] <= nr_min:
        n = nr_min
        #print("number of bars required before is the minimum", n)
    else:
        n = A[j]
        #print("number of bars required before is n", n)
    count = 0
    Point1 = []
    Point2 = []
    Dx1 = []
    Dx2 = []
    Dy1 = []
    Dy2 = []
    Dz1 = []
    Dz2 = []
    dx1 = (P1[j][1][0] - P1[j][0][0]) / (nr_min - 1)
    dx2 = (P2[j][1][0] - P2[j][0][0]) / (nr_min - 1)
    dy1 = (P1[j][1][1] - P1[j][0][1]) / (nr_min - 1)
    dy2 = (P2[j][1][1] - P2[j][0][1]) / (nr_min - 1)
    dz1 = (P1[j][1][2] - P1[j][0][2]) / (nr_min - 1)
    dz2 = (P2[j][1][2] - P2[j][0][2]) / (nr_min - 1)
    Dx1.append(dx1)
    Dx2.append(dx2)
    Dy1.append(dy1)
    Dy2.append(dy2)
    Dz1.append(dz1)
    Dz2.append(dz2)

    while count < nr_min: 
       point1 = [P1[j][0][0] + dx1 * count, P1[j][0][1] + dy1 * count, P1[j][0][2] + dz1 * count]
       point2 = [P2[j][0][0] + dx2 * count, P2[j][0][1] + dy2 * count, P2[j][0][2] + dz2 * count]
       Point1.append(point1)
       Point2.append(point2)
       count += 1
    
    Points1 = Point1
    Points2 = Point2
    if n != nr_min:
        spacing = nr_min - 1
        n = n - nr_min
        while n > 0:
            if spacing / n > 1:
                if n % 2 != 0:
                    n += 1
            dx1 = Dx1[-1] / 2
            dx2 = Dx2[-1] / 2
            dy1 = Dy1[-1] / 2
            dy2 = Dy2[-1] / 2
            dz1 = Dz1[-1] / 2
            dz2 = Dz2[-1] / 2
        
            Point3 = []
            Point4 = []
            count = 0
            j1 = 0
            j2 = 0
            if spacing / n < 1:
                while count < spacing:
                    if count % 2 == 0:
                        point3 = [Points1[j1][0] + dx1, Points1[j1][1] + dy1, Points1[j1][2] + dz1]
                        point4 = [Points2[j1][0] + dx2, Points2[j1][1] + dy2, Points2[j1][2] + dz2]
                        Point3.append(point3)
                        Point4.append(point4)
                        j1 += 1
                        count += 1
                    elif count % 2 != 0:
                        point3 = [Points1[len(Points1) - 1 - j2][0] - dx1, Points1[len(Points1) - 1 - j2][1] - dy1, Points1[len(Points1) - 1 - j2][2] - dz1]
                        point4 = [Points2[len(Points1) - 1 - j2][0] - dx2, Points2[len(Points1) - 1 - j2][1] - dy2, Points2[len(Points1) - 1 - j2][2] - dz2]   
                        Point3.append(point3)
                        Point4.append(point4)
                        j2 += 1
                        count += 1
            else:
                while count < n:
                    if count % 2 == 0:
                        point3 = [Points1[j1][0] + dx1, Points1[j1][1] + dy1, Points1[j1][2] + dz1]
                        point4 = [Points2[j1][0] + dx2, Points2[j1][1] + dy2, Points2[j1][2] + dz2]
                        Point3.append(point3)
                        Point4.append(point4)
                        j1 += 1
                        count += 1
                    elif count % 2 != 0:
                        point3 = [Points1[len(Points1) - 1 - j2][0] - dx1, Points1[len(Points1) - 1 - j2][1] - dy1, Points1[len(Points1) - 1 - j2][2] - dz1]
                        point4 = [Points2[len(Points1) - 1 - j2][0] - dx2, Points2[len(Points1) - 1 - j2][1] - dy2, Points2[len(Points1) - 1 - j2][2] - dz2]   
                        Point3.append(point3)
                        Point4.append(point4)
                        j2 += 1
                        count += 1
            i = 0
            while i < len(Point3):
                if i % 2 == 0:
                    index = i + 1
                    Points1.insert(index, Point3[i])
                    Points2.insert(index, Point4[i])        
                else:
                    index = len(Points1) - i
                    Points1.insert(index, Point3[i])
                    Points2.insert(index, Point4[i])
                i += 1
            Dx1.append(dx1)
            Dx2.append(dx2)
            Dy1.append(dy1)
            Dy2.append(dy2)
            Dz1.append(dz1)
            Dz2.append(dz2)
            n -= spacing
            spacing *= 2
    #print("n after is", n)
    Point1_ = Points1
    Point2_ = Points2
    
    Point1 = []
    Point2 = []

    for j in range(len(Point1_)):
        point1 = rc.Geometry.Point3d(Point1_[j][0], Point1_[j][1], Point1_[j][2])
        point2 = rc.Geometry.Point3d(Point2_[j][0], Point2_[j][1], Point2_[j][2])
        Point1.append(point1)
        Point2.append(point2)
    #print("\n\n")
    return Point1, Point2

## This is some code that we can use for testing mesh by mesh which is the quantity of reinforcement (in terms of Points), we just need as input in GH the variable r as a slider.
## This could also clarify how the main code works!!
#prova1, prova2 = building_reinforcement(r, Ax_bottom, Lx1, Lx2, Px1, Px2, "bottom")
#print(prova1)
#print(prova2)
#prova0 = building_reinforcement(222, Ax_top, Lx1, Lx2, Px1, Px2)
#prova1 = building_reinforcement(223, Ax_top, Lx1, Lx2, Px1, Px2)
#prova2 = building_reinforcement(224, Ax_top, Lx1, Lx2, Px1, Px2)


#print(prova1)

#for prova1 in prova1:
   # print(prova1)
#for prova2 in prova2:
  #  print(prova2)


P1x_top = []
P2x_top = []
P1y_top = []
P2y_top = []

for j in range(len(Mesh)):
    p1x_top, p2x_top = building_reinforcement(j, Ax_top, Lx1, Lx2, Px1, Px2)
    p1y_top, p2y_top = building_reinforcement(j, Ay_top, Ly1, Ly2, Py1, Py2)
    for i in p1x_top:
        P1x_top.append(i)
    for i in p2x_top:
        P2x_top.append(i)

    for i in p1y_top:
        P1y_top.append(i)
    for i in p2y_top:
        P2y_top.append(i)

Lx_top =[]
Ly_top = []

for t in range(len(P1x_top)):
    lx_top = rc.Geometry.Line(P1x_top[t], P2x_top[t])
    Lx_top.append(lx_top)
    
for t in range(len(P1y_top)):
    ly_top =  rc.Geometry.Line(P1y_top[t], P2y_top[t])
    Ly_top.append(ly_top)

print(Lx_top)

print(Ly_top)
# ---------- end python_3_script_33 ----------
python_3_script_34 = Python3Script(
    Axbr=python_3_script_28.Axbr,
    Aybr=python_3_script_28.Aybr,
    X=deconstruct_3.XComponent,
    Y=deconstruct_3.YComponent,
    Z=deconstruct_3.ZComponent,
    CornerA=deconstruct_face_6.CornerA,
    CornerB=deconstruct_face_6.CornerB,
    CornerC=deconstruct_face_6.CornerC,
    CornerD=deconstruct_face_6.CornerD,
    d=diameter_mm)  # -> Lx_bottom, Ly_bottom; inputs Axbr: list of Double, Aybr: list of Double, X: list of Double, Y: list of Double, Z: list of Double, CornerA: list of Int32, CornerB: list of Int32, CornerC: list of Int32, CornerD: list of Int32, d: Int32
# ---------- python_3_script_34: Python ----------
import rhinoscriptsyntax as rs
from math import pi
import Rhino as rc



## First step: I create a list which contains, for each mesh element, the id of the points on the corners (4 because the mesh is quadrangular)

Mesh = []
for i in range(len(CornerA)):
    m = [CornerA[i], CornerB[i], CornerC[i], CornerD[i]]    
    Mesh.append(m)


## Second step: Define a function which gives in output, for each mesh element, the length of the edges (2 edges "along x" and 2 edges "along y") and the Points
## (2 Points for each edge). Starting from these points we'll add additional points for additional reinforcements.

def f(list): ### This code cannot be the ultimate one, because it is strictly function on our way to discretise the mesh!! That's the reason why later we'll need some more complicated code,
            ### with a local branch node matrix or local Floyd-Warshall algorithm.
    lx = []
    ly = []
    a = list[0]
    b = list[1]
    c = list[2]
    d = list[3]

    lx1 = ((X[a] - X[b]) ** 2 + (Y[a] - Y[b]) ** 2 + (Z[a] - Z[b]) ** 2) ** 0.5
    lx2 = ((X[c] - X[d]) ** 2 + (Y[c] - Y[d]) ** 2 + (Z[c] - Z[d]) ** 2) ** 0.5
    ly1 = ((X[a] - X[d]) ** 2 + (Y[a] - Y[d]) ** 2 + (Z[a] - Z[d]) ** 2) ** 0.5
    ly2 = ((X[b] - X[c]) ** 2 + (Y[b] - Y[c]) ** 2 + (Z[b] - Z[c]) ** 2) ** 0.5

    Px1 = [[X[a], Y[a], Z[a]], [X[b], Y[b], Z[b]]]
    Px2 = [[X[d], Y[d], Z[d]], [X[c], Y[c], Z[c]]]
    Py1 = [[X[a], Y[a], Z[a]], [X[d], Y[d], Z[d]]]
    Py2 = [[X[b], Y[b], Z[b]], [X[c], Y[c], Z[c]]]

    return lx1, lx2, ly1, ly2, Px1, Px2, Py1, Py2


Px1 = []
Px2 = []
Py1 = []
Py2 = []

Lx1 = []
Lx2 = []
Ly1 = []
Ly2 = []

for j in range(len(Mesh)):
    lx1, lx2, ly1, ly2, px1, px2, py1, py2 = f(Mesh[j])
    Lx1.append(lx1)
    Lx2.append(lx2)
    Ly1.append(ly1)
    Ly2.append(ly2)
    Px1.append(px1)
    Px2.append(px2)
    Py1.append(py1)
    Py2.append(py2)



## Third step: evaluate, for each mesh element, the quantity of reinforcement in terms of number of rebars, in top and bottom, x and y with a simple criterion: if the ratio between the required Area
## and the Area of one rebar is a float, it has to be rounded to the greatest integer (es. 4.3 --> 5)

As = pi * d ** 2 / 4 #mm**2



Ax_bottom = []
for i in range(len(Axbr)):
    if Axbr[i] * 1000000/ As > round((Axbr[i]) * 1000000/ As,ndigits=None):
        ax_bottom = round((Axbr[i]) * 1000000/ As,ndigits=None) + 1
        Ax_bottom.append(ax_bottom)
    else:
         ax_bottom = round((Axbr[i]) * 1000000/ As,ndigits=None)
         Ax_bottom.append(ax_bottom)

Ay_bottom = []
for i in range(len(Aybr)):
    if Aybr[i] * 1000000/ As > round((Aybr[i]) * 1000000/ As,ndigits=None):
        ay_bottom = round((Aybr[i]) * 1000000/ As,ndigits=None) + 1
        Ay_bottom.append(ay_bottom)
    else:
         ay_bottom = round((Aybr[i]) * 1000000/ As,ndigits=None)
         Ay_bottom.append(ay_bottom)


''' Fourth step: the main function. With this function we create our grid of reinforcement in x, y, top and bottom (depends on the input parameters of the function).
First of all we assign to the mesh element the minimum reinforcement required, in function of the maximum spacing between rebars (in this case 30 cm), and then we add reinforcement
by inserting additional rebars in the free spaces. (If the minimum number of reinforcement is 5, but we have in total 12 rebars, first of all we insert 5 rebars, then we have 4 spaces for adding other 4 bars
and so we have to add only 3 rebars. In order to have always symmetric reinforcement, we round this 3 into the highest even number, which is 4 and add these rebars putting one rebar in the first and one in the last space
, another one in the second and the last one in the last space - 1). There are some loops at the end because we iterate along all the mesh elements, in top and bottom, x and y, but finally
what we really need are the lists Lx and Ly top and bottom, which contain lines, which represent our reinforcement. Obviously the z coordinate of each starting/ending point of reinforcement
is +- h / 2 due to the top/bottom case


IMPORTANT!:

- With this method we are not considering the cover (both in vertical and lateral edges);
- With this method we gave only a lower bound to the number of rebars, but not an upper bound! (for example, if we set as input a diameter of 100 mm or higher, 
 automatically we'll have the minimum required reinforcement in all the shell, even if with this kind of rebars (theoretically) we'd need probably only one rebar for each mesh element, or less 
 (which is obviously from a practical point of view impossible), because of we set a minimum which is function of the maximum spacing between bars.  Instead, if we use lower diameters, as 6 mm, we would need up to 40 rebars
 which from a practical point of view cannot be used in 1 m, because they're too much (1 bar each 3 cm (axis / axis), which is quite impossible!!);
- With this method we create some duplicate lines so it is better to use the Karamba Tool remove duplicates;
- The reinforcement is not completely symmetric because the input Area is not symmetric.

PROBABLY later it will be better to optimise the code because there are too many variables which are useless!

'''
def building_reinforcement(j, A, L1, L2, P1, P2):
   
    #print("We are in the step", j)
    l1 = L1[j]
    l2 = L2[j]
    spacing_max = 0.3 #m
    #print("l1 is", l1)
    #print("l2 is", l2)
    nr_min = max(l1, l2) / spacing_max
     ## Additional code! ## - 25_08_25 ## We add an if condition in order to have always minimum 4 rebars and not more than 4! (We assume 1m divisions, even if sometimes I have 1.22)
    ## 1 is 1 m ## !!
    if max(l1, l2) > 1 or max(l1, l2) < 1:
        nr_min = 1 / spacing_max
    
    
    ###
    
    if nr_min > round(nr_min, ndigits=None):
        nr_min = round(nr_min, ndigits=None) + 1
    else:
        nr_min = round(nr_min, ndigits=None)
    
   
    

    if A[j] <= nr_min:
        n = nr_min
        #print("number of bars required before is the minimum", n)
    else:
        n = A[j]
        #print("number of bars required before is n", n)
    count = 0
    Point1 = []
    Point2 = []
    Dx1 = []
    Dx2 = []
    Dy1 = []
    Dy2 = []
    Dz1 = []
    Dz2 = []
    dx1 = (P1[j][1][0] - P1[j][0][0]) / (nr_min - 1)
    dx2 = (P2[j][1][0] - P2[j][0][0]) / (nr_min - 1)
    dy1 = (P1[j][1][1] - P1[j][0][1]) / (nr_min - 1)
    dy2 = (P2[j][1][1] - P2[j][0][1]) / (nr_min - 1)
    dz1 = (P1[j][1][2] - P1[j][0][2]) / (nr_min - 1)
    dz2 = (P2[j][1][2] - P2[j][0][2]) / (nr_min - 1)
    Dx1.append(dx1)
    Dx2.append(dx2)
    Dy1.append(dy1)
    Dy2.append(dy2)
    Dz1.append(dz1)
    Dz2.append(dz2)

    while count < nr_min: 
       point1 = [P1[j][0][0] + dx1 * count, P1[j][0][1] + dy1 * count, P1[j][0][2] + dz1 * count]
       point2 = [P2[j][0][0] + dx2 * count, P2[j][0][1] + dy2 * count, P2[j][0][2] + dz2 * count]
       Point1.append(point1)
       Point2.append(point2)
       count += 1
    
    Points1 = Point1
    Points2 = Point2
    if n != nr_min:
        spacing = nr_min - 1
        n = n - nr_min
        while n > 0:
            if spacing / n > 1:
                if n % 2 != 0:
                    n += 1
            dx1 = Dx1[-1] / 2
            dx2 = Dx2[-1] / 2
            dy1 = Dy1[-1] / 2
            dy2 = Dy2[-1] / 2
            dz1 = Dz1[-1] / 2
            dz2 = Dz2[-1] / 2
        
            Point3 = []
            Point4 = []
            count = 0
            j1 = 0
            j2 = 0
            if spacing / n < 1:
                while count < spacing:
                    if count % 2 == 0:
                        point3 = [Points1[j1][0] + dx1, Points1[j1][1] + dy1, Points1[j1][2] + dz1]
                        point4 = [Points2[j1][0] + dx2, Points2[j1][1] + dy2, Points2[j1][2] + dz2]
                        Point3.append(point3)
                        Point4.append(point4)
                        j1 += 1
                        count += 1
                    elif count % 2 != 0:
                        point3 = [Points1[len(Points1) - 1 - j2][0] - dx1, Points1[len(Points1) - 1 - j2][1] - dy1, Points1[len(Points1) - 1 - j2][2] - dz1]
                        point4 = [Points2[len(Points1) - 1 - j2][0] - dx2, Points2[len(Points1) - 1 - j2][1] - dy2, Points2[len(Points1) - 1 - j2][2] - dz2]   
                        Point3.append(point3)
                        Point4.append(point4)
                        j2 += 1
                        count += 1
            else:
                while count < n:
                    if count % 2 == 0:
                        point3 = [Points1[j1][0] + dx1, Points1[j1][1] + dy1, Points1[j1][2] + dz1]
                        point4 = [Points2[j1][0] + dx2, Points2[j1][1] + dy2, Points2[j1][2] + dz2]
                        Point3.append(point3)
                        Point4.append(point4)
                        j1 += 1
                        count += 1
                    elif count % 2 != 0:
                        point3 = [Points1[len(Points1) - 1 - j2][0] - dx1, Points1[len(Points1) - 1 - j2][1] - dy1, Points1[len(Points1) - 1 - j2][2] - dz1]
                        point4 = [Points2[len(Points1) - 1 - j2][0] - dx2, Points2[len(Points1) - 1 - j2][1] - dy2, Points2[len(Points1) - 1 - j2][2] - dz2]   
                        Point3.append(point3)
                        Point4.append(point4)
                        j2 += 1
                        count += 1
            i = 0
            while i < len(Point3):
                if i % 2 == 0:
                    index = i + 1
                    Points1.insert(index, Point3[i])
                    Points2.insert(index, Point4[i])        
                else:
                    index = len(Points1) - i
                    Points1.insert(index, Point3[i])
                    Points2.insert(index, Point4[i])
                i += 1
            Dx1.append(dx1)
            Dx2.append(dx2)
            Dy1.append(dy1)
            Dy2.append(dy2)
            Dz1.append(dz1)
            Dz2.append(dz2)
            n -= spacing
            spacing *= 2
    #print("n after is", n)
    Point1_ = Points1
    Point2_ = Points2
    
    Point1 = []
    Point2 = []

    for j in range(len(Point1_)):
        point1 = rc.Geometry.Point3d(Point1_[j][0], Point1_[j][1], Point1_[j][2])
        point2 = rc.Geometry.Point3d(Point2_[j][0], Point2_[j][1], Point2_[j][2])
        Point1.append(point1)
        Point2.append(point2)
    #print("\n\n")
    return Point1, Point2

## This is some code that we can use for testing mesh by mesh which is the quantity of reinforcement (in terms of Points), we just need as input in GH the variable r as a slider.
## This could also clarify how the main code works!!
#prova1, prova2 = building_reinforcement(r, Ax_bottom, Lx1, Lx2, Px1, Px2, "bottom")
#print(prova1)
#print(prova2)
#prova0 = building_reinforcement(222, Ax_top, Lx1, Lx2, Px1, Px2)
#prova1 = building_reinforcement(223, Ax_top, Lx1, Lx2, Px1, Px2)
#prova2 = building_reinforcement(224, Ax_top, Lx1, Lx2, Px1, Px2)


#print(prova1)

#for prova1 in prova1:
   # print(prova1)
#for prova2 in prova2:
  #  print(prova2)



P1x_bottom = []
P2x_bottom = []
P1y_bottom = []
P2y_bottom = []

for j in range(len(Mesh)):
    p1x_bottom, p2x_bottom = building_reinforcement(j, Ax_bottom, Lx1, Lx2, Px1, Px2)
    p1y_bottom, p2y_bottom = building_reinforcement(j, Ay_bottom, Ly1, Ly2, Py1, Py2)
    for i in p1x_bottom:
        P1x_bottom.append(i)
    for i in p2x_bottom:
        P2x_bottom.append(i)

    for i in p1y_bottom:
        P1y_bottom.append(i)
    for i in p2y_bottom:
        P2y_bottom.append(i)

Lx_bottom =[]
Ly_bottom = []

for t in range(len(P1x_bottom)):
    lx_bottom = rc.Geometry.Line(P1x_bottom[t], P2x_bottom[t])
    Lx_bottom.append(lx_bottom)
    
for t in range(len(P1y_bottom)):
    ly_bottom =  rc.Geometry.Line(P1y_bottom[t], P2y_bottom[t])
    Ly_bottom.append(ly_bottom)

print(Lx_bottom)

print(Ly_bottom)
# ---------- end python_3_script_34 ----------
line = Line(python_3_script_33.Lx_top)
line_2 = Line(python_3_script_33.Ly_top)
line_3 = Line(python_3_script_34.Ly_bottom)
line_4 = Line(python_3_script_34.Lx_bottom)
line_5 = Line([line, line_2, line_4, line_3])
rdlines = RemoveDuplicateLinesKaramba3D(Line=line_5, LimitDistance=0.005)  # -> OutLine, Info, Indexes

point_list_4 = PointList(Points=python_3_script_31.Points)

# ----
# Embodied carbon of rebars
len = Length(Curve=rdlines.OutLine)
ma_2 = MassAddition(Input=len)  # -> Result, PartialResults
py3_3 = Python3Script(BarLength=ma_2.Result, BarDia=diameter_mm)  # -> out, a; inputs BarLength: Double, BarDia: Double
# ---------- py3_3: Python ----------
#This code is for calculating the embodied carbon of the reinforcement from the total length of the bars provided and their diameter
import numpy as np
from scipy.optimize import minimize

from sympy import Eq, Symbol, solve
from sympy import tan
import math
from sympy import symbols, solve
Gamma_FRP = 1900       #  kg/m3 
ECF_GFRP = 2.7          #  kgCO2e/kg (provided by Orlimex UK Ltd)


L = BarLength
d = BarDia / 1000
EC = L * np.pi * d **2 / 4 * Gamma_FRP * ECF_GFRP
print(EC)
# ---------- end py3_3 ----------

ec_due_to_gfrp = Panel(py3_3.out)
addition_2 = Addition(A=ec_due_to_gfrp, B=ec_due_to_concrete, C=ec_due_to_columns)

# ----
# Total Embodied
# Carbon (kgCO2e)
total_embodied_carbon = Panel(addition_2)

v_armature = Panel(py3_3.out)

# ----
# (7) EMBODIED CARBON-
#       BASED OPTIMIZATION
# Constraint for Failure in Average Depths Evaluation
permessible_deflection_l_250_m = Panel(permessible_deflection_m)
column_sufficiency_check = Panel(py3.Col_Check)
multiplication_11 = Multiplication(A=permessible_deflection_l_250_m, B=100)
actual_def_cm = Panel(item)
permessible_deflection_cm = Panel(multiplication_11)

# ----
# In questa versione manca il controllo sulle quote massime
# La versione 16/09 è sul pc del lab
division_5 = Division(A=actual_def_cm, B=permessible_deflection_cm)  # -> flatten(Result)

# ----
# Column Sufficiency Constraint
expression_2 = Expression(x=column_sufficiency_check, y="1", Expression="If(x>y, 1000000000, 0)")
panel_26 = Panel(expression_2)

# ----
# Maximum Deflection Constraint
expression_3 = Expression(x=permessible_deflection_cm, y=actual_def_cm, Expression="If(x<y, 1000000000, 0)")
panel_27 = Panel(expression_3)

panel_28 = Panel(division_5)

addition_3 = Addition(CO2=total_embodied_carbon, Penality1=panel_26, Penality2=panel_27, Penality3=panel_22)  # -> flatten(Result)
data = Data(addition_3)
